# Grasshopper definition new-bay-assembly.gh (Grasshopper 1.0.8)

# ---- group: 01 / SOURCE
# 01 / SOURCE
# Actual saved Breps / unchanged shapes
source_frame_connector = SourceFrameConnector(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)
source_frame_member = SourceFrameMember(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)

# ---- group: 02 / PLACE
# 02 / PLACE
# New 2026 bay / source pitch 13.2881 cm
_8_node_placements = _8NodePlacements([Vector(-55.55869996, -3.814697266e-06, -98.93849309), Vector(-42.27720473, -3.814697266e-06, -98.93849309), Vector(-55.55869996, 13.28149141, -98.93849309), Vector(-42.27720473, 13.28149141, -98.93849309), Vector(-55.55869996, -3.814697266e-06, -85.65699786), Vector(-42.27720473, -3.814697266e-06, -85.65699786), Vector(-55.55869996, 13.28149141, -85.65699786), Vector(-42.27720473, 13.28149141, -85.65699786)])
member_source_plane = MemberSourcePlane(PlaneXY(0, 0, 0))
_12_member_placements = _12MemberPlacements([Plane(origin=(55.55869996, -3.814697266e-06, 98.93849309), x=(-1, 0, 0), y=(0, 1, 0)), Plane(origin=(-3.814697266e-06, 55.55869996, -98.93849309), x=(0, -1, 0), y=(1, 0, 0)), Plane(origin=(-98.93849309, -3.814697266e-06, 55.55869996), x=(0, 0, -1), y=(0, 1, 0)), Plane(origin=(13.28149141, 55.55869996, -98.93849309), x=(0, -1, 0), y=(1, 0, 0)), Plane(origin=(-85.65699786, -3.814697266e-06, 55.55869996), x=(0, 0, -1), y=(0, 1, 0)), Plane(origin=(55.55869996, 13.28149141, 98.93849309), x=(-1, 0, 0), y=(0, 1, 0))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])

# ---- group: 03 / TRANSFORM
# 03 / TRANSFORM
# Rigid moves and rotations
move = Move(Geometry=source_frame_connector, Motion=_8_node_placements)  # -> Geometry, Transform
orient = Orient(Geometry=source_frame_member, Source=member_source_plane, Target=_12_member_placements)  # -> Geometry, Transform

# ---- group: 04 / ASSEMBLY
# 04 / ASSEMBLY
# 8 connectors + 12 members
placed_connectors = PlacedConnectors(move.Geometry)
placed_members = PlacedMembers(orient.Geometry)
lng = ListLength(List=placed_connectors)
lng_2 = ListLength(List=placed_members)

# ----
nodes = Panel(lng)
members = Panel(lng_2)
