# Grasshopper definition Original_Grasshopper_Source.ghx (Grasshopper 1.0.8)

# ---- group: culm_tip2
geo = Geometry([<brep referenced from the Rhino model> x9])
# culm_2
panel = Panel("""10
11""")
debrep = DeconstructBrep(Brep=geo)  # -> simplify(Faces), Edges, simplify(Vertices)
panel_2 = Panel("""4
5""")
panel_3 = Panel("""3
5""")
entwine = Entwine(Branch00=panel, Branch01=panel_2, FlattenInputs=True)
branch = TreeBranch(Tree=debrep.Vertices, Path=panel_3, MaintainPaths=True)
# culm_1
item = ListItem(List=branch, Index=entwine, Wrap=True)
item_2 = ListItem(List=flatten(item), Index=0, Wrap=True)  # -> Item, Item1, Item2, Item3
merge = Merge(Data1=item_2.Item3, Data2=item_2.Item1, Data3=item_2.Item, Data4=item_2.Item2)
knob = ControlKnob(Decimals=0, Limit=True, Maximum=40, Minimum=0, Range=360, Value=30)
pline = PolyLine(Vertices=merge, Closed=True)
crv = Curve(pline)
explode = Explode(Curve=crv, Recursive=True)  # -> Segments, Vertices
item_3 = ListItem(List=explode.Segments, Index=0, Wrap=True)  # -> Item, Item1
number_slider = Slider(0.06, range=0..0.1)
number_slider_2 = Slider(0.04, range=0..0.1)
midpt = CurveMiddle(Curve=item_3.Item)
midpt_2 = CurveMiddle(Curve=item_3.Item1)
area = Area(Geometry=crv)
vec2pt = Vector2Pt(PointA=area, PointB=midpt, Unitize=True)  # -> Vector, Length
vec2pt_2 = Vector2Pt(PointA=area, PointB=midpt_2, Unitize=True)  # -> Vector, Length
line = LineSDL(Start=area, Direction=vec2pt.Vector, Length=Slider(1.3, range=0..5))
rev = Reverse(Vector=vec2pt.Vector)
multiplication = Multiplication(A=rev, B=Slider(0.17, range=0..0.2))
move = Move(Geometry=line, Motion=multiplication)  # -> Geometry, Transform
pframes = PerpFrames(Curve=move.Geometry, Count=1, Align=True)  # -> Frames, Parameters
number_slider_3 = Slider(0.25, range=0..0.25)
rot3d = Rotate3D(Geometry=pframes.Frames, Angle=expr("90-x", degrees(knob)), Center=area, Axis=vec2pt_2.Vector)  # -> Geometry, Transform
dom = ConstructDomain(DomainStart=expr("x/2", number_slider), DomainEnd=expr("(x/2)*-1", number_slider))
dom_2 = ConstructDomain(DomainStart=expr("x/2", number_slider_2), DomainEnd=expr("(x/2)*-1", number_slider_2))
subtraction = Subtraction(A=0.5, B=number_slider_3)
addition = Addition(A=number_slider_3, B=0.5)
dom_3 = ConstructDomain(DomainStart=Slider(0.32, range=0..1), DomainEnd=Slider(0.97, range=0..1))
merge_2 = Merge(Data1=subtraction, Data2=addition)
range = Range(Domain=dom_3, Steps=Slider(100, range=0..100))
rectangle = Rectangle(Plane=rot3d.Geometry, XSize=dom, YSize=dom_2, Radius=0)  # -> Rectangle, Length
crossref = CrossReference(ListA=range, ListB=merge_2, CrossMode=1)  # -> ListA, ListB
loft = Loft(
    Curves=rectangle.Rectangle,
    Options={Adjust=False, Closed=False, LoftEnds=0, LoftSimp=0, LoftType=3, Rebuild=10, Refit=0.01})
debrep_2 = DeconstructBrep(Brep=loft)  # -> Faces, Edges, Vertices
pt = ConstructPoint(XCoordinate=crossref.ListA, YCoordinate=reverse(crossref.ListB), ZCoordinate=0)
pt_2 = ConstructPoint(XCoordinate=crossref.ListA, YCoordinate=crossref.ListB, ZCoordinate=0)
item_4 = ListItem(List=debrep_2.Faces, Index=[1, 3], Wrap=True)
cull_i = CullIndex(List=debrep_2.Faces, Indices=[1, 3], Wrap=True)
entwine_2 = Entwine(Branch00=pt, Branch01=pt_2, FlattenInputs=True)
evalsrf = EvaluateSurface(Surface=reparameterize(graft(item_4)), Point=entwine_2)  # -> Point, Normal, UDirection, VDirection, Frame
circle = CircleCNR(Center=evalsrf.Point, Normal=evalsrf.Normal, Radius=Slider(0.003, range=0..0.01))
flip = FlipMatrix(Data=circle)
srfsplit = SurfaceSplit(Surface=graft(item_4), Curves=circle)
loft_2 = Loft(Curves=flip, Options={Adjust=True, Closed=False, LoftEnds=0, LoftSimp=0, LoftType=0, Rebuild=10, Refit=0.01})  # -> flatten(Loft)
item_5 = ListItem(List=srfsplit, Index=0, Wrap=True)  # -> flatten(Item)
relay = Relay([loft_2, cull_i])
join = BrepJoin(Breps=flatten([item_5, relay]))  # -> Breps, Closed
cap = CapHoles(Brep=join.Breps)

geo_2 = Geometry([<brep referenced from the Rhino model> x9])
# culm_3
panel_4 = Panel("""10
11""")
debrep_3 = DeconstructBrep(Brep=geo_2)  # -> simplify(Faces), Edges, simplify(Vertices)
panel_5 = Panel("""4
5""")
panel_6 = Panel("""3
5""")
entwine_3 = Entwine(Branch00=panel_4, Branch01=panel_5, FlattenInputs=True)
branch_2 = TreeBranch(Tree=debrep_3.Vertices, Path=panel_6, MaintainPaths=True)
item_6 = ListItem(List=branch_2, Index=entwine_3, Wrap=True)
item_7 = ListItem(List=flatten(item_6), Index=0, Wrap=True)  # -> Item, Item1, Item2, Item3
merge_3 = Merge(Data1=item_7.Item3, Data2=item_7.Item1, Data3=item_7.Item, Data4=item_7.Item2)
knob_2 = ControlKnob(Decimals=0, Limit=True, Maximum=40, Minimum=0, Range=360, Value=30)
pline_2 = PolyLine(Vertices=merge_3, Closed=True)
crv_2 = Curve(pline_2)
explode_2 = Explode(Curve=crv_2, Recursive=True)  # -> Segments, Vertices
item_8 = ListItem(List=explode_2.Segments, Index=0, Wrap=True)  # -> Item, Item1
number_slider_4 = Slider(0.06, range=0..0.1)
number_slider_5 = Slider(0.04, range=0..0.1)
midpt_3 = CurveMiddle(Curve=item_8.Item)
midpt_4 = CurveMiddle(Curve=item_8.Item1)
area_2 = Area(Geometry=crv_2)
vec2pt_3 = Vector2Pt(PointA=area_2, PointB=midpt_3, Unitize=True)  # -> Vector, Length
vec2pt_4 = Vector2Pt(PointA=area_2, PointB=midpt_4, Unitize=True)  # -> Vector, Length
line_2 = LineSDL(Start=area_2, Direction=vec2pt_3.Vector, Length=Slider(1.9, range=0..5))
rev_2 = Reverse(Vector=vec2pt_3.Vector)
multiplication_2 = Multiplication(A=rev_2, B=Slider(0.17, range=0..0.2))
move_2 = Move(Geometry=line_2, Motion=multiplication_2)  # -> Geometry, Transform
pframes_2 = PerpFrames(Curve=move_2.Geometry, Count=1, Align=True)  # -> Frames, Parameters
number_slider_6 = Slider(0.25, range=0..0.25)
rot3d_2 = Rotate3D(Geometry=pframes_2.Frames, Angle=expr("90-x", degrees(knob_2)), Center=area_2, Axis=vec2pt_4.Vector)  # -> Geometry, Transform
dom_4 = ConstructDomain(DomainStart=expr("x/2", number_slider_4), DomainEnd=expr("(x/2)*-1", number_slider_4))
dom_5 = ConstructDomain(DomainStart=expr("x/2", number_slider_5), DomainEnd=expr("(x/2)*-1", number_slider_5))
subtraction_2 = Subtraction(A=0.5, B=number_slider_6)
addition_2 = Addition(A=number_slider_6, B=0.5)
dom_6 = ConstructDomain(DomainStart=Slider(0.24, range=0..1), DomainEnd=Slider(0.97, range=0..1))
merge_4 = Merge(Data1=subtraction_2, Data2=addition_2)
range_2 = Range(Domain=dom_6, Steps=Slider(100, range=0..100))
rectangle_2 = Rectangle(Plane=rot3d_2.Geometry, XSize=dom_4, YSize=dom_5, Radius=0)  # -> Rectangle, Length
crossref_2 = CrossReference(ListA=range_2, ListB=merge_4, CrossMode=1)  # -> ListA, ListB
loft_3 = Loft(
    Curves=rectangle_2.Rectangle,
    Options={Adjust=False, Closed=False, LoftEnds=0, LoftSimp=0, LoftType=3, Rebuild=10, Refit=0.01})
debrep_4 = DeconstructBrep(Brep=loft_3)  # -> Faces, Edges, Vertices
pt_3 = ConstructPoint(XCoordinate=crossref_2.ListA, YCoordinate=reverse(crossref_2.ListB), ZCoordinate=0)
pt_4 = ConstructPoint(XCoordinate=crossref_2.ListA, YCoordinate=crossref_2.ListB, ZCoordinate=0)
item_9 = ListItem(List=debrep_4.Faces, Index=[1, 3], Wrap=True)
cull_i_2 = CullIndex(List=debrep_4.Faces, Indices=[1, 3], Wrap=True)
entwine_4 = Entwine(Branch00=pt_3, Branch01=pt_4, FlattenInputs=True)
evalsrf_2 = EvaluateSurface(Surface=reparameterize(graft(item_9)), Point=entwine_4)  # -> Point, Normal, UDirection, VDirection, Frame
circle_2 = CircleCNR(Center=evalsrf_2.Point, Normal=evalsrf_2.Normal, Radius=Slider(0.003, range=0..0.01))
flip_2 = FlipMatrix(Data=circle_2)
srfsplit_2 = SurfaceSplit(Surface=graft(item_9), Curves=circle_2)
loft_4 = Loft(Curves=flip_2, Options={Adjust=True, Closed=False, LoftEnds=0, LoftSimp=0, LoftType=0, Rebuild=10, Refit=0.01})  # -> flatten(Loft)
item_10 = ListItem(List=srfsplit_2, Index=0, Wrap=True)  # -> flatten(Item)
relay_2 = Relay([loft_4, cull_i_2])
join_2 = BrepJoin(Breps=flatten([item_10, relay_2]))  # -> Breps, Closed
cap_2 = CapHoles(Brep=join_2.Breps)

geo_3 = Geometry([<brep referenced from the Rhino model> x9])
# culm_4
panel_7 = Panel("""10
11""")
debrep_5 = DeconstructBrep(Brep=geo_3)  # -> simplify(Faces), Edges, simplify(Vertices)
panel_8 = Panel("""4
5""")
panel_9 = Panel("""3
5""")
entwine_5 = Entwine(Branch00=panel_7, Branch01=panel_8, FlattenInputs=True)
branch_3 = TreeBranch(Tree=debrep_5.Vertices, Path=panel_9, MaintainPaths=True)
item_11 = ListItem(List=branch_3, Index=entwine_5, Wrap=True)
item_12 = ListItem(List=flatten(item_11), Index=0, Wrap=True)  # -> Item, Item1, Item2, Item3
merge_5 = Merge(Data1=item_12.Item3, Data2=item_12.Item1, Data3=item_12.Item, Data4=item_12.Item2)
# culm_5
knob_3 = ControlKnob(Decimals=0, Limit=True, Maximum=40, Minimum=0, Range=360, Value=21)
pline_3 = PolyLine(Vertices=merge_5, Closed=True)
crv_3 = Curve(pline_3)
explode_3 = Explode(Curve=crv_3, Recursive=True)  # -> Segments, Vertices
item_13 = ListItem(List=explode_3.Segments, Index=0, Wrap=True)  # -> Item, Item1
number_slider_7 = Slider(0.06, range=0..0.1)
number_slider_8 = Slider(0.04, range=0..0.1)
midpt_5 = CurveMiddle(Curve=item_13.Item)
midpt_6 = CurveMiddle(Curve=item_13.Item1)
area_3 = Area(Geometry=crv_3)
vec2pt_5 = Vector2Pt(PointA=area_3, PointB=midpt_5, Unitize=True)  # -> Vector, Length
vec2pt_6 = Vector2Pt(PointA=area_3, PointB=midpt_6, Unitize=True)  # -> Vector, Length
line_3 = LineSDL(Start=area_3, Direction=vec2pt_5.Vector, Length=Slider(2.1, range=0..5))
rev_3 = Reverse(Vector=vec2pt_5.Vector)
multiplication_3 = Multiplication(A=rev_3, B=Slider(0.17, range=0..0.2))
move_3 = Move(Geometry=line_3, Motion=multiplication_3)  # -> Geometry, Transform
pframes_3 = PerpFrames(Curve=move_3.Geometry, Count=1, Align=True)  # -> Frames, Parameters
number_slider_9 = Slider(0.25, range=0..0.25)
rot3d_3 = Rotate3D(Geometry=pframes_3.Frames, Angle=expr("90-x", degrees(knob_3)), Center=area_3, Axis=vec2pt_6.Vector)  # -> Geometry, Transform
dom_7 = ConstructDomain(DomainStart=expr("x/2", number_slider_7), DomainEnd=expr("(x/2)*-1", number_slider_7))
dom_8 = ConstructDomain(DomainStart=expr("x/2", number_slider_8), DomainEnd=expr("(x/2)*-1", number_slider_8))
subtraction_3 = Subtraction(A=0.5, B=number_slider_9)
addition_3 = Addition(A=number_slider_9, B=0.5)
dom_9 = ConstructDomain(DomainStart=Slider(0.24, range=0..1), DomainEnd=Slider(0.97, range=0..1))
merge_6 = Merge(Data1=subtraction_3, Data2=addition_3)
range_3 = Range(Domain=dom_9, Steps=Slider(100, range=0..100))
rectangle_3 = Rectangle(Plane=rot3d_3.Geometry, XSize=dom_7, YSize=dom_8, Radius=0)  # -> Rectangle, Length
crossref_3 = CrossReference(ListA=range_3, ListB=merge_6, CrossMode=1)  # -> ListA, ListB
loft_5 = Loft(
    Curves=rectangle_3.Rectangle,
    Options={Adjust=False, Closed=False, LoftEnds=0, LoftSimp=0, LoftType=3, Rebuild=10, Refit=0.01})
debrep_6 = DeconstructBrep(Brep=loft_5)  # -> Faces, Edges, Vertices
pt_5 = ConstructPoint(XCoordinate=crossref_3.ListA, YCoordinate=reverse(crossref_3.ListB), ZCoordinate=0)
pt_6 = ConstructPoint(XCoordinate=crossref_3.ListA, YCoordinate=crossref_3.ListB, ZCoordinate=0)
item_14 = ListItem(List=debrep_6.Faces, Index=[1, 3], Wrap=True)
cull_i_3 = CullIndex(List=debrep_6.Faces, Indices=[1, 3], Wrap=True)
entwine_6 = Entwine(Branch00=pt_5, Branch01=pt_6, FlattenInputs=True)
evalsrf_3 = EvaluateSurface(Surface=reparameterize(graft(item_14)), Point=entwine_6)  # -> Point, Normal, UDirection, VDirection, Frame
circle_3 = CircleCNR(Center=evalsrf_3.Point, Normal=evalsrf_3.Normal, Radius=Slider(0.003, range=0..0.01))
flip_3 = FlipMatrix(Data=circle_3)
srfsplit_3 = SurfaceSplit(Surface=graft(item_14), Curves=circle_3)
loft_6 = Loft(Curves=flip_3, Options={Adjust=True, Closed=False, LoftEnds=0, LoftSimp=0, LoftType=0, Rebuild=10, Refit=0.01})  # -> flatten(Loft)
item_15 = ListItem(List=srfsplit_3, Index=0, Wrap=True)  # -> flatten(Item)
relay_3 = Relay([loft_6, cull_i_3])
join_3 = BrepJoin(Breps=flatten([item_15, relay_3]))  # -> Breps, Closed
cap_3 = CapHoles(Brep=join_3.Breps)

# ---- group: culm_tip1
geo_4 = Geometry([<brep referenced from the Rhino model> x9])
debrep_7 = DeconstructBrep(Brep=geo_4)  # -> simplify(Faces), Edges, simplify(Vertices)
panel_10 = Panel("""2
6""")
entwine_7 = Entwine(Branch00="5", Branch01="1", Branch02="10", FlattenInputs=True)
branch_4 = TreeBranch(Tree=debrep_7.Vertices, Path=panel_10, MaintainPaths=True)
item_16 = ListItem(List=branch_4, Index=entwine_7, Wrap=True)  # -> flatten(Item)
item_17 = ListItem(List=item_16, Index=0, Wrap=True)  # -> Item, Item1, Item2
number_slider_10 = Slider(0.04, range=0..1)
number_slider_11 = Slider(0.25, range=0..0.25)
vec2pt_7 = Vector2Pt(PointA=item_17.Item1, PointB=item_17.Item2, Unitize=True)  # -> Vector, Length
vec2pt_8 = Vector2Pt(PointA=item_17.Item, PointB=item_17.Item1, Unitize=False)  # -> Vector, Length
line_4 = LineSDL(Start=item_17.Item, Direction=vec2pt_7.Vector, Length=Slider(2.2, range=1..4))
subtraction_4 = Subtraction(A=0.5, B=number_slider_11)
addition_4 = Addition(A=number_slider_11, B=0.5)
vlen = VectorLength(Vector=vec2pt_8.Vector)
dom_10 = ConstructDomain(DomainStart=number_slider_10, DomainEnd=expr("1-x", number_slider_10))
midpt_7 = CurveMiddle(Curve=line_4)
merge_7 = Merge(Data1=subtraction_4, Data2=addition_4)
range_4 = Range(Domain=dom_10, Steps=Slider(100, range=0..100))
line_5 = LineSDL(Start=midpt_7, Direction=vec2pt_8.Vector, Length=vlen)
Z = UnitZ(Factor=Slider(0.09, range=0..0.1))
crossref_4 = CrossReference(ListA=range_4, ListB=merge_7, CrossMode=1)  # -> ListA, ListB
extr = Extrude(Base=line_4, Direction=line_5)
pl = ConstructPlane(Origin=midpt_7, XAxis=line_5, YAxis=Z)
pt_7 = ConstructPoint(XCoordinate=crossref_4.ListB, YCoordinate=reverse(crossref_4.ListA), ZCoordinate=0)
pt_8 = ConstructPoint(XCoordinate=crossref_4.ListB, YCoordinate=crossref_4.ListA, ZCoordinate=0)
extr_2 = Extrude(Base=extr, Direction=expr("x*-1", Z))
mirror = Mirror(Geometry=geo_4, Plane=pl)  # -> Geometry, Transform
entwine_8 = Entwine(Branch00=pt_7, Branch01=pt_8, FlattenInputs=True)
debrep_8 = DeconstructBrep(Brep=extr_2)  # -> Faces, Edges, Vertices
item_18 = ListItem(List=debrep_8.Faces, Index=[4, 2], Wrap=True)
evalsrf_4 = EvaluateSurface(Surface=reparameterize(graft(item_18)), Point=entwine_8)  # -> Point, Normal, UDirection, VDirection, Frame
circle_4 = CircleCNR(Center=evalsrf_4.Point, Normal=evalsrf_4.Normal, Radius=Slider(0.003, range=0..0.01))
flip_4 = FlipMatrix(Data=circle_4)
srfsplit_4 = SurfaceSplit(Surface=graft(item_18), Curves=circle_4)
loft_7 = Loft(Curves=flip_4, Options={Adjust=True, Closed=False, LoftEnds=0, LoftSimp=0, LoftType=0, Rebuild=10, Refit=0.01})  # -> flatten(Loft)
item_19 = ListItem(List=srfsplit_4, Index=0, Wrap=True)
cull_i_4 = CullIndex(List=debrep_8.Faces, Indices=[2, 4], Wrap=True)
join_4 = BrepJoin(Breps=flatten([item_19, loft_7, cull_i_4]))  # -> Breps, Closed

geo_5 = Geometry([<brep referenced from the Rhino model> x9])
debrep_9 = DeconstructBrep(Brep=geo_5)  # -> simplify(Faces), Edges, simplify(Vertices)
panel_11 = Panel("""2
6""")
entwine_9 = Entwine(Branch00="5", Branch01="1", Branch02="10", FlattenInputs=True)
branch_5 = TreeBranch(Tree=debrep_9.Vertices, Path=panel_11, MaintainPaths=True)
item_20 = ListItem(List=branch_5, Index=entwine_9, Wrap=True)  # -> flatten(Item)
item_21 = ListItem(List=item_20, Index=0, Wrap=True)  # -> Item, Item1, Item2
number_slider_12 = Slider(0.04, range=0..1)
number_slider_13 = Slider(0.25, range=0..0.25)
vec2pt_9 = Vector2Pt(PointA=item_21.Item1, PointB=item_21.Item2, Unitize=True)  # -> Vector, Length
vec2pt_10 = Vector2Pt(PointA=item_21.Item, PointB=item_21.Item1, Unitize=False)  # -> Vector, Length
line_6 = LineSDL(Start=item_21.Item, Direction=vec2pt_9.Vector, Length=Slider(1.9, range=1..4))
subtraction_5 = Subtraction(A=0.5, B=number_slider_13)
addition_5 = Addition(A=number_slider_13, B=0.5)
vlen_2 = VectorLength(Vector=vec2pt_10.Vector)
dom_11 = ConstructDomain(DomainStart=number_slider_12, DomainEnd=expr("1-x", number_slider_12))
midpt_8 = CurveMiddle(Curve=line_6)
merge_8 = Merge(Data1=subtraction_5, Data2=addition_5)
range_5 = Range(Domain=dom_11, Steps=Slider(100, range=0..100))
line_7 = LineSDL(Start=midpt_8, Direction=vec2pt_10.Vector, Length=vlen_2)
Z_2 = UnitZ(Factor=Slider(0.09, range=0..0.1))
crossref_5 = CrossReference(ListA=range_5, ListB=merge_8, CrossMode=1)  # -> ListA, ListB
extr_3 = Extrude(Base=line_6, Direction=line_7)
pl_2 = ConstructPlane(Origin=midpt_8, XAxis=line_7, YAxis=Z_2)
pt_9 = ConstructPoint(XCoordinate=crossref_5.ListB, YCoordinate=reverse(crossref_5.ListA), ZCoordinate=0)
pt_10 = ConstructPoint(XCoordinate=crossref_5.ListB, YCoordinate=crossref_5.ListA, ZCoordinate=0)
extr_4 = Extrude(Base=extr_3, Direction=expr("x*-1", Z_2))
mirror_2 = Mirror(Geometry=geo_5, Plane=pl_2)  # -> Geometry, Transform
entwine_10 = Entwine(Branch00=pt_9, Branch01=pt_10, FlattenInputs=True)
debrep_10 = DeconstructBrep(Brep=extr_4)  # -> Faces, Edges, Vertices
item_22 = ListItem(List=debrep_10.Faces, Index=[4, 2], Wrap=True)
evalsrf_5 = EvaluateSurface(Surface=reparameterize(graft(item_22)), Point=entwine_10)  # -> Point, Normal, UDirection, VDirection, Frame
circle_5 = CircleCNR(Center=evalsrf_5.Point, Normal=evalsrf_5.Normal, Radius=Slider(0.003, range=0..0.01))
flip_5 = FlipMatrix(Data=circle_5)
srfsplit_5 = SurfaceSplit(Surface=graft(item_22), Curves=circle_5)
loft_8 = Loft(Curves=flip_5, Options={Adjust=True, Closed=False, LoftEnds=0, LoftSimp=0, LoftType=0, Rebuild=10, Refit=0.01})  # -> flatten(Loft)
item_23 = ListItem(List=srfsplit_5, Index=0, Wrap=True)
cull_i_5 = CullIndex(List=debrep_10.Faces, Indices=[2, 4], Wrap=True)
join_5 = BrepJoin(Breps=flatten([item_23, loft_8, cull_i_5]))  # -> Breps, Closed

# ----
gap_1 = BooleanToggle(False)
gap_2 = BooleanToggle(False)
gap_3 = BooleanToggle(True)
gap_4 = BooleanToggle(True)
multiplication_4 = Multiplication(A=gap_1, B=1)
multiplication_5 = Multiplication(A=gap_2, B=2)
multiplication_6 = Multiplication(A=gap_3, B=3)
multiplication_7 = Multiplication(A=gap_4, B=4)
merge_9 = Merge(Data1=multiplication_4, Data2=multiplication_5, Data3=multiplication_6, Data4=multiplication_7)
weave = Weave(Pattern=merge_9, Stream0=0, Stream1=[2, 3], Stream2=[4, 5], Stream3=[6, 7], Stream4=[8, 9], NullGaps=False)
equals = Equality(FirstNumber=weave, SecondNumber=0)  # -> Equality, Inequality
cull = CullPattern(List=weave, CullPattern=equals.Inequality)
sort = SortList(Keys=cull)  # -> Keys, ValuesA

branch_6 = TreeBranch(Tree=simplify(evalsrf_4.Point), Path="0", MaintainPaths=True)
branch_7 = TreeBranch(Tree=simplify(evalsrf_5.Point), Path="1", MaintainPaths=True)
entwine_11 = Entwine(
    Branch0X=simplify(evalsrf_4.Point),
    Branch1X=simplify(evalsrf.Point),
    Branch2X=simplify(evalsrf_2.Point),
    Branch3X=simplify(evalsrf_3.Point),
    Branch4X=simplify(evalsrf_5.Point),
    FlattenInputs=False)
path_mapper = PathMapper(entwine_11, source="{a;b}(i)", target="{i;b}(a)")
ln = Line(StartPoint=branch_6, EndPoint=branch_7)
trim = TrimTree(Tree=path_mapper, Depth=1)
alongcrv = SortAlongCurve(Points=trim, Curve=graft(ln))  # -> Points, Indices
path_mapper_2 = PathMapper(alongcrv.Points, source="{a;b;0}(i)", target="{b}(i)")
flip_6 = FlipMatrix(Data=path_mapper_2)
# solver
bang = ExplodeTree(Data=flip_6)  # -> Branch0, Branch1, Branch2, Branch3, Branch4, Branch5, Branch6, Branch7, Branch8, Branch9
entwine_12 = Entwine(
    Branch00=bang.Branch1,
    Branch01=bang.Branch0,
    Branch02=bang.Branch2,
    Branch03=bang.Branch3,
    Branch04=bang.Branch4,
    Branch05=bang.Branch5,
    Branch06=bang.Branch6,
    Branch07=bang.Branch7,
    Branch08=bang.Branch9,
    Branch09=bang.Branch8,
    FlattenInputs=True)
split = SplitList(List=entwine_12, Index=101)  # -> simplify(ListA), simplify(ListB)
start_color = ColourSwatch(SwatchColor=RGB(255, 145, 0))
end_color = ColourSwatch(SwatchColor=RGB(255, 255, 255))
ln_2 = Line(StartPoint=start_color, EndPoint=end_color)
divide = DivideCurve(Curve=ln_2, Count=100, Kinks=False)  # -> Points, Tangents, Parameters

rev_4 = ReverseList(List=split.ListA)
flip_7 = FlipMatrix(Data=split.ListA)
flip_8 = FlipMatrix(Data=rev_4)
item_24 = ListItem(List=flip_8, Index=sort.Keys, Wrap=True)
replace = ReplaceItems(List=flip_7, Item=item_24, Indices=sort.Keys, Wrap=False)
pline_4 = PolyLine(Vertices=replace, Closed=False)

rev_5 = ReverseList(List=split.ListB)
flip_9 = FlipMatrix(Data=split.ListB)
flip_10 = FlipMatrix(Data=rev_5)
item_25 = ListItem(List=flip_10, Index=sort.Keys, Wrap=True)
replace_2 = ReplaceItems(List=flip_9, Item=item_25, Indices=sort.Keys, Wrap=False)
pline_5 = PolyLine(Vertices=replace_2, Closed=False)

merge_10 = Merge(Data1=pline_4, Data2=pline_5)
mp = MultiPipe(Curves=merge_10, NodeSize=0.001, EndOffset=1, StrutSize=1, Segment=0, KinkAngle=0.6, CubeFit=0, Caps=0)
preview = CustomPreview(Geometry=mp, Material=graft(divide.Points))
