# Grasshopper definition python study 1.gh (Grasshopper 1.0.8)

python_3_script = Python3Script(
    grid_size=Slider(9, range=0..10),
    seed=Slider(7, range=0..10),
    num_agents=Slider(271, range=0..1000),
    gravity_weight=Slider(0.5, range=0..10),
    daylight_weight=Slider(2.47, range=0..10),
    reset=Toggle(False))  # -> out, boxes, colors; inputs grid_size: Int32, seed: Int32, num_agents: Int32, gravity_weight: Double, daylight_weight: Double, reset: Boolean; disabled
# ---------- python_3_script: Python ----------
import Rhino.Geometry as rg
import System.Drawing as sd
import random

# grid dimensions
sx = sy = sz = grid_size

# voxel size
vs = 3.0

random.seed(seed)

# track occupied cells
occupied = set()

# all possible cells
def neighbors_6(x, y, z):
    """6-connected neighbors"""
    dirs = [(1,0,0),(-1,0,0),(0,1,0),(0,-1,0),(0,0,1),(0,0,-1)]
    out = []
    for dx, dy, dz in dirs:
        nx, ny, nz = x+dx, y+dy, z+dz
        if 0 <= nx < sx and 0 <= ny < sy and 0 <= nz < sz:
            out.append((nx, ny, nz))
    return out

def exposed_faces(x, y, z):
    """count how many of 6 faces are not touching another occupied cell or are on boundary"""
    count = 0
    dirs = [(1,0,0),(-1,0,0),(0,1,0),(0,-1,0),(0,0,1),(0,0,-1)]
    for dx, dy, dz in dirs:
        nx, ny, nz = x+dx, y+dy, z+dz
        if not (0 <= nx < sx and 0 <= ny < sy and 0 <= nz < sz):
            count += 1  # boundary face = exposed
        elif (nx, ny, nz) not in occupied:
            count += 1
    return count

def get_candidates():
    """cells that are either ground level or adjacent to an occupied cell"""
    candidates = set()
    if len(occupied) == 0:
        # first agent: any ground cell
        for x in range(sx):
            for y in range(sy):
                candidates.add((x, y, 0))
    else:
        for cell in occupied:
            for n in neighbors_6(*cell):
                if n not in occupied:
                    candidates.add(n)
    return list(candidates)

def score_cell(x, y, z):
    """higher score = more desirable"""
    # gravity: prefer lower z
    max_z = float(sz - 1)
    gravity_score = 1.0 - (z / max_z) if max_z > 0 else 1.0
    
    # daylight: prefer more exposed faces
    daylight_score = exposed_faces(x, y, z) / 6.0
    
    total = gravity_weight * gravity_score + daylight_weight * daylight_score
    return total

# run growth
placement_order = []

for i in range(num_agents):
    candidates = get_candidates()
    if not candidates:
        break
    
    # score all candidates
    scored = [(score_cell(*c), c) for c in candidates]
    scored.sort(key=lambda x: x[0], reverse=True)
    
    # pick from top candidates with some randomness
    # take top 20% and choose randomly among them
    top_n = max(1, len(scored) // 5)
    pick = random.choice(scored[:top_n])
    
    cell = pick[1]
    occupied.add(cell)
    placement_order.append(cell)

# generate geometry
boxes = []
colors = []

for i, (x, y, z) in enumerate(placement_order):
    # create box
    origin = rg.Point3d(x * vs, y * vs, z * vs)
    box = rg.Box(
        rg.Plane(origin, rg.Vector3d.ZAxis),
        rg.Interval(0, vs * 0.95),
        rg.Interval(0, vs * 0.95),
        rg.Interval(0, vs * 0.95)
    )
    boxes.append(box.ToBrep())
    
    # color: blue (early) to red (late)
    t = i / max(1.0, float(len(placement_order) - 1))
    r = int(255 * t)
    b = int(255 * (1.0 - t))
    colors.append(sd.Color.FromArgb(r, 50, b))
# ---------- end python_3_script ----------
python_3_script_2 = Python3Script(x=Slider(0.42, range=0..1), y=Slider(0.1, range=0..1))  # -> out, a; disabled
# ---------- python_3_script_2: Python ----------
import math
import Rhino.Geometry as rg

n = 20
plist = []

for i in range (n):
    for j in range (n):
        height = math.cos(x*i) * math.cos(y*j) * 3
        plist.append(rg.Point3d(i, j, height))


plane = [rg.Plane(p, rg.Vector3d.ZAxis) for p in plist]
scale = rg.Interval(-0.5, 0.5)

box = [rg.Box(p, scale, scale, scale,) for p in plane]

a = box
# ---------- end python_3_script_2 ----------
python_3_script_3 = Python3Script(x=Slider(0.43, range=0..1), y=Slider(0.43, range=0..1))  # -> out, a; disabled
# ---------- python_3_script_3: Python ----------
import math
import Rhino.Geometry as rg

n = 30
plist = []
leng = 6
cent = n/2

for i in range (n):
    for j in range (n):
        dist = math.sqrt((cent-i)**2 + (cent-j)**2)
        if (dist > leng):
            height = math.cos(x*i) * math.cos(y*j) * 3
            plist.append(rg.Point3d(i, j, height))


plane = [rg.Plane(p, rg.Vector3d.ZAxis) for p in plist]
scale = rg.Interval(-0.5, 0.5)

box = [rg.Box(p, scale, scale, scale,) for p in plane]

a = box
# ---------- end python_3_script_3 ----------
python_3_script_4 = Python3Script()  # -> out, a, b; disabled
# ---------- python_3_script_4: Python ----------
import math
import random as rnd
import Rhino.Geometry as rg

rnd.seed(1)
pts = []
pln = []
bx = []

ptswin = []
plnwin = []
win =[]

floor = 10
height = 4
min = 4
max =10

for i in range(floor):

    pts.append(rg.Point3d(0, 0, i * height))
    pln.append(rg.Plane(pts[i], rg.Vector3d.ZAxis))

    x = rnd.uniform(min, max)
    y = rnd.uniform(min, max)

    bx.append(rg.Box(pln[i], rg.Interval(0, x), rg.Interval(0, y), rg.Interval(0, height)))

    ptswin.append(rg.Point3d(x/2, y, i * height+(height/2)))
    plnwin.append(rg.Plane(ptswin[i], rg.Vector3d.ZAxis))

    win.append(rg.Box(plnwin[i], rg.Interval(-i/floor, i/floor), rg.Interval(-0.1, 0.1), rg.Interval(-i/floor, i/floor)))

a = bx
b = win
# ---------- end python_3_script_4 ----------
custom_preview = CustomPreview(Geometry=python_3_script.boxes, Material=python_3_script.colors)
