# Grasshopper definition python study 10 ellipsoid wallacei.gh (Grasshopper 1.0.8)
# plug-ins: Wallacei

# GEOMTRY CREATION
gene_pool = GenePool(
    Decimals=1,
    Maximum=1,
    Minimum=0,
    Value=[0.6361124437, 0.5449117902, 0.1535487238, 0.3624196647, 0.09863400515, 0.249912262, 0.5393066562, 0.2197044035, 0.2254664431, 0.7325039672, 0.3303355058, 0.5231079572, 0.2768792813, 0.2692962086, 0.2187770505, 0.6901760439, 0.6788966833, 0.9229865133, 0.1483287395, 0.8582846536, 0.1088929838, 0.7814400561, 0.04088096602, 0.4475493584])
curve = Curve(<curve referenced from the Rhino model>)
python_3_script = Python3Script(
    genes=gene_pool,
    site_crv=curve,
    max_height=Slider(30, range=0..100),
    cell_size=Slider(8, range=0..20),
    max_radius_x=Slider(60, range=0..100),
    max_radius_y=Slider(30, range=0..100),
    max_radius_z=Slider(45, range=0..100))  # -> active_pts, void_pts, all_pts, cell_states, boxes, grid_x, grid_y, grid_z, volume, cell_count; inputs genes: list of Double, site_crv: Curve, max_height: Double, cell_size: Double, max_radius_x: Double, max_radius_y: Double, max_radius_z: Double
# ---------- python_3_script: Python ----------
"""3D Grid Massing Generator - Single Genepool
Inputs:
    genes: list of 24 floats [0-1] from Wallacei genepool - List Access
    site_crv: site boundary curve (planar, on ground) - Item Access
    max_height: float - maximum building height in meters - Item Access
    cell_size: float - voxel cell size in meters - Item Access
    max_radius_x: float - max ellipsoid radius x in meters - Item Access
    max_radius_y: float - max ellipsoid radius y in meters - Item Access
    max_radius_z: float - max ellipsoid radius z in meters - Item Access
Outputs:
    active_pts: center points of solid cells
    void_pts: center points of void-cut cells
    all_pts: all grid points
    cell_states: 0=empty 1=solid 2=void 3=outside
    boxes: brep boxes for solid cells
    grid_x: int
    grid_y: int
    grid_z: int
    volume: total solid volume
    cell_count: number of solid cells
"""

import Rhino.Geometry as rg
import math

# defaults
if cell_size is None:
    cell_size = 3.0
if max_height is None:
    max_height = 21.0
if max_radius_x is None:
    max_radius_x = 20.0
if max_radius_y is None:
    max_radius_y = 20.0
if max_radius_z is None:
    max_radius_z = 15.0

# site bounds
bbox = site_crv.GetBoundingBox(True)
s_min = bbox.Min
s_max = bbox.Max
site_w = s_max.X - s_min.X
site_d = s_max.Y - s_min.Y

# grid dims
nx = int(math.ceil(site_w / cell_size))
ny = int(math.ceil(site_d / cell_size))
nz = int(math.ceil(max_height / cell_size))

# origin so grid centers on site
ox = s_min.X + (site_w - nx * cell_size) / 2.0
oy = s_min.Y + (site_d - ny * cell_size) / 2.0
oz = s_min.Z

# parse genes into attractors and repellers
# each entity: 6 genes [x, y, z, rx, ry, rz]
def parse_entity(g, offset):
    cx = ox + g[offset + 0] * nx * cell_size
    cy = oy + g[offset + 1] * ny * cell_size
    cz = oz + g[offset + 2] * nz * cell_size
    rx = g[offset + 3] * max_radius_x
    ry = g[offset + 4] * max_radius_y
    rz = g[offset + 5] * max_radius_z
    return (rg.Point3d(cx, cy, cz), rx, ry, rz)

attractors = [parse_entity(genes, 0), parse_entity(genes, 6)]
repellers = [parse_entity(genes, 12), parse_entity(genes, 18)]

# ellipsoid test
def in_ellipsoid(pt, center, rx, ry, rz):
    if rx < 0.01 or ry < 0.01 or rz < 0.01:
        return False
    dx = (pt.X - center.X) / rx
    dy = (pt.Y - center.Y) / ry
    dz = (pt.Z - center.Z) / rz
    return (dx * dx + dy * dy + dz * dz) <= 1.0

# site containment
plane = rg.Plane.WorldXY
tol = cell_size * 0.1

def on_site(pt):
    tp = rg.Point3d(pt.X, pt.Y, plane.OriginZ)
    r = site_crv.Contains(tp, plane, tol)
    return r == rg.PointContainment.Inside or r == rg.PointContainment.Coincident

# build grid
active_pts = []
void_pts = []
all_pts = []
cell_states = []
boxes = []

half = cell_size / 2.0
bx_int = rg.Interval(0, cell_size)

for ix in range(nx):
    for iy in range(ny):
        for iz in range(nz):
            cx = ox + (ix + 0.5) * cell_size
            cy = oy + (iy + 0.5) * cell_size
            cz = oz + (iz + 0.5) * cell_size
            pt = rg.Point3d(cx, cy, cz)
            all_pts.append(pt)

            if not on_site(pt):
                cell_states.append(3)
                continue

            hit_a = False
            for c, rx, ry, rz in attractors:
                if in_ellipsoid(pt, c, rx, ry, rz):
                    hit_a = True
                    break

            if not hit_a:
                cell_states.append(0)
                continue

            hit_r = False
            for c, rx, ry, rz in repellers:
                if in_ellipsoid(pt, c, rx, ry, rz):
                    hit_r = True
                    break

            if hit_r:
                cell_states.append(2)
                void_pts.append(pt)
                continue

            cell_states.append(1)
            active_pts.append(pt)

            corner = rg.Point3d(cx - half, cy - half, cz - half)
            bp = rg.Plane(corner, rg.Vector3d.XAxis, rg.Vector3d.YAxis)
            box = rg.Box(bp, bx_int, bx_int, bx_int)
            boxes.append(box.ToBrep())

grid_x = nx
grid_y = ny
grid_z = nz
volume = len(active_pts) * (cell_size ** 3)
cell_count = len(active_pts)
# ---------- end python_3_script ----------
brep = Brep(python_3_script.boxes)

# ----
# FACE SELECTOR
deconstruct_brep = DeconstructBrep(Brep=brep)  # -> Faces, Edges, Vertices
construct_point = ConstructPoint(XCoordinate=0, YCoordinate=0, ZCoordinate=0)
evaluate_surface = EvaluateSurface(Surface=deconstruct_brep.Faces, Point=construct_point)  # -> Point, Normal, UDirection, VDirection, Frame
deconstruct_vector = DeconstructVector(Vector=evaluate_surface.Normal)  # -> XComponent, YComponent, ZComponent
absolute = Absolute(Value=deconstruct_vector.YComponent)
equality = Equality(FirstNumber=absolute, SecondNumber="1")  # -> Equality, Inequality
dispatch = Dispatch(List=deconstruct_brep.Faces, DispatchPattern=equality.Equality)  # -> ListA, ListB

# ----
# AVG SUNLIGHT HOURS
ladybug = Ladybug_Ladybug()  # -> out; plug-in component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
panel = Panel(ladybug)
open_weather_file = Ladybug_OpenEPWWeatherFile(open=Toggle(True))  # -> epwFile; plug-in component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
importepw = Ladybug_ImportEpw(epwFile=open_weather_file)  # -> Output, latitude, location, dryBulbTemperature, dewPointTemperature, relativeHumidity, windSpeed, windDirection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; plug-in component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
analysisperiod = Ladybug_AnalysisPeriod(fromMonth="11", fromDay="1", fromHour="9", toMonth="2", toDay="31", toHour="17")  # -> out, analysisPeriod; plug-in component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
flip = Flip()  # -> Surface, Result
sunpath = Ladybug_SunPath(
    location=importepw.location,
    hour=12,
    day=21,
    month=12,
    timeStep=1,
    analysisPeriod=analysisperiod.analysisPeriod,
    sunPathScale=Slider(2, range=0..10),
    dailyOrAnnualSunPath=True)  # -> out, sunVectors, sunAltitudes, sunAzimuths, port, sunSpheresMesh, sunPathCrvs, compassCrvs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; plug-in component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
surface = Surface(<surface referenced from the Rhino model>)
sunlighthoursanalysis = Ladybug_SunlightHoursAnalysis(
    geometry=flatten(dispatch.ListA),
    context=flatten(brep),
    gridSize=Slider(10, range=0..10),
    disFromBase=Slider(0.01, range=0..1),
    sunVectors=flatten(sunpath.sunVectors),
    timeStep=1,
    parallel=Toggle(True),
    runIt=Toggle(True))  # -> out, contextMesh, analysisMesh, testPts, testVec, port, sunlightHoursResult, sunlightHoursMesh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; disabled; plug-in component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
multiplication = Multiplication(A=sunlighthoursanalysis.totalSunlightHours, B="-1")

volume = Volume(Geometry=brep)  # -> flatten(Volume), Centroid

curve_2 = Curve(<curve referenced from the Rhino model>)
curve_3 = Curve(<curve referenced from the Rhino model>)
curve_4 = Curve(<curve referenced from the Rhino model>)
# NOISE
curve_closest_point = CurveClosestPoint(Point=volume.Centroid, Curve=graft([curve_3, curve_2]))  # -> flatten(Point), Parameter, Distance
curve_closest_point_2 = CurveClosestPoint(Point=volume.Centroid, Curve=graft(curve_4))  # -> flatten(Point), Parameter, Distance
distance = Distance(PointA=volume.Centroid, PointB=curve_closest_point.Point)
distance_2 = Distance(PointA=volume.Centroid, PointB=curve_closest_point_2.Point)
# FACE AREA SN
panel_2 = Panel("-3")
power = Power(A=distance, B="-2")
power_2 = Power(A=distance_2, B=panel_2)
mass_addition = MassAddition(Input=[power, power_2])  # -> Result, PartialResults
multiplication_2 = Multiplication(A=mass_addition.Result, B="1")

area = Area(Geometry=dispatch.ListA)  # -> Area, Centroid
mass_addition_2 = MassAddition(Input=flatten(area.Area))  # -> Result, PartialResults
area_2 = Area(Geometry=deconstruct_brep.Faces)  # -> Area, Centroid
mass_addition_3 = MassAddition(Input=flatten(area_2.Area))  # -> Result, PartialResults
multiplication_3 = Multiplication(A=mass_addition_2.Result, B="-1")
addition = Addition(A=mass_addition_3.Result, B=multiplication_3)  # disabled

# ----
# VOLUME
mass_addition_4 = MassAddition(Input=flatten(volume.Volume))  # -> Result, PartialResults
subtraction = Subtraction(A="60000", B=mass_addition_4.Result)
multiplication_4 = Multiplication(A=subtraction, B=subtraction)
multiplication_5 = Multiplication(A=multiplication_4, B="10000")

group = Group(Geometry=brep)
number = Number(multiplication_5)
number_2 = Number(multiplication_2)
number_3 = Number(multiplication_3)
number_4 = Number(multiplication)
# 100 X 100
# MUTATION 0.4
wallacei_x = WallaceiX(
    Genes=gene_pool,
    Objectives=[number, number_2, number_3],
    Phenotype=group,
    allFitness="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",
    allFrontIdx="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",
    allGenomes="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",
    curFrontIdx="99|0;99|1;99|2;99|3;99|4;99|5;99|6;99|7;99|8;99|9;99|10;99|11;99|12;99|13;99|14;99|15;99|16;99|17;99|18;99|19;99|20;99|21;99|22;99|23;99|24;99|25;99|26;99|27;99|28;99|29;99|30;99|31;99|32;99|33;99|34;99|35;99|36;99|37;99|38;99|39;99|40;99|41;99|42;99|43;99|44;99|45;99|46;99|47;99|48;99|49;99|50;99|51;99|52;99|53;99|54;99|55;99|56;99|57;99|58;99|59;99|60;99|61;99|62;99|63;99|64;99|65;99|66;99|67;99|68;99|69;99|70;99|71;99|72;99|73;99|74;99|75;99|76;99|77;99|78;99|79;99|80;99|81;99|82;99|83;99|84;99|85;99|86;99|87;99|88;99|89;99|90;99|91;99|92;99|93;99|94;99|95;99|96;99|97;99|98;99|99",
    curFrontIdxSave="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",
    popGen="100,100",
    total="3967938",
    wlcDone=True)  # -> WallaceiGenomes, FitnessValues, Data, Phenotypes
decode_phenotype = DecodePhenotype(WallaceiPhenotype=wallacei_x.Phenotypes)  # -> flatten(GeometriesList), MeshesList, NumbersList, TextList
cherry_picker = CherryPicker(decode_phenotype.GeometriesList, ListIndex=330, TreePath_path="{0}")
vector_xyz = VectorXYZ(XComponent=0, YComponent=Slider(252, range=0..1000), ZComponent=0)  # -> Vector, Length
move = Move(Geometry=cherry_picker, Motion=vector_xyz.Vector)  # -> Geometry, Transform
