# Grasshopper definition python study 11 kangroo.gh (Grasshopper 1.0.8)

number_slider = Slider(10, range=0..100)
rectangle = Rectangle(Plane=PlaneXY(0, 0, 0), XSize=number_slider, YSize=number_slider, Radius=0)  # -> Rectangle, Length
boundary_surfaces = BoundarySurfaces(Edges=rectangle.Rectangle)
number_slider_2 = Slider(30, range=0..100)
mesh_surface = MeshSurface(Surface=boundary_surfaces, UCount=number_slider_2, VCount=number_slider_2, Overhang=True, Equalize=False)
vector_xyz = VectorXYZ(XComponent=0, YComponent=0, ZComponent=Slider(-1, range=-10..0))  # -> Vector, Length
construct_point = ConstructPoint(XCoordinate=Slider(5, range=0..100), YCoordinate=Slider(5, range=0..100), ZCoordinate=Slider(12, range=0..100))
deconstruct_mesh = DeconstructMesh(Mesh=mesh_surface)  # -> Vertices, Faces, Colours, Normals
load = Load(Point=construct_point, ForceVector=vector_xyz.Vector, Weighting=1)
brep = Brep(<brep referenced from the Rhino model>)
collider = Collider(Objects=[construct_point, deconstruct_mesh.Vertices], Radii=1, Strength=1)
solidpointcollide = SolidPointCollide(Points=construct_point, Solid=brep, Interior=Toggle(True), Unidirectional=True, Strength=1)
solver = Solver(GoalObjects=[solidpointcollide, load], Reset=Button(), Threshold=1e-15, Tolerance=0.0001, On=Toggle(True))  # -> I, V, O
