# Grasshopper definition python study 2 tree gen.gh (Grasshopper 1.0.8)
# plug-ins: Wallacei

open_weather_file = Ladybug_OpenEPWWeatherFile(open=Toggle(True))  # -> epwFile; plug-in component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
importepw = Ladybug_ImportEpw(epwFile=open_weather_file)  # -> Output, latitude, location, dryBulbTemperature, dewPointTemperature, relativeHumidity, windSpeed, windDirection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; plug-in component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
ladybug = Ladybug_Ladybug()  # -> out; plug-in component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
panel = Panel(ladybug)
analysisperiod = Ladybug_AnalysisPeriod(fromMonth="5", fromDay="1", fromHour="9", toMonth="8", toDay="31", toHour="17")  # -> out, analysisPeriod; plug-in component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
number_slider = Slider(0.3, range=0..1)
vector = Vector(Vector(0, 29.92264783, 0))
sunpath = Ladybug_SunPath(
    north=vector,
    location=importepw.location,
    hour=12,
    day=21,
    month=12,
    timeStep=Slider(0.5, range=0..1),
    analysisPeriod=analysisperiod.analysisPeriod,
    sunPathScale=number_slider,
    sunScale=number_slider,
    dailyOrAnnualSunPath=True)  # -> out, sunVectors, sunAltitudes, sunAzimuths, port, sunSpheresMesh, sunPathCrvs, compassCrvs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; plug-in component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
number_slider_2 = Slider(64709239, range=0..100000000)
number_slider_3 = Slider(360, range=0..360)
number_slider_4 = Slider(0, range=0..360)
number_slider_5 = Slider(43, range=0..90)
number_slider_6 = Slider(0, range=0..90)
number_slider_7 = Slider(0, range=0..1)
python_3_script = Python3Script(
    seed=number_slider_2,
    step=Slider(7, range=0..10),
    length=Slider(5, range=0..10),
    factor=Slider(1.3, range=0.5..3),
    branch_min=Slider(0, range=0..4),
    branch_max=Slider(4, range=0..6),
    branch_direction_min=number_slider_3,
    branch_direction_max=number_slider_4,
    branch_degree_min=number_slider_5,
    branch_degree_max=number_slider_6,
    noise=number_slider_7)  # -> out, a, b, c; inputs step: Int32
# ---------- python_3_script: Python ----------
import math
import random
import Rhino.Geometry as rg

'''
seed = 42
step = 10
length = 5
factor = 1
branch_min = 0
branch_max = 4
branch_direction_min = 0
branch_direction_max = 360
branch_degree_min = 0
branch_degree_max = 30
'''
random.seed(seed)

startp = rg.Point3d(0, 0, 0)
startv = rg.Vector3d(0, 0, 1)

lastp = [startp]
lastv = [startv]

genv = []
genp = []

lines = []

every = []

leaves = []

for i in range(step):
    allbranchvector = []
    allbranchpoint = []
    for vector in range(len(lastv)):
        for branch in range(random.randint(branch_min, branch_max)):
            angle1 = rg.Vector3d.YAxis
            angle1.Rotate(math.radians(random.uniform(branch_direction_min, branch_direction_max)), rg.Vector3d.ZAxis)
            axis = rg.Vector3d.CrossProduct(angle1, lastv[vector])
            v = rg.Vector3d(lastv[vector])
            v.Rotate(math.radians(random.uniform(branch_degree_min, branch_degree_max)), axis)
            p = lastp[vector] + (v * (length / ((factor**i)+1)) * (1-(noise*(random.random())))) 
            genv.append(v)
            genp.append(p)
            lines.append(rg.Line(lastp[vector], p))
        allbranchvector.extend(genv)
        genv = []
        allbranchpoint.extend(genp)
        genp = []
    lastv = allbranchvector
    lastp = allbranchpoint
    #if (i == step-1):
    #    for p,v in zip(lastp,lastv):
    #        plane = rg.Plane(p, v)
    #        leaf = rg.Rectangle3d(plane, 0.2, 0.1)
    #        leaves.append(leaf)

a = lines
b = leaves



ribbons = []
ribbon_width = 0.1  # thin enough to be light, wide enough to cast shadow

for ln in lines:
    direction = ln.Direction
    direction.Unitize()
    
    # find a perpendicular vector for ribbon width
    if abs(direction.Z) < 0.99:
        perp = rg.Vector3d.CrossProduct(direction, rg.Vector3d.ZAxis)
    else:
        perp = rg.Vector3d.CrossProduct(direction, rg.Vector3d.XAxis)
    perp.Unitize()
    perp *= ribbon_width * 0.5
    
    # four corners of the ribbon
    p1 = ln.From + perp
    p2 = ln.From - perp
    p3 = ln.To - perp
    p4 = ln.To + perp
    
    mesh = rg.Mesh()
    mesh.Vertices.Add(p1)
    mesh.Vertices.Add(p2)
    mesh.Vertices.Add(p3)
    mesh.Vertices.Add(p4)
    mesh.Faces.AddFace(0, 1, 2, 3)
    mesh.Normals.ComputeNormals()
    ribbons.append(mesh)

joined = rg.Mesh()
for r in ribbons:
    joined.Append(r)

c = joined
# ---------- end python_3_script ----------
python_3_script_2 = Python3Script()  # -> out, a, b, c
# ---------- python_3_script_2: Python ----------
import math
import Rhino.Geometry as rg
import random

random.seed(12344)

pt = [rg.Point3d(0, 0, 0)]
plast = []
pts = [rg.Point3d(0, 0, 0)]
n = 5
vz = rg.Vector3d(0,0,500)
vy = rg.Vector3d(0,200,400)

lns = []
box = []

for i in range(n):
    vz = ((i+1)/n) * vz + rg.Vector3d(0,10,0)
    vy = ((i+1)/n) * vy + rg.Vector3d(0,10,0)
    for p in pt:

        if random.random() > 0.1:
            print ("what is going on1")
            plast.append(p+vz)
            pts.append(p+vz)
            lns.append(rg.Line(p, (p+vz)))

        if random.random() > 0.1:
            print ("what is going on")
            plast.append(p+vy)
            pts.append(p+vy)
            lns.append(rg.Line(p, (p+vy)))
        
    
    pt = plast
    plast = []

c = box
a = pts
b = lns
# ---------- end python_3_script_2 ----------
surface = Surface(<surface referenced from the Rhino model>)
length = Length(Curve=python_3_script.a)
galapagos = Galapagos(fitness=sunlighthoursanalysis, gene=[number_slider_3, number_slider_4, number_slider_5, number_slider_6])
sunlighthoursanalysis = Ladybug_SunlightHoursAnalysis(
    north=vector,
    geometry=flatten(surface),
    context=flatten(python_3_script.c),
    gridSize=Slider(4, range=0..10),
    disFromBase=Slider(0.01, range=0..1),
    sunVectors=flatten(sunpath.sunVectors),
    timeStep=1,
    parallel=Toggle(True),
    runIt=Toggle(True))  # -> out, contextMesh, analysisMesh, testPts, testVec, port, sunlightHoursResult, sunlightHoursMesh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; disabled; plug-in component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
bounding_box = BoundingBox(Content=python_3_script.c, Plane=PlaneXY(0, 0, 0))  # -> Box, Box_2
mass_addition = MassAddition(Input=length)  # -> Result, PartialResults
volume = Volume(Geometry=bounding_box.Box)  # -> Volume, Centroid
multiplication = Multiplication(A=volume.Volume, B="-1")
wallacei_x = WallaceiX(
    Genes=[number_slider_3, number_slider_4, number_slider_5, number_slider_6, number_slider_7, number_slider_2],
    Objectives=[multiplication, mass_addition.Result],
    Phenotype=python_3_script.c,
    allFitness="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",
    allFrontIdx="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",
    allGenomes="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",
    curFrontIdx="99|0;99|1;99|2;99|3;99|4;99|5;99|6;99|7;99|8;99|9;99|10;99|11;99|12;99|13;99|14;99|15;99|16;99|17;99|18;99|19;99|20;99|21;99|22;99|23;99|24;99|25;99|26;99|27;99|28;99|29;99|30;99|31;99|32;99|33;99|34;99|35;99|36;99|37;99|38;99|39;99|40;99|41;99|42;99|43;99|44;99|45;99|46;99|47;99|48;99|49;99|50;99|51;99|52;99|53;99|54;99|55;99|56;99|57;99|58;99|59;99|60;99|61;99|62;99|63;99|64;99|65;99|66;99|67;99|68;99|69;99|70;99|71;99|72;99|73;99|74;99|75;99|76;99|77;99|78;99|79;99|80;99|81;99|82;99|83;99|84;99|85;99|86;99|87;99|88;99|89;99|90;99|91;99|92;99|93;99|94;99|95;99|96;99|97;99|98;99|99",
    curFrontIdxSave="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",
    popGen="100,100",
    total="715687",
    wlcDone=True)  # -> WallaceiGenomes, FitnessValues, Data, Phenotypes
decode_phenotype = DecodePhenotype(WallaceiPhenotype=wallacei_x.Phenotypes)  # -> GeometriesList, MeshesList, NumbersList, TextList
decode_genome = DecodeGenome(WallaceiGenome=wallacei_x.WallaceiGenomes)
series = Series(Start=Slider(5, range=0..10), Step=Slider(10, range=0..10), Count=Slider(5, range=0..10))
cherry_picker = CherryPicker(decode_genome, ListIndex=0, TreePath_path="{0;17;0}")
unit_y = UnitY(Factor=series)
move = Move(Geometry=graft(decode_phenotype.MeshesList), Motion=graft(unit_y))  # -> Geometry, Transform
panel_2 = Panel(cherry_picker)
