# Grasshopper definition python study 3 terrain gen.gh (Grasshopper 1.0.8)

python_3_script = Python3Script()  # -> out, a
# ---------- python_3_script: Python ----------
import math
import random
import Rhino.Geometry as rg

# --- Permutation table ---
perm = list(range(256))
random.seed(42)  # reproducible
random.shuffle(perm)
perm = perm + perm

def fade(t):
    return t * t * t * (t * (t * 6 - 15) + 10)

def lerp(a, b, t):
    return a + t * (b - a)

def grad(hash_val, x, y):
    """Convert hash to gradient direction, dot with (x,y)"""
    h = hash_val & 3
    if   h == 0: return  x + y
    elif h == 1: return -x + y
    elif h == 2: return  x - y
    else:        return -x - y

def perlin(x, y):
    xi = int(math.floor(x)) & 255
    yi = int(math.floor(y)) & 255
    tx = x - math.floor(x)
    ty = y - math.floor(y)
    
    u = fade(tx)
    v = fade(ty)
    
    # Hash corners
    aa = perm[perm[xi]     + yi]
    ab = perm[perm[xi]     + yi + 1]
    ba = perm[perm[xi + 1] + yi]
    bb = perm[perm[xi + 1] + yi + 1]
    
    # Dot products
    x0y0 = grad(aa, tx,     ty)
    x1y0 = grad(ba, tx-1.0, ty)
    x0y1 = grad(ab, tx,     ty-1.0)
    x1y1 = grad(bb, tx-1.0, ty-1.0)
    
    # Interpolate
    nx0 = lerp(x0y0, x1y0, u)
    nx1 = lerp(x0y1, x1y1, u)
    return lerp(nx0, nx1, v)

def fractal_noise(x, y, octaves=3, persistence=0.5, lacunarity=2.0):
    value = 0.0
    freq = 1.0
    amp = 1.0
    for _ in range(octaves):
        value += amp * perlin(x * freq, y * freq)
        freq *= lacunarity
        amp *= persistence
    return value

# --- Generate points ---
size_x = 50
size_y = 50
scale = 0.08
z_scale = 5.0

points = []
for x in range(size_x):
    for y in range(size_y):
        z = fractal_noise(x * scale, y * scale)
        points.append(rg.Point3d(x, y, z * z_scale))



M = rg.Mesh()

# Add all points as mesh vertices
for pt in points:
    M.Vertices.Add(pt)


# Build triangle faces
for r in range(size_y - 1):
    for c in range(size_x - 1):
        # Four corner indices
        bl = r * size_x + c          # bottom-left
        br = bl + 1                  # bottom-right
        tl = bl + size_x             # top-left
        tr = tl + 1                 # top-right
        
        # Two triangles per cell
        M.Faces.AddFace(bl, br, tl)
        M.Faces.AddFace(br, tr, tl)

# Compute normals for shading
M.Normals.ComputeNormals()
M.Compact()

mesh = M

a = mesh
# ---------- end python_3_script ----------
