# Grasshopper definition python study 4 erosion gen.gh (Grasshopper 1.0.8)

python_3_script = Python3Script(
    x_res=Slider(100, range=0..100),
    y_res=Slider(100, range=0..100),
    scale=Slider(0.02, range=0..0.1),
    octaves=Slider(5, range=0..10),
    persistence=Slider(0.4, range=0..1),
    lacunarity=Slider(2, range=0..10),
    height_mult=Slider(40.1, range=0..100),
    seed=Slider(79, range=0..100))  # -> heights, x_res_out, y_res_out; inputs x_res: Int32, y_res: Int32, scale: Double, octaves: Int32, persistence: Double, height_mult: Double, seed: Int32
# ---------- python_3_script: Python ----------
import math
import random

# --- Permutation table ---
random.seed(seed)
perm = list(range(256))
random.shuffle(perm)
perm = perm + perm

grads = [(1,0),(-1,0),(0,1),(0,-1),(1,1),(-1,1),(1,-1),(-1,-1)]

def fade(t):
    return t * t * t * (t * (t * 6 - 15) + 10)

def lerp(a, b, t):
    return a + t * (b - a)

def grad(hash_val, x, y):
    g = grads[hash_val & 7]
    return g[0] * x + g[1] * y

def perlin(x, y):
    xi = int(math.floor(x)) & 255
    yi = int(math.floor(y)) & 255
    tx = x - math.floor(x)
    ty = y - math.floor(y)
    u = fade(tx)
    v = fade(ty)
    
    aa = perm[perm[xi] + yi]
    ab = perm[perm[xi] + yi + 1]
    ba = perm[perm[xi + 1] + yi]
    bb = perm[perm[xi + 1] + yi + 1]
    
    x0y0 = grad(aa, tx, ty)
    x1y0 = grad(ba, tx - 1.0, ty)
    x0y1 = grad(ab, tx, ty - 1.0)
    x1y1 = grad(bb, tx - 1.0, ty - 1.0)
    
    nx0 = lerp(x0y0, x1y0, u)
    nx1 = lerp(x0y1, x1y1, u)
    return lerp(nx0, nx1, v)

def fractal(x, y):
    total = 0.0
    amp = 1.0
    freq = 1.0
    max_amp = 0.0
    for i in range(octaves):
        total += perlin(x * freq, y * freq) * amp
        max_amp += amp
        amp *= persistence
        freq *= lacunarity
    return total / max_amp

# --- Generate height array ---
heights = []
for r in range(y_res):
    for c in range(x_res):
        nx = c * scale
        ny = r * scale
        h = fractal(nx, ny) * height_mult
        heights.append(h)

x_res_out = x_res
y_res_out = y_res
# ---------- end python_3_script ----------
python_3_script_2 = Python3Script(
    heights=python_3_script.heights,
    x_res=python_3_script.x_res_out,
    y_res=python_3_script.y_res_out,
    step=Slider(30, range=0..100),
    drops_per_step=Slider(50, range=0..200),
    max_lifetime=Slider(100, range=0..100),
    inertia=Slider(0.3, range=0..1),
    capacity_mult=Slider(8, range=0..10),
    deposition_rate=Slider(0.02, range=0..0.1),
    erosion_rate=Slider(0.7, range=0..1),
    evaporation=Slider(0.01, range=0..0.1),
    min_slope=Slider(0.01, range=0..0.01),
    gravity=Slider(10, range=0..10),
    erosion_radius=Slider(3, range=0..10),
    seed=Slider(42, range=0..100))  # -> eroded_heights, trails, delta; inputs heights: list of Double, x_res: Int32, y_res: Int32, drops_per_step: Int32, max_lifetime: Int32, inertia: Double, capacity_mult: Double, deposition_rate: Double, erosion_rate: Double, evaporation: Double, min_slope: Double, gravity: Double, erosion_radius: Int32, seed: Int32
# ---------- python_3_script_2: Python ----------
import math
import random

# INPUTS (all right-click configured):
# heights          (list, float)   - from Component 1
# x_res            (item, int)     - grid width
# y_res            (item, int)     - grid height
# step             (item, int)     - current time step (0 = no erosion)
# drops_per_step   (item, int)     - agents per batch, e.g. 50
# erosion_rate     (item, float)   - e.g. 0.3
# deposition_rate  (item, float)   - e.g. 0.2
# evaporation      (item, float)   - e.g. 0.02
# max_lifetime     (item, int)     - e.g. 80
# inertia          (item, float)   - momentum vs gradient, e.g. 0.3
# gravity          (item, float)   - speed gain from slope, e.g. 4.0
# min_slope        (item, float)   - minimum slope for capacity, e.g. 0.01
# capacity_mult    (item, float)   - sediment capacity multiplier, e.g. 4.0
# erosion_radius   (item, int)     - radius of erosion brush, e.g. 0 (single cell) or 2-3
# seed             (item, int)     - for reproducibility, e.g. 42

# OUTPUTS:
# eroded_heights
# trails
# delta

W = int(x_res) if x_res is not None else 100
H = int(y_res) if y_res is not None else 100
n_step = int(step) if step is not None else 0
dps = int(drops_per_step) if drops_per_step is not None else 50
e_rate = float(erosion_rate) if erosion_rate is not None else 0.3
d_rate = float(deposition_rate) if deposition_rate is not None else 0.2
evap = float(evaporation) if evaporation is not None else 0.02
maxlife = int(max_lifetime) if max_lifetime is not None else 80
inrt = float(inertia) if inertia is not None else 0.3
grav = float(gravity) if gravity is not None else 4.0
mslope = float(min_slope) if min_slope is not None else 0.01
capmul = float(capacity_mult) if capacity_mult is not None else 4.0
erad = int(erosion_radius) if erosion_radius is not None else 0
sd = int(seed) if seed is not None else 42

hmap = list(heights)
original = list(heights)
size = W * H

def get_h(hm, fx, fy):
    """Bilinear interpolation of height"""
    x0 = int(fx)
    y0 = int(fy)
    x1 = min(x0 + 1, W - 1)
    y1 = min(y0 + 1, H - 1)
    x0 = max(x0, 0)
    y0 = max(y0, 0)
    sx = fx - int(fx)
    sy = fy - int(fy)
    h00 = hm[y0 * W + x0]
    h10 = hm[y0 * W + x1]
    h01 = hm[y1 * W + x0]
    h11 = hm[y1 * W + x1]
    return h00*(1-sx)*(1-sy) + h10*sx*(1-sy) + h01*(1-sx)*sy + h11*sx*sy

def get_gradient(hm, fx, fy):
    """Central difference gradient"""
    eps = 0.5
    lx = max(fx - eps, 0.0)
    rx = min(fx + eps, W - 1.0)
    ly = max(fy - eps, 0.0)
    ry = min(fy + eps, H - 1.0)
    dhdx = (get_h(hm, rx, fy) - get_h(hm, lx, fy)) / (rx - lx + 1e-10)
    dhdy = (get_h(hm, fx, ry) - get_h(hm, fx, ly)) / (ry - ly + 1e-10)
    return dhdx, dhdy

def erode_at(hm, px, py, amount):
    """Erode or deposit with radius brush"""
    if erad <= 0:
        # single cell
        ix = max(0, min(int(px), W - 1))
        iy = max(0, min(int(py), H - 1))
        idx = iy * W + ix
        hm[idx] -= amount
    else:
        # weighted brush within erosion_radius
        cx = int(px)
        cy = int(py)
        total_w = 0.0
        weights = []
        cells = []
        for dy in range(-erad, erad + 1):
            for dx in range(-erad, erad + 1):
                nx = cx + dx
                ny = cy + dy
                if nx < 0 or nx >= W or ny < 0 or ny >= H:
                    continue
                dist = math.sqrt((nx - px)**2 + (ny - py)**2)
                if dist <= erad:
                    w = max(0.0, erad - dist)
                    weights.append(w)
                    cells.append(ny * W + nx)
                    total_w += w
        if total_w > 0:
            for j in range(len(cells)):
                hm[cells[j]] -= amount * (weights[j] / total_w)

def run_drop(hm, sx, sy, rng):
    """Simulate one water drop, return trail"""
    px, py = float(sx), float(sy)
    dx, dy = 0.0, 0.0
    water = 1.0
    sediment = 0.0
    speed = 1.0
    trail = []
    
    for _ in range(maxlife):
        ix = int(px)
        iy = int(py)
        if ix < 0 or ix >= W - 1 or iy < 0 or iy >= H - 1:
            break
        
        h_here = get_h(hm, px, py)
        trail.append((px, py, h_here))
        
        # gradient
        gx, gy = get_gradient(hm, px, py)
        
        # update direction with inertia
        dx = dx * inrt - gx * (1.0 - inrt)
        dy = dy * inrt - gy * (1.0 - inrt)
        
        # normalize
        mag = math.sqrt(dx*dx + dy*dy)
        if mag < 1e-10:
            ang = rng.random() * 6.2832
            dx = math.cos(ang)
            dy = math.sin(ang)
            mag = 1.0
        dx /= mag
        dy /= mag
        
        # new position
        nx = px + dx
        ny = py + dy
        
        if nx < 0 or nx >= W - 1 or ny < 0 or ny >= H - 1:
            break
        
        h_new = get_h(hm, nx, ny)
        h_diff = h_new - h_here
        
        # sediment capacity
        cap = max(-h_diff, mslope) * speed * water * capmul
        
        if sediment > cap or h_diff > 0:
            # DEPOSIT
            if h_diff > 0:
                amount = min(sediment, h_diff)
            else:
                amount = (sediment - cap) * d_rate
            sediment -= amount
            erode_at(hm, px, py, -amount)  # negative = deposit
        else:
            # ERODE
            amount = min((cap - sediment) * e_rate, -h_diff)
            sediment += amount
            erode_at(hm, px, py, amount)
        
        # update physics
        speed = math.sqrt(max(speed * speed + h_diff * grav, 0.01))
        water *= (1.0 - evap)
        
        if water < 0.01:
            break
        
        px = nx
        py = ny
    
    return trail

# --- RUN ALL STEPS CUMULATIVELY ---
all_trails = []

for s in range(n_step):
    rng = random.Random(sd + s * 1000)
    step_trails = []
    for d in range(dps):
        sx = rng.uniform(1, W - 2)
        sy = rng.uniform(1, H - 2)
        tr = run_drop(hmap, sx, sy, rng)
        if s == n_step - 1:
            step_trails.append(tr)
    if s == n_step - 1:
        all_trails = step_trails

# --- OUTPUTS ---
eroded_heights = hmap

trail_coords = []
for tr in all_trails:
    for (tx, ty, tz) in tr:
        trail_coords.append(tx)
        trail_coords.append(ty)
        trail_coords.append(tz)
    trail_coords.append(-1)

trails = trail_coords

delta = [original[i] - hmap[i] for i in range(size)]
# ---------- end python_3_script_2 ----------
number_slider = Slider(1, range=0..1)
python_3_script_3 = Python3Script(
    eroded_heights=python_3_script_2.eroded_heights,
    trails=python_3_script_2.trails,
    delta=python_3_script_2.delta,
    x_res=python_3_script.x_res_out,
    y_res=python_3_script.y_res_out,
    z_scale=number_slider,
    cell_size=number_slider)  # -> mesh, polylines; inputs eroded_heights: list of Double, trails: list of Double, delta: list of Double, x_res: Int32, y_res: Int32, cell_size: Double
# ---------- python_3_script_3: Python ----------
import Rhino.Geometry as rg
import System.Drawing as sd

# INPUTS:
# eroded_heights (list, float)
# delta          (list, float) - erosion depth
# trails         (list, float) - trail coordinate stream
# x_res          (item, int)
# y_res          (item, int)
# z_scale        (item, float)
# cell_size      (item, float)

W = int(x_res) if x_res is not None else 100
H = int(y_res) if y_res is not None else 100
zs = float(z_scale) if z_scale is not None else 30.0
cs = float(cell_size) if cell_size is not None else 1.0

hm = list(eroded_heights)
dt = list(delta)

# --- BUILD MESH ---
mesh = rg.Mesh()

for iy in range(H):
    for ix in range(W):
        idx = iy * W + ix
        z = hm[idx] * zs
        mesh.Vertices.Add(ix * cs, iy * cs, z)

for iy in range(H - 1):
    for ix in range(W - 1):
        i00 = iy * W + ix
        i10 = iy * W + ix + 1
        i01 = (iy + 1) * W + ix
        i11 = (iy + 1) * W + ix + 1
        mesh.Faces.AddFace(i00, i10, i11, i01)

# --- COLOR BY EROSION/DEPOSITION ---
max_d = max(max(dt), 0.001)
min_d = min(min(dt), -0.001)

for i in range(len(dt)):
    d = dt[i]
    if d > 0:
        # eroded -> blue
        t = min(d / max_d, 1.0)
        r = int(120 * (1 - t))
        g = int(160 * (1 - t))
        b = int(100 + 155 * t)
    else:
        # deposited -> warm/red
        t = min(-d / -min_d, 1.0)
        r = int(120 + 135 * t)
        g = int(160 * (1 - t * 0.7))
        b = int(100 * (1 - t))
    mesh.VertexColors.Add(r, g, b)

mesh.Normals.ComputeNormals()
mesh.Compact()

terrain_mesh = mesh

# --- BUILD TRAIL POLYLINES ---
polylines = []
if trails is not None and len(trails) > 0:
    coords = list(trails)
    current_pts = []
    i = 0
    while i < len(coords):
        v = coords[i]
        if v == -1:
            # end of one trail
            if len(current_pts) > 1:
                pl = rg.Polyline(current_pts)
                polylines.append(pl.ToPolylineCurve())
            current_pts = []
            i += 1
        else:
            if i + 2 < len(coords):
                tx = v * cs
                ty = coords[i+1] * cs
                tz = coords[i+2] * zs
                current_pts.append(rg.Point3d(tx, ty, tz))
            i += 3
    # last trail if no trailing -1
    if len(current_pts) > 1:
        pl = rg.Polyline(current_pts)
        polylines.append(pl.ToPolylineCurve())

trail_curves = polylines
# ---------- end python_3_script_3 ----------
curve = Curve(python_3_script_3.polylines)
custom_preview = CustomPreview(
    Geometry=python_3_script_3.mesh,
    Material={diffuse=RGB(221, 160, 221), emission=RGB(66, 48, 66), shine=0.5, specular=RGB(255, 255, 255), transparency=0})
