# Grasshopper definition python study 5 core placement.gh (Grasshopper 1.0.8)
# plug-ins: Wallacei

gene_pool = GenePool(Decimals=3, Maximum=1, Minimum=0, Value=[0.32, 0.591, 0.353, 0.378])
gene_pool_2 = GenePool(Decimals=3, Maximum=1, Minimum=0, Value=[0.869, 0.367, 0.341, 0.606])
surface = Surface(<surface referenced from the Rhino model>)
construct_point = ConstructPoint(XCoordinate=gene_pool, YCoordinate=gene_pool_2, ZCoordinate=0)
evaluate_surface = EvaluateSurface(Surface=reparameterize(surface), Point=construct_point)  # -> Point, Normal, UDirection, VDirection, Frame
open_weather_file = Ladybug_OpenEPWWeatherFile(open=Toggle(True))  # -> epwFile; plug-in component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
polyline = PolyLine(Vertices=evaluate_surface.Point, Closed="-1")  # disabled
boundary_surfaces = BoundarySurfaces(Edges=polyline)
importepw = Ladybug_ImportEpw(epwFile=open_weather_file)  # -> Output, latitude, location, dryBulbTemperature, dewPointTemperature, relativeHumidity, windSpeed, windDirection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; plug-in component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
number_slider = Slider(4, range=0..10)
gene_pool_3 = GenePool(Decimals=0, Maximum=15, Minimum=0, Value=[11, 15, 12, 14])
vector_xyz = VectorXYZ(XComponent=0, YComponent=0, ZComponent=Slider(0.5, range=0..1))  # -> Vector, Length
polygon = Polygon(Plane=evaluate_surface.Point, Radius=Slider(10, range=0..10), Segments=Slider(4, range=0..10), FilletRadius=0)  # -> Polygon, Length
gene_pool_4 = GenePool(Decimals=0, Maximum=15, Minimum=0, Value=[7, 5.569385144, 3])
extrude = Extrude(Base=boundary_surfaces, Direction=vector_xyz.Vector)
ladybug = Ladybug_Ladybug()  # -> out; plug-in component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
multiplication = Multiplication(A=gene_pool_3, B=number_slider)
gene_pool_5 = GenePool(Decimals=0, Maximum=90, Minimum=0, Value=[0, 28, 66, 35])
vector_xyz_2 = VectorXYZ(XComponent=0, YComponent=0, ZComponent=multiplication)  # -> Vector, Length
analysisperiod = Ladybug_AnalysisPeriod(fromMonth="11", fromDay="1", fromHour="9", toMonth="2", toDay="31", toHour="17")  # -> out, analysisPeriod; plug-in component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
panel = Panel(ladybug)
multiplication_2 = Multiplication(A=gene_pool_4, B=number_slider)
vector_xyz_3 = VectorXYZ(XComponent=0, YComponent=0, ZComponent=multiplication_2)  # -> Vector, Length
rotate = Rotate(Geometry=polygon.Polygon, Angle=degrees(gene_pool_5), Plane=evaluate_surface.Point)  # -> Geometry, Transform
python_3_script = Python3Script(x=flatten(rotate.Geometry))  # -> a; inputs x: list of Curve
# ---------- python_3_script: Python ----------
import Rhino.Geometry as rg
import ghpythonlib.treehelpers as th  # 1. Import the tree helper

# Create an empty list to hold your data
nested_list = []

for i in range(len(x)):
    temp_list = list(x) 
    temp_list.pop(i)
    nested_list.append(temp_list)

# 2. Convert the Python list of lists into a Grasshopper Data Tree
a = th.list_to_tree(nested_list)
# ---------- end python_3_script ----------
move = Move(Geometry=extrude, Motion=vector_xyz_3.Vector)  # -> Geometry, Transform
isovist = IsoVist(
    Plane=graft(evaluate_surface.Point),
    Count=Slider(220, range=0..1000),
    Radius=Slider(194, range=0..1000),
    Obstacles=python_3_script)  # -> Points, Distance, Index; disabled
boundary_surfaces_2 = BoundarySurfaces(Edges=rotate.Geometry)
sunpath = Ladybug_SunPath(
    location=importepw.location,
    hour=12,
    day=21,
    month=12,
    timeStep=1,
    analysisPeriod=analysisperiod.analysisPeriod,
    sunPathScale=Slider(2, range=0..10),
    dailyOrAnnualSunPath=True)  # -> out, sunVectors, sunAltitudes, sunAzimuths, port, sunSpheresMesh, sunPathCrvs, compassCrvs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; plug-in component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
extrude_2 = Extrude(Base=boundary_surfaces_2, Direction=vector_xyz_2.Vector)
line = Line(StartPoint=graft(evaluate_surface.Point), EndPoint=isovist.Points)
range = Range(Domain=Domain(0, 1), Steps=Slider(3, range=0..10))
group = Group(Geometry=extrude_2)
surface_2 = Surface(<surface referenced from the Rhino model>)
gradient = Gradient(
    LowerLimit=0,
    UpperLimit=1,
    Parameter=range,
    stops=[0: RGB(48, 18, 59), 0.0294: RGB(56, 40, 112), 0.0588: RGB(63, 62, 156), 0.0882: RGB(68, 82, 193), 0.118: RGB(70, 102, 221), 0.147: RGB(71, 122, 241)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])
volume = Volume(Geometry=extrude_2)  # -> Volume, Centroid
flip = Flip(Surface=surface_2)  # -> Surface, Result
deconstruct_brep = DeconstructBrep(Brep=extrude_2)  # -> Faces, Edges, Vertices
bounding_box = BoundingBox(Content=group, Plane=PlaneXY(0, 0, 0))  # -> Box, Box_2
galapagos = Galapagos(fitness=division, gene=[gene_pool, gene_pool_2, gene_pool_3])
sunlighthoursanalysis = Ladybug_SunlightHoursAnalysis(
    geometry=flatten([deconstruct_brep.Faces, flip.Surface]),
    context=flatten(extrude_2),
    gridSize=Slider(9, range=0..10),
    disFromBase=Slider(0.01, range=0..1),
    sunVectors=flatten(sunpath.sunVectors),
    timeStep=1,
    parallel=Toggle(True),
    runIt=Toggle(True))  # -> out, contextMesh, analysisMesh, testPts, testVec, port, sunlightHoursResult, sunlightHoursMesh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; plug-in component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
custom_preview = CustomPreview(Geometry=line, Material=graft(gradient))
mass_addition = MassAddition(Input=volume.Volume)  # -> Result, PartialResults
volume_2 = Volume(Geometry=bounding_box.Box)  # -> Volume, Centroid
division = Division(A=mass_addition.Result, B=volume_2.Volume)
wallacei_x = WallaceiX(popGen="-1,-1", total="0", wlcDone=False)  # -> WallaceiGenomes, FitnessValues, Data, Phenotypes
