# Grasshopper definition python study 6 ziggurat courtyard.gh (Grasshopper 1.0.8)
# plug-ins: Wallacei

gene_pool = GenePool(Decimals=3, Maximum=1, Minimum=0, Value=[0.105, 0.675, 0.311, 0.845])
gene_pool_2 = GenePool(Decimals=3, Maximum=1, Minimum=0, Value=[0.414, 0.362, 0.632, 0.09])
surface = Surface(<surface referenced from the Rhino model>)
construct_point = ConstructPoint(XCoordinate=gene_pool, YCoordinate=gene_pool_2, ZCoordinate=0)
gene_pool_3 = GenePool(Decimals=0, Maximum=50, Minimum=0, Value=[13, 16, 36, 37])
gene_pool_4 = GenePool(Decimals=0, Maximum=50, Minimum=0, Value=[27, 36, 33, 22])
gene_pool_5 = GenePool(Decimals=0, Maximum=50, Minimum=0, Value=[9, 21, 43, 45])
evaluate_surface = EvaluateSurface(Surface=reparameterize(surface), Point=construct_point)  # -> Point, Normal, UDirection, VDirection, Frame
center_box = CenterBox(Base=evaluate_surface.Point, X=gene_pool_4, Y=gene_pool_3, Z=gene_pool_5)
list_length = ListLength(List=center_box)
gene_pool_6 = GenePool(Decimals=0, Maximum=50, Minimum=0, Value=[5, 37])
division = Division(A=list_length, B="2")
split_list = SplitList(List=center_box, Index=division)  # -> ListA, ListB
unit_z = UnitZ(Factor=gene_pool_6)
surface_2 = Surface(<surface referenced from the Rhino model>)
move = Move(Geometry=split_list.ListB, Motion=unit_z)  # -> Geometry, Transform
solid_difference = SolidDifference(BrepsA=split_list.ListA, BrepsB=move.Geometry)
split_brep = SplitBrep(Brep=solid_difference, Cutter=surface_2)
dispatch = Dispatch(List=split_brep, DispatchPattern=[True, False])  # -> ListA, ListB
brep = Brep(flatten(dispatch.ListB))
volume = Volume(Geometry=dispatch.ListB)  # -> Volume, Centroid
group = Group(Geometry=brep)
deconstruct_brep = DeconstructBrep(Brep=brep)  # -> Faces, Edges, Vertices
mass_addition = MassAddition(Input=flatten(volume.Volume))  # -> Result, PartialResults
area = Area(Geometry=deconstruct_brep.Faces)  # -> Area, Centroid
subtraction = Subtraction(A="250000", B=mass_addition.Result)
mass_addition_2 = MassAddition(Input=flatten(area.Area))  # -> Result, PartialResults
multiplication = Multiplication(A=subtraction, B=subtraction)
multiplication_2 = Multiplication(A=mass_addition_2.Result, B="-1")
wallacei_x = WallaceiX(
    Genes=[gene_pool_6, gene_pool_5, gene_pool_3, gene_pool_4, gene_pool, gene_pool_2],
    Objectives=[multiplication, multiplication_2],
    Phenotype=group,
    popGen="50,100",
    total="0",
    wlcDone=False)  # -> WallaceiGenomes, FitnessValues, Data, Phenotypes
decode_genome = DecodeGenome(WallaceiGenome=wallacei_x.WallaceiGenomes)
decode_phenotype = DecodePhenotype(WallaceiPhenotype=wallacei_x.Phenotypes)  # -> GeometriesList, MeshesList, NumbersList, TextList
brep_2 = Brep(decode_phenotype.GeometriesList)
