# Grasshopper definition python study 7 ziggurat courtyard better.gh (Grasshopper 1.0.8)
# plug-ins: Wallacei

brep = Brep(<brep referenced from the Rhino model>)
gene_pool = GenePool(Decimals=1, Maximum=1, Minimum=0, Value=[0.5, 0.5])
gene_pool_2 = GenePool(Decimals=1, Maximum=1, Minimum=0, Value=[0.7, 0.6])
gene_pool_3 = GenePool(Decimals=1, Maximum=1, Minimum=0, Value=[1, 1])
gene_pool_4 = GenePool(Decimals=1, Maximum=1, Minimum=0, Value=[0.3, 0.4])
gene_pool_5 = GenePool(Decimals=1, Maximum=1, Minimum=0, Value=[0.2, 0.1])
gene_pool_6 = GenePool(Decimals=1, Maximum=1, Minimum=0, Value=[1, 0.4])
gene_pool_7 = GenePool(Decimals=1, Maximum=1, Minimum=0, Value=[0.2, 0.7])
gene_pool_8 = GenePool(Decimals=1, Maximum=1, Minimum=0, Value=[0.2, 0.9])
gene_pool_9 = GenePool(Decimals=0, Maximum=10, Minimum=0, Value=[10, 10])
gene_pool_10 = GenePool(Decimals=0, Maximum=7, Minimum=0, Value=[6, 5])
gene_pool_11 = GenePool(Decimals=0, Maximum=6, Minimum=0, Value=[6, 5])
evaluate_box = EvaluateBox(Box=brep, UParameter=gene_pool_5, VParameter=gene_pool_3, WParameter=gene_pool_4)  # -> Plane, Point, Include
evaluate_box_2 = EvaluateBox(Box=brep, UParameter=gene_pool_6, VParameter=gene_pool_7, WParameter=gene_pool_8)  # -> Plane, Point, Include
evaluate_box_3 = EvaluateBox(Box=brep, UParameter=gene_pool, VParameter=gene_pool_2, WParameter=Slider(0, range=0..100))  # -> Plane, Point, Include
multiplication = Multiplication(A=gene_pool_11, B="4")
multiplication_2 = Multiplication(A=gene_pool_9, B="4")
multiplication_3 = Multiplication(A=gene_pool_10, B="2")
center_box = CenterBox(Base=evaluate_box_3.Plane, X=multiplication, Y=multiplication_2, Z=multiplication_3)
box_2pt = Box2Pt(PointA=evaluate_box_2.Plane, PointB=evaluate_box.Plane, Plane=PlaneXY(0, 0, 0))
move = Move(Motion=Vector(0, 0, 10))  # -> Geometry, Transform
unit_z = UnitZ(Factor=multiplication_3)
unit_z_2 = UnitZ(Factor=Slider(5, range=0..10))
move_2 = Move(Geometry=center_box, Motion=unit_z)  # -> Geometry, Transform
move_3 = Move(Geometry=box_2pt, Motion=unit_z_2)  # -> Geometry, Transform
solid_difference = SolidDifference(BrepsA=flatten(move_2.Geometry), BrepsB=flatten(move_3.Geometry))
brep_join = BrepJoin(Breps=solid_difference)  # -> Breps, Closed
dispatch = Dispatch(List=brep_join.Breps, DispatchPattern=brep_join.Closed)  # -> ListA, ListB
brep_2 = Brep(dispatch.ListA)
deconstruct_brep = DeconstructBrep(Brep=brep_2)  # -> Faces, Edges, Vertices
volume = Volume(Geometry=brep_2)  # -> flatten(Volume), Centroid
mass_addition = MassAddition(Input=flatten(volume.Volume))  # -> Result, PartialResults
area = Area(Geometry=deconstruct_brep.Faces)  # -> Area, Centroid
subtraction = Subtraction(A="150000", B=mass_addition.Result)
construct_point = ConstructPoint(XCoordinate=0, YCoordinate=0, ZCoordinate=0)
mass_addition_2 = MassAddition(Input=flatten(area.Area))  # -> Result, PartialResults
multiplication_4 = Multiplication(A=subtraction, B=subtraction)
evaluate_surface = EvaluateSurface(Surface=deconstruct_brep.Faces, Point=construct_point)  # -> Point, Normal, UDirection, VDirection, Frame
multiplication_5 = Multiplication(A=mass_addition_2.Result, B="-1")
deconstruct_vector = DeconstructVector(Vector=evaluate_surface.Normal)  # -> XComponent, YComponent, ZComponent
absolute = Absolute(Value=deconstruct_vector.XComponent)
group = Group(Geometry=brep_2)
equality = Equality(FirstNumber=absolute, SecondNumber="1")  # -> Equality, Inequality
dispatch_2 = Dispatch(List=deconstruct_brep.Faces, DispatchPattern=equality.Equality)  # -> ListA, ListB
number_slider = Slider(400, range=0..400)
decode_phenotype = DecodePhenotype()  # -> GeometriesList, MeshesList, NumbersList, TextList
area_2 = Area(Geometry=dispatch_2.ListB)  # -> Area, Centroid
series = Series(Start=number_slider, Step=number_slider, Count=Slider(50, range=0..100))
mass_addition_3 = MassAddition(Input=flatten(area_2.Area))  # -> Result, PartialResults
unit_x = UnitX(Factor=series)
move_4 = Move(Geometry=flatten(decode_phenotype.GeometriesList), Motion=unit_x)  # -> Geometry, Transform
multiplication_6 = Multiplication(A=mass_addition_3.Result, B="-2")
addition = Addition(A=mass_addition_2.Result, B=multiplication_6)
wallacei_x = WallaceiX(
    Genes=[gene_pool_2, gene_pool, gene_pool_11, gene_pool_9, gene_pool_10, gene_pool_6, gene_pool_7, gene_pool_8, gene_pool_5, gene_pool_3, gene_pool_4],
    Objectives=[multiplication_4, addition],
    Phenotype=group,
    allFitness="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",
    allFrontIdx="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",
    allGenomes="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",
    curFrontIdx="71|0;71|1;71|2;71|3;71|4;71|5;71|6;71|7;71|8;71|9;71|10;71|11;71|12;71|13;71|14;71|15;71|16;71|17;71|18;71|19;71|20;71|21;71|22;71|23;71|24;71|25;71|26;71|27;71|28;71|29;71|30;71|31;71|32;71|33;71|34;71|35;71|36",
    curFrontIdxSave="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",
    popGen="50,100",
    total="83469",
    wlcDone=True)  # -> WallaceiGenomes, FitnessValues, Data, Phenotypes
