# Grasshopper definition python study 8 ziggurat courtyard sun.gh (Grasshopper 1.0.8)
# plug-ins: Wallacei

brep = Brep(<brep referenced from the Rhino model>)
gene_pool = GenePool(Decimals=1, Maximum=1, Minimum=0, Value=[0.9, 0.9])
gene_pool_2 = GenePool(Decimals=1, Maximum=1, Minimum=0, Value=[0.8, 0.5])
gene_pool_3 = GenePool(Decimals=1, Maximum=1, Minimum=0, Value=[0.9, 0.3])
gene_pool_4 = GenePool(Decimals=1, Maximum=1, Minimum=0, Value=[0, 0])
gene_pool_5 = GenePool(Decimals=1, Maximum=1, Minimum=0, Value=[1, 1])
gene_pool_6 = GenePool(Decimals=1, Maximum=1, Minimum=0, Value=[0.8, 0.7])
gene_pool_7 = GenePool(Decimals=1, Maximum=1, Minimum=0, Value=[0.8, 1])
gene_pool_8 = GenePool(Decimals=1, Maximum=1, Minimum=0, Value=[0.6, 0.1])
gene_pool_9 = GenePool(Decimals=0, Maximum=10, Minimum=0, Value=[5, 9])
gene_pool_10 = GenePool(Decimals=0, Maximum=7, Minimum=0, Value=[7, 7])
gene_pool_11 = GenePool(Decimals=0, Maximum=6, Minimum=0, Value=[1, 5])
evaluate_box = EvaluateBox(Box=brep, UParameter=gene_pool_5, VParameter=gene_pool_3, WParameter=gene_pool_4)  # -> Plane, Point, Include
evaluate_box_2 = EvaluateBox(Box=brep, UParameter=gene_pool_6, VParameter=gene_pool_7, WParameter=gene_pool_8)  # -> Plane, Point, Include
evaluate_box_3 = EvaluateBox(Box=brep, UParameter=gene_pool, VParameter=gene_pool_2, WParameter=Slider(0, range=0..100))  # -> Plane, Point, Include
multiplication = Multiplication(A=gene_pool_11, B="4")
multiplication_2 = Multiplication(A=gene_pool_9, B="4")
multiplication_3 = Multiplication(A=gene_pool_10, B="2")
center_box = CenterBox(Base=evaluate_box_3.Plane, X=multiplication, Y=multiplication_2, Z=multiplication_3)
box_2pt = Box2Pt(PointA=evaluate_box_2.Plane, PointB=evaluate_box.Plane, Plane=PlaneXY(0, 0, 0))
unit_z = UnitZ(Factor=multiplication_3)
unit_z_2 = UnitZ(Factor=Slider(5, range=0..10))
move = Move(Geometry=center_box, Motion=unit_z)  # -> Geometry, Transform
move_2 = Move(Geometry=box_2pt, Motion=unit_z_2)  # -> Geometry, Transform
solid_difference = SolidDifference(BrepsA=flatten(move.Geometry), BrepsB=flatten(move_2.Geometry))
brep_join = BrepJoin(Breps=solid_difference)  # -> Breps, Closed
dispatch = Dispatch(List=brep_join.Breps, DispatchPattern=brep_join.Closed)  # -> ListA, ListB
brep_2 = Brep(dispatch.ListA)
open_weather_file = Ladybug_OpenEPWWeatherFile(open=Toggle(True))  # -> epwFile; plug-in component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
deconstruct_brep = DeconstructBrep(Brep=brep_2)  # -> Faces, Edges, Vertices
volume = Volume(Geometry=brep_2)  # -> flatten(Volume), Centroid
mass_addition = MassAddition(Input=flatten(volume.Volume))  # -> Result, PartialResults
curve = Curve(<curve referenced from the Rhino model>)
area = Area(Geometry=deconstruct_brep.Faces)  # -> Area, Centroid
importepw = Ladybug_ImportEpw(epwFile=open_weather_file)  # -> Output, latitude, location, dryBulbTemperature, dewPointTemperature, relativeHumidity, windSpeed, windDirection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; plug-in component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
construct_point = ConstructPoint(XCoordinate=0, YCoordinate=0, ZCoordinate=0)
subtraction = Subtraction(A="60000", B=mass_addition.Result)
curve_closest_point = CurveClosestPoint(Point=volume.Centroid, Curve=curve)  # -> Point, Parameter, Distance
mass_addition_2 = MassAddition(Input=flatten(area.Area))  # -> Result, PartialResults
multiplication_4 = Multiplication(A=subtraction, B=subtraction)
ladybug = Ladybug_Ladybug()  # -> out; plug-in component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
evaluate_surface = EvaluateSurface(Surface=deconstruct_brep.Faces, Point=construct_point)  # -> Point, Normal, UDirection, VDirection, Frame
distance = Distance(PointA=volume.Centroid, PointB=curve_closest_point.Point)
analysisperiod = Ladybug_AnalysisPeriod(fromMonth="11", fromDay="1", fromHour="9", toMonth="2", toDay="31", toHour="17")  # -> out, analysisPeriod; plug-in component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
multiplication_5 = Multiplication(A=mass_addition_2.Result, B="-1")
panel = Panel(ladybug)
mass_addition_3 = MassAddition(Input=distance)  # -> Result, PartialResults
deconstruct_vector = DeconstructVector(Vector=evaluate_surface.Normal)  # -> XComponent, YComponent, ZComponent
absolute = Absolute(Value=deconstruct_vector.ZComponent)
multiplication_6 = Multiplication(A=mass_addition_3.Result, B="-1")
group = Group(Geometry=brep_2)
equality = Equality(FirstNumber=absolute, SecondNumber="1")  # -> Equality, Inequality
sunpath = Ladybug_SunPath(
    location=importepw.location,
    hour=12,
    day=21,
    month=12,
    timeStep=1,
    analysisPeriod=analysisperiod.analysisPeriod,
    sunPathScale=Slider(2, range=0..10),
    dailyOrAnnualSunPath=True)  # -> out, sunVectors, sunAltitudes, sunAzimuths, port, sunSpheresMesh, sunPathCrvs, compassCrvs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; plug-in component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
dispatch_2 = Dispatch(List=deconstruct_brep.Faces, DispatchPattern=equality.Equality)  # -> ListA, ListB
number_slider = Slider(400, range=0..400)
surface = Surface(<surface referenced from the Rhino model>)
decode_phenotype = DecodePhenotype()  # -> GeometriesList, MeshesList, NumbersList, TextList
area_2 = Area(Geometry=dispatch_2.ListA)  # -> Area, Centroid; disabled
flip = Flip()  # -> Surface, Result
series = Series(Start=number_slider, Step=number_slider, Count=Slider(10, range=0..100))
mass_addition_4 = MassAddition(Input=flatten(area_2.Area))  # -> Result, PartialResults; disabled
sunlighthoursanalysis = Ladybug_SunlightHoursAnalysis(
    geometry=flatten(dispatch_2.ListB),
    context=flatten(brep_2),
    gridSize=Slider(10, range=0..10),
    disFromBase=Slider(0.01, range=0..1),
    sunVectors=flatten(sunpath.sunVectors),
    timeStep=1,
    parallel=Toggle(True),
    runIt=Toggle(True))  # -> out, contextMesh, analysisMesh, testPts, testVec, port, sunlightHoursResult, sunlightHoursMesh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; plug-in component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
unit_x = UnitX(Factor=series)
vector_xyz = VectorXYZ(XComponent=0, YComponent=series, ZComponent=0)  # -> Vector, Length
move_3 = Move(Geometry=flatten(decode_phenotype.GeometriesList), Motion=vector_xyz.Vector)  # -> Geometry, Transform
multiplication_7 = Multiplication(A=mass_addition_4.Result, B="-2")  # disabled
addition = Addition(A=mass_addition_2.Result, B=multiplication_7)  # disabled
multiplication_8 = Multiplication(A=sunlighthoursanalysis.totalSunlightHours, B="-1")
wallacei_x = WallaceiX(
    Genes=[gene_pool_2, gene_pool, gene_pool_11, gene_pool_9, gene_pool_10, gene_pool_6, gene_pool_7, gene_pool_8, gene_pool_5, gene_pool_3, gene_pool_4],
    Objectives=[multiplication_4, multiplication_8, multiplication_6],
    Phenotype=group,
    allFitness="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",
    allFrontIdx="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",
    allGenomes="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",
    curFrontIdx="99|0;99|1;99|2;99|3;99|4;99|5;99|6;99|7;99|8;99|9;99|10;99|11;99|12;99|13;99|14;99|15;99|16;99|17;99|18;99|19;99|20;99|21;99|22;99|23;99|24;99|25;99|26;99|27;99|28;99|29;99|30;99|31;99|32;99|33;99|34;99|35;99|36;99|37;99|38;99|39;99|40;99|41;99|42;99|43;99|44;99|45;99|46;99|47;99|48;99|49",
    curFrontIdxSave="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",
    popGen="50,100",
    total="2178969",
    wlcDone=True)  # -> WallaceiGenomes, FitnessValues, Data, Phenotypes
