# Grasshopper definition python study 9 ziggurat courtyard octopus.gh (Grasshopper 1.0.8)
# plug-ins: Octopus

gene_pool = GenePool(
    Decimals=1,
    Maximum=1,
    Minimum=0,
    Value=[0.7308185071, 0.0907583714, 0.9998728845, 0.5033958001, 0.9492420622, 0.8089074136, 0.4146453416, 0.4588514191, 0.5535176193, 0.4879697981, 0.4937343724, 0.1412698034, 0.3970638292, 0.9804466124, 0.2210655589, 0.5693030308, 0.307304081, 0.9982641802, 0.2013419623, 0.7089365193, 0.2534973358, 0.05023321881, 0.07375653603, 0.2585280729])
surface = Surface(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)  # disabled
curve = Curve(<curve referenced from the Rhino model>)
python_3_script = Python3Script(
    genes=gene_pool,
    site_crv=curve,
    max_height=Slider(50, range=0..100),
    cell_size=Slider(9, range=0..20),
    max_radius_x=Slider(20, range=0..100),
    max_radius_y=Slider(100, range=0..100),
    max_radius_z=Slider(100, range=0..100))  # -> active_pts, void_pts, all_pts, cell_states, boxes, grid_x, grid_y, grid_z, volume, cell_count; inputs genes: list of Double, site_crv: Curve, max_height: Double, cell_size: Double, max_radius_x: Double, max_radius_y: Double, max_radius_z: Double
# ---------- python_3_script: Python ----------
"""3D Grid Massing Generator - Single Genepool
Inputs:
    genes: list of 24 floats [0-1] from Wallacei genepool - List Access
    site_crv: site boundary curve (planar, on ground) - Item Access
    max_height: float - maximum building height in meters - Item Access
    cell_size: float - voxel cell size in meters - Item Access
    max_radius_x: float - max ellipsoid radius x in meters - Item Access
    max_radius_y: float - max ellipsoid radius y in meters - Item Access
    max_radius_z: float - max ellipsoid radius z in meters - Item Access
Outputs:
    active_pts: center points of solid cells
    void_pts: center points of void-cut cells
    all_pts: all grid points
    cell_states: 0=empty 1=solid 2=void 3=outside
    boxes: brep boxes for solid cells
    grid_x: int
    grid_y: int
    grid_z: int
    volume: total solid volume
    cell_count: number of solid cells
"""

import Rhino.Geometry as rg
import math

# defaults
if cell_size is None:
    cell_size = 3.0
if max_height is None:
    max_height = 21.0
if max_radius_x is None:
    max_radius_x = 20.0
if max_radius_y is None:
    max_radius_y = 20.0
if max_radius_z is None:
    max_radius_z = 15.0

# site bounds
bbox = site_crv.GetBoundingBox(True)
s_min = bbox.Min
s_max = bbox.Max
site_w = s_max.X - s_min.X
site_d = s_max.Y - s_min.Y

# grid dims
nx = int(math.ceil(site_w / cell_size))
ny = int(math.ceil(site_d / cell_size))
nz = int(math.ceil(max_height / cell_size))

# origin so grid centers on site
ox = s_min.X + (site_w - nx * cell_size) / 2.0
oy = s_min.Y + (site_d - ny * cell_size) / 2.0
oz = s_min.Z

# parse genes into attractors and repellers
# each entity: 6 genes [x, y, z, rx, ry, rz]
def parse_entity(g, offset):
    cx = ox + g[offset + 0] * nx * cell_size
    cy = oy + g[offset + 1] * ny * cell_size
    cz = oz + g[offset + 2] * nz * cell_size
    rx = g[offset + 3] * max_radius_x
    ry = g[offset + 4] * max_radius_y
    rz = g[offset + 5] * max_radius_z
    return (rg.Point3d(cx, cy, cz), rx, ry, rz)

attractors = [parse_entity(genes, 0), parse_entity(genes, 6)]
repellers = [parse_entity(genes, 12), parse_entity(genes, 18)]

# ellipsoid test
def in_ellipsoid(pt, center, rx, ry, rz):
    if rx < 0.01 or ry < 0.01 or rz < 0.01:
        return False
    dx = (pt.X - center.X) / rx
    dy = (pt.Y - center.Y) / ry
    dz = (pt.Z - center.Z) / rz
    return (dx * dx + dy * dy + dz * dz) <= 1.0

# site containment
plane = rg.Plane.WorldXY
tol = cell_size * 0.1

def on_site(pt):
    tp = rg.Point3d(pt.X, pt.Y, plane.OriginZ)
    r = site_crv.Contains(tp, plane, tol)
    return r == rg.PointContainment.Inside or r == rg.PointContainment.Coincident

# build grid
active_pts = []
void_pts = []
all_pts = []
cell_states = []
boxes = []

half = cell_size / 2.0
bx_int = rg.Interval(0, cell_size)

for ix in range(nx):
    for iy in range(ny):
        for iz in range(nz):
            cx = ox + (ix + 0.5) * cell_size
            cy = oy + (iy + 0.5) * cell_size
            cz = oz + (iz + 0.5) * cell_size
            pt = rg.Point3d(cx, cy, cz)
            all_pts.append(pt)

            if not on_site(pt):
                cell_states.append(3)
                continue

            hit_a = False
            for c, rx, ry, rz in attractors:
                if in_ellipsoid(pt, c, rx, ry, rz):
                    hit_a = True
                    break

            if not hit_a:
                cell_states.append(0)
                continue

            hit_r = False
            for c, rx, ry, rz in repellers:
                if in_ellipsoid(pt, c, rx, ry, rz):
                    hit_r = True
                    break

            if hit_r:
                cell_states.append(2)
                void_pts.append(pt)
                continue

            cell_states.append(1)
            active_pts.append(pt)

            corner = rg.Point3d(cx - half, cy - half, cz - half)
            bp = rg.Plane(corner, rg.Vector3d.XAxis, rg.Vector3d.YAxis)
            box = rg.Box(bp, bx_int, bx_int, bx_int)
            boxes.append(box.ToBrep())

grid_x = nx
grid_y = ny
grid_z = nz
volume = len(active_pts) * (cell_size ** 3)
cell_count = len(active_pts)
# ---------- end python_3_script ----------

# ---- group: geomtry creation
# GEOMTRY CREATION
gene_pool_2 = GenePool(Decimals=1, Maximum=1, Minimum=0, Value=[0.04004967202, 0.1130382098])
gene_pool_3 = GenePool(Decimals=1, Maximum=1, Minimum=0, Value=[0.5013502564, 0.001877628688])
gene_pool_4 = GenePool(Decimals=0, Maximum=8, Minimum=0, Value=[6.286368737, 4.99471562])
gene_pool_5 = GenePool(Decimals=0, Maximum=8, Minimum=0, Value=[5.033363802, 7.990495868])
gene_pool_6 = GenePool(Decimals=0, Maximum=7, Minimum=2, Value=[6.888010928, 6.970815271])
construct_point = ConstructPoint(XCoordinate=gene_pool_2, YCoordinate=gene_pool_3, ZCoordinate=0)
multiplication = Multiplication(A=gene_pool_4, B="4")
multiplication_2 = Multiplication(A=gene_pool_5, B="4")
multiplication_3 = Multiplication(A=gene_pool_6, B="2")
evaluate_surface = EvaluateSurface(Surface=reparameterize(surface), Point=construct_point)  # -> Point, Normal, UDirection, VDirection, Frame
unit_z = UnitZ(Factor=multiplication_3)
# 2 BOX
center_box = CenterBox(Base=evaluate_surface.Point, X=multiplication, Y=multiplication_2, Z=multiplication_3)
# 2 VOID
move = Move(Geometry=center_box, Motion=unit_z)  # -> Geometry, Transform

gene_pool_7 = GenePool(Decimals=1, Maximum=1, Minimum=0, Value=[0.350978497, 0.001047330545])
gene_pool_8 = GenePool(Decimals=1, Maximum=1, Minimum=0, Value=[0.3378252541, 0.5643376453])
gene_pool_9 = GenePool(Decimals=0, Maximum=7, Minimum=0, Value=[6.999916857, 0.08104076137])
gene_pool_10 = GenePool(Decimals=0, Maximum=10, Minimum=0, Value=[3.818940118, 9.558511165])
gene_pool_11 = GenePool(Decimals=0, Maximum=10, Minimum=0, Value=[7.055186066, 3.610608463])
construct_point_2 = ConstructPoint(XCoordinate=gene_pool_7, YCoordinate=gene_pool_8, ZCoordinate=0)
multiplication_4 = Multiplication(A=gene_pool_9, B="2")
multiplication_5 = Multiplication(A=gene_pool_10, B="4")
multiplication_6 = Multiplication(A=gene_pool_11, B="4")
multiplication_7 = Multiplication(A=Slider(10, range=0..10), B="2")
evaluate_surface_2 = EvaluateSurface(Surface=reparameterize(surface), Point=construct_point_2)  # -> Point, Normal, UDirection, VDirection, Frame
unit_z_2 = UnitZ(Factor=multiplication_4)
unit_z_3 = UnitZ(Factor=multiplication_7)
move_2 = Move(Geometry=evaluate_surface_2.Point, Motion=unit_z_2)  # -> Geometry, Transform
center_box_2 = CenterBox(Base=move_2.Geometry, X=multiplication_5, Y=multiplication_6, Z=multiplication_7)
move_3 = Move(Geometry=center_box_2, Motion=unit_z_3)  # -> Geometry, Transform

# ----
brep = Brep(<brep referenced from the Rhino model>)

# ---- group: geomtry creation
solid_difference = SolidDifference(BrepsA=flatten(move.Geometry), BrepsB=flatten([move_3.Geometry, brep]))
solid_union = SolidUnion(Breps=solid_difference)
brep_join = BrepJoin(Breps=solid_union)  # -> Breps, Closed
# CUT
dispatch = Dispatch(List=brep_join.Breps, DispatchPattern=brep_join.Closed)  # -> ListA, ListB
brep_2 = Brep(dispatch.ListA)

# ----
# FACE SELECTOR
deconstruct_brep = DeconstructBrep(Brep=brep_2)  # -> Faces, Edges, Vertices
construct_point_3 = ConstructPoint(XCoordinate=0, YCoordinate=0, ZCoordinate=0)
evaluate_surface_3 = EvaluateSurface(Surface=deconstruct_brep.Faces, Point=construct_point_3)  # -> Point, Normal, UDirection, VDirection, Frame
deconstruct_vector = DeconstructVector(Vector=evaluate_surface_3.Normal)  # -> XComponent, YComponent, ZComponent
absolute = Absolute(Value=deconstruct_vector.YComponent)
equality = Equality(FirstNumber=absolute, SecondNumber="1")  # -> Equality, Inequality
dispatch_2 = Dispatch(List=deconstruct_brep.Faces, DispatchPattern=equality.Equality)  # -> ListA, ListB

# ----
# AVG SUNLIGHT HOURS
ladybug = Ladybug_Ladybug()  # -> out; plug-in component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
panel = Panel(ladybug)
open_weather_file = Ladybug_OpenEPWWeatherFile(open=Toggle(True))  # -> epwFile; plug-in component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
importepw = Ladybug_ImportEpw(epwFile=open_weather_file)  # -> Output, latitude, location, dryBulbTemperature, dewPointTemperature, relativeHumidity, windSpeed, windDirection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; plug-in component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
analysisperiod = Ladybug_AnalysisPeriod(fromMonth="11", fromDay="1", fromHour="9", toMonth="2", toDay="31", toHour="17")  # -> out, analysisPeriod; plug-in component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
flip = Flip()  # -> Surface, Result
sunpath = Ladybug_SunPath(
    location=importepw.location,
    hour=12,
    day=21,
    month=12,
    timeStep=1,
    analysisPeriod=analysisperiod.analysisPeriod,
    sunPathScale=Slider(2, range=0..10),
    dailyOrAnnualSunPath=True)  # -> out, sunVectors, sunAltitudes, sunAzimuths, port, sunSpheresMesh, sunPathCrvs, compassCrvs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; plug-in component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
surface_2 = Surface(<surface referenced from the Rhino model>)
sunlighthoursanalysis = Ladybug_SunlightHoursAnalysis(
    geometry=flatten(dispatch_2.ListA),
    context=flatten(brep_2),
    gridSize=Slider(6, range=0..10),
    disFromBase=Slider(0.01, range=0..1),
    sunVectors=flatten(sunpath.sunVectors),
    timeStep=1,
    parallel=Toggle(True),
    runIt=Toggle(True))  # -> out, contextMesh, analysisMesh, testPts, testVec, port, sunlightHoursResult, sunlightHoursMesh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; plug-in component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
multiplication_8 = Multiplication(A=sunlighthoursanalysis.totalSunlightHours, B="-1")

volume = Volume(Geometry=brep_2)  # -> flatten(Volume), Centroid

curve_2 = Curve(<curve referenced from the Rhino model>)
curve_3 = Curve(<curve referenced from the Rhino model>)
curve_4 = Curve(<curve referenced from the Rhino model>)
# NOISE
curve_closest_point = CurveClosestPoint(Point=volume.Centroid, Curve=graft([curve_4, curve_2]))  # -> flatten(Point), Parameter, Distance
curve_closest_point_2 = CurveClosestPoint(Point=volume.Centroid, Curve=graft(curve_3))  # -> flatten(Point), Parameter, Distance
distance = Distance(PointA=volume.Centroid, PointB=curve_closest_point.Point)
distance_2 = Distance(PointA=volume.Centroid, PointB=curve_closest_point_2.Point)
# FACE AREA SN
panel_2 = Panel("-3")
power = Power(A=distance, B="-2")
power_2 = Power(A=distance_2, B=panel_2)
mass_addition = MassAddition(Input=[power, power_2])  # -> Result, PartialResults
multiplication_9 = Multiplication(A=mass_addition.Result, B="1")

number_slider = Slider(10, range=0..10)

area = Area(Geometry=dispatch_2.ListA)  # -> Area, Centroid
mass_addition_2 = MassAddition(Input=flatten(area.Area))  # -> Result, PartialResults
area_2 = Area(Geometry=deconstruct_brep.Faces)  # -> Area, Centroid
mass_addition_3 = MassAddition(Input=flatten(area_2.Area))  # -> Result, PartialResults
multiplication_10 = Multiplication(A=mass_addition_2.Result, B="-1")
addition = Addition(A=mass_addition_3.Result, B=multiplication_10)  # disabled

surface_3 = Surface(<surface referenced from the Rhino model>)
unit_z_4 = UnitZ(Factor="60")
extrude = Extrude(Base=surface_3, Direction=unit_z_4)  # disabled
shape_in_brep = ShapeInBrep(Brep=extrude, Shape=brep_2)
multiplication_11 = Multiplication(A="10000000", B=shape_in_brep)
mass_addition_4 = MassAddition(Input=multiplication_11)  # -> Result, PartialResults

# ----
# VOLUME
mass_addition_5 = MassAddition(Input=flatten(volume.Volume))  # -> Result, PartialResults
subtraction = Subtraction(A="60000", B=mass_addition_5.Result)
multiplication_12 = Multiplication(A=subtraction, B=subtraction)
multiplication_13 = Multiplication(A=multiplication_12, B="10000")

divide_surface = DivideSurface(Surface=graft(dispatch_2.ListA), UCount=number_slider, VCount=number_slider)  # -> Points, Normals, Parameters; disabled
# 100 X 100
# MUTATION 0.4
group = Group(Geometry=brep_2)
panel_3 = Panel("volume")
panel_4 = Panel("noise")
panel_5 = Panel("face")
octopus = Octopus(
    Phenotype=group,
    OctopusData_gene=[gene_pool_2, gene_pool_3, gene_pool_4, gene_pool_5, gene_pool_6, gene_pool_7, gene_pool_8, gene_pool_9, gene_pool_10, gene_pool_11],
    OctopusData_obj=[number_4, boolean, number_2, number_3, number])
number = Number(multiplication_8)
boolean = Boolean(Toggle(True))
number_2 = Number(multiplication_9)
number_3 = Number(multiplication_10)
number_4 = Number(multiplication_13)
