# Grasshopper definition python study 9 ziggurat courtyard refined.gh (Grasshopper 1.0.8)
# plug-ins: Wallacei

surface = Surface(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)

# ---- group: geomtry creation
# GEOMTRY CREATION
gene_pool = GenePool(Decimals=1, Maximum=1, Minimum=0, Value=[0.2, 0.3])
gene_pool_2 = GenePool(Decimals=1, Maximum=1, Minimum=0, Value=[0.3, 0.3])
gene_pool_3 = GenePool(Decimals=0, Maximum=8, Minimum=0, Value=[7, 3])
gene_pool_4 = GenePool(Decimals=0, Maximum=8, Minimum=0, Value=[1, 7])
gene_pool_5 = GenePool(Decimals=0, Maximum=7, Minimum=2, Value=[7, 7])
construct_point = ConstructPoint(XCoordinate=gene_pool, YCoordinate=gene_pool_2, ZCoordinate=0)
multiplication = Multiplication(A=gene_pool_3, B="4")
multiplication_2 = Multiplication(A=gene_pool_4, B="4")
multiplication_3 = Multiplication(A=gene_pool_5, B="2")
evaluate_surface = EvaluateSurface(Surface=reparameterize(surface), Point=construct_point)  # -> Point, Normal, UDirection, VDirection, Frame
unit_z = UnitZ(Factor=multiplication_3)
# 2 BOX
center_box = CenterBox(Base=evaluate_surface.Point, X=multiplication, Y=multiplication_2, Z=multiplication_3)
# 2 VOID
move = Move(Geometry=center_box, Motion=unit_z)  # -> Geometry, Transform

gene_pool_6 = GenePool(Decimals=1, Maximum=1, Minimum=0, Value=[0.3, 0.3])
gene_pool_7 = GenePool(Decimals=1, Maximum=1, Minimum=0, Value=[0.4, 0.6])
gene_pool_8 = GenePool(Decimals=0, Maximum=7, Minimum=0, Value=[4, 0])
gene_pool_9 = GenePool(Decimals=0, Maximum=10, Minimum=0, Value=[6, 10])
gene_pool_10 = GenePool(Decimals=0, Maximum=10, Minimum=0, Value=[4, 2])
construct_point_2 = ConstructPoint(XCoordinate=gene_pool_6, YCoordinate=gene_pool_7, ZCoordinate=0)
multiplication_4 = Multiplication(A=gene_pool_8, B="2")
multiplication_5 = Multiplication(A=gene_pool_9, B="4")
multiplication_6 = Multiplication(A=gene_pool_10, B="4")
multiplication_7 = Multiplication(A=Slider(10, range=0..10), B="2")
evaluate_surface_2 = EvaluateSurface(Surface=reparameterize(surface), Point=construct_point_2)  # -> Point, Normal, UDirection, VDirection, Frame
unit_z_2 = UnitZ(Factor=multiplication_4)
move_2 = Move(Geometry=evaluate_surface_2.Point, Motion=unit_z_2)  # -> Geometry, Transform
unit_z_3 = UnitZ(Factor=multiplication_7)
center_box_2 = CenterBox(Base=move_2.Geometry, X=multiplication_5, Y=multiplication_6, Z=multiplication_7)
move_3 = Move(Geometry=center_box_2, Motion=unit_z_3)  # -> Geometry, Transform

# ----
brep = Brep(<brep referenced from the Rhino model>)

# ---- group: geomtry creation
solid_difference = SolidDifference(BrepsA=flatten(move.Geometry), BrepsB=flatten([move_3.Geometry, brep]))
solid_union = SolidUnion(Breps=solid_difference)
brep_join = BrepJoin(Breps=solid_union)  # -> Breps, Closed
# CUT
dispatch = Dispatch(List=brep_join.Breps, DispatchPattern=brep_join.Closed)  # -> ListA, ListB
brep_2 = Brep(dispatch.ListA)

# ----
# FACE SELECTOR
deconstruct_brep = DeconstructBrep(Brep=brep_2)  # -> Faces, Edges, Vertices
construct_point_3 = ConstructPoint(XCoordinate=0, YCoordinate=0, ZCoordinate=0)
evaluate_surface_3 = EvaluateSurface(Surface=deconstruct_brep.Faces, Point=construct_point_3)  # -> Point, Normal, UDirection, VDirection, Frame
deconstruct_vector = DeconstructVector(Vector=evaluate_surface_3.Normal)  # -> XComponent, YComponent, ZComponent
absolute = Absolute(Value=deconstruct_vector.YComponent)
equality = Equality(FirstNumber=absolute, SecondNumber="1")  # -> Equality, Inequality
dispatch_2 = Dispatch(List=deconstruct_brep.Faces, DispatchPattern=equality.Equality)  # -> ListA, ListB

# ----
# AVG SUNLIGHT HOURS
ladybug = Ladybug_Ladybug()  # -> out; plug-in component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
panel = Panel(ladybug)
open_weather_file = Ladybug_OpenEPWWeatherFile(open=Toggle(True))  # -> epwFile; plug-in component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
importepw = Ladybug_ImportEpw(epwFile=open_weather_file)  # -> Output, latitude, location, dryBulbTemperature, dewPointTemperature, relativeHumidity, windSpeed, windDirection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; plug-in component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
analysisperiod = Ladybug_AnalysisPeriod(fromMonth="11", fromDay="1", fromHour="9", toMonth="2", toDay="31", toHour="17")  # -> out, analysisPeriod; plug-in component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
flip = Flip()  # -> Surface, Result
sunpath = Ladybug_SunPath(
    location=importepw.location,
    hour=12,
    day=21,
    month=12,
    timeStep=1,
    analysisPeriod=analysisperiod.analysisPeriod,
    sunPathScale=Slider(2, range=0..10),
    dailyOrAnnualSunPath=True)  # -> out, sunVectors, sunAltitudes, sunAzimuths, port, sunSpheresMesh, sunPathCrvs, compassCrvs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; plug-in component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
surface_2 = Surface(<surface referenced from the Rhino model>)
sunlighthoursanalysis = Ladybug_SunlightHoursAnalysis(
    geometry=flatten(dispatch_2.ListA),
    context=flatten(brep_2),
    gridSize=Slider(10, range=0..10),
    disFromBase=Slider(0.01, range=0..1),
    sunVectors=flatten(sunpath.sunVectors),
    timeStep=1,
    parallel=Toggle(True),
    runIt=Toggle(True))  # -> out, contextMesh, analysisMesh, testPts, testVec, port, sunlightHoursResult, sunlightHoursMesh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; plug-in component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
multiplication_8 = Multiplication(A=sunlighthoursanalysis.totalSunlightHours, B="-1")

volume = Volume(Geometry=brep_2)  # -> flatten(Volume), Centroid

curve = Curve(<curve referenced from the Rhino model>)
curve_2 = Curve(<curve referenced from the Rhino model>)
curve_3 = Curve(<curve referenced from the Rhino model>)
# NOISE
curve_closest_point = CurveClosestPoint(Point=volume.Centroid, Curve=graft([curve_3, curve]))  # -> flatten(Point), Parameter, Distance
curve_closest_point_2 = CurveClosestPoint(Point=volume.Centroid, Curve=graft(curve_2))  # -> flatten(Point), Parameter, Distance
distance = Distance(PointA=volume.Centroid, PointB=curve_closest_point.Point)
distance_2 = Distance(PointA=volume.Centroid, PointB=curve_closest_point_2.Point)
# FACE AREA SN
panel_2 = Panel("-3")
power = Power(A=distance, B="-2")
power_2 = Power(A=distance_2, B=panel_2)
mass_addition = MassAddition(Input=[power, power_2])  # -> Result, PartialResults
multiplication_9 = Multiplication(A=mass_addition.Result, B="1")

number_slider = Slider(10, range=0..10)

area = Area(Geometry=dispatch_2.ListA)  # -> Area, Centroid
mass_addition_2 = MassAddition(Input=flatten(area.Area))  # -> Result, PartialResults
area_2 = Area(Geometry=deconstruct_brep.Faces)  # -> Area, Centroid
mass_addition_3 = MassAddition(Input=flatten(area_2.Area))  # -> Result, PartialResults
multiplication_10 = Multiplication(A=mass_addition_2.Result, B="-1")
addition = Addition(A=mass_addition_3.Result, B=multiplication_10)  # disabled

surface_3 = Surface(<surface referenced from the Rhino model>)
unit_z_4 = UnitZ(Factor="60")
extrude = Extrude(Base=surface_3, Direction=unit_z_4)  # disabled
shape_in_brep = ShapeInBrep(Brep=extrude, Shape=brep_2)
multiplication_11 = Multiplication(A="10000000", B=shape_in_brep)
mass_addition_4 = MassAddition(Input=multiplication_11)  # -> Result, PartialResults

# ----
# VOLUME
mass_addition_5 = MassAddition(Input=flatten(volume.Volume))  # -> Result, PartialResults
subtraction = Subtraction(A="60000", B=mass_addition_5.Result)
multiplication_12 = Multiplication(A=subtraction, B=subtraction)
multiplication_13 = Multiplication(A=multiplication_12, B="10000")

divide_surface = DivideSurface(Surface=graft(dispatch_2.ListA), UCount=number_slider, VCount=number_slider)  # -> Points, Normals, Parameters
group = Group(Geometry=brep_2)
# 100 X 100
# MUTATION 0.4
wallacei_x = WallaceiX(
    Genes=[gene_pool_2, gene_pool, gene_pool_3, gene_pool_4, gene_pool_5, gene_pool_6, gene_pool_7, gene_pool_8, gene_pool_9, gene_pool_10],
    Objectives=[multiplication_10, multiplication_9, multiplication_8, multiplication_13],
    Phenotype=group,
    popGen="100,100",
    total="3155531",
    wlcDone=True)  # -> WallaceiGenomes, FitnessValues, Data, Phenotypes
decode_phenotype = DecodePhenotype()  # -> GeometriesList, MeshesList, NumbersList, TextList
series = Series(Start=Slider(400, range=0..1000), Step=Slider(99, range=0..400), Count=Slider(336, range=0..1000))
vector_xyz = VectorXYZ(XComponent=0, YComponent=series, ZComponent=0)  # -> Vector, Length
move_4 = Move(Geometry=flatten(decode_phenotype.GeometriesList), Motion=vector_xyz.Vector)  # -> Geometry, Transform
