# Grasshopper definition python study 9 ziggurat courtyard voxel.gh (Grasshopper 1.0.8)
# plug-ins: Wallacei

surface = Surface(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)
gene_pool = GenePool(Decimals=0, Maximum=20, Minimum=0, Value=0)
gene_pool_2 = GenePool(Decimals=0, Maximum=20, Minimum=0, Value=3)
brep = Brep(<brep referenced from the Rhino model>)
number_slider = Slider(10, range=0..10)
decode_phenotype = DecodePhenotype()  # -> GeometriesList, MeshesList, NumbersList, TextList
series = Series(Start=Slider(400, range=0..1000), Step=Slider(99, range=0..400), Count=Slider(336, range=0..1000))
vector_xyz = VectorXYZ(XComponent=0, YComponent=series, ZComponent=0)  # -> Vector, Length
move = Move(Geometry=flatten(decode_phenotype.GeometriesList), Motion=vector_xyz.Vector)  # -> Geometry, Transform

# ----
# experiment
number_slider_2 = Slider(40, range=0..100)
unit_z = UnitZ(Factor=number_slider_2)
extrude = Extrude(Base=surface, Direction=unit_z)
number_slider_3 = Slider(4, range=0..10)

# ---- group: geomtry creation
gene_pool_3 = GenePool(Decimals=0, Maximum=8, Minimum=0, Value=[5, 6])
gene_pool_4 = GenePool(Decimals=1, Maximum=1, Minimum=0, Value=0.5)
gene_pool_5 = GenePool(Decimals=0, Maximum=8, Minimum=0, Value=[4, 8])
gene_pool_6 = GenePool(Decimals=0, Maximum=7, Minimum=2, Value=[4, 6])
# GEOMTRY CREATION
gene_pool_7 = GenePool(Decimals=1, Maximum=1, Minimum=0, Value=0.5)
panel = Panel("4")
construct_point = ConstructPoint(XCoordinate=gene_pool_7, YCoordinate=gene_pool_4, ZCoordinate=0)
multiplication = Multiplication(A=gene_pool_3, B=panel)
multiplication_2 = Multiplication(A=gene_pool_5, B=panel)
multiplication_3 = Multiplication(A=gene_pool_6, B="2")
evaluate_surface = EvaluateSurface(Surface=reparameterize(surface), Point=construct_point)  # -> Point, Normal, UDirection, VDirection, Frame
unit_z_2 = UnitZ(Factor=multiplication_3)

# ----
multiplication_4 = Multiplication(A=gene_pool_2, B=panel)
multiplication_5 = Multiplication(A=gene_pool, B=panel)
vector_xyz_2 = VectorXYZ(XComponent=multiplication_4, YComponent=multiplication_5, ZComponent=0)  # -> Vector, Length
move_2 = Move(Geometry=evaluate_surface.Point, Motion=vector_xyz_2.Vector)  # -> Geometry, Transform

# ---- group: geomtry creation (continued)
# 2 BOX
center_box = CenterBox(Base=[evaluate_surface.Point, move_2.Geometry], X=multiplication, Y=multiplication_2, Z=multiplication_3)
# 2 VOID
move_3 = Move(Geometry=center_box, Motion=unit_z_2)  # -> Geometry, Transform

gene_pool_8 = GenePool(Decimals=0, Maximum=20, Minimum=-20, Value=[4, -7])
gene_pool_9 = GenePool(Decimals=0, Maximum=20, Minimum=-20, Value=[2, 5])
gene_pool_10 = GenePool(Decimals=0, Maximum=7, Minimum=0, Value=[1, 3])
gene_pool_11 = GenePool(Decimals=0, Maximum=10, Minimum=0, Value=[2, 3])
gene_pool_12 = GenePool(Decimals=0, Maximum=10, Minimum=0, Value=[8, 1])
multiplication_6 = Multiplication(A=gene_pool_10, B="2")
multiplication_7 = Multiplication(A=gene_pool_12, B="4")
multiplication_8 = Multiplication(A=gene_pool_11, B="4")
multiplication_9 = Multiplication(A=Slider(10, range=0..10), B="2")
unit_z_3 = UnitZ(Factor=multiplication_6)
unit_z_4 = UnitZ(Factor=multiplication_9)

# ----
multiplication_10 = Multiplication(A=gene_pool_8, B=panel)
multiplication_11 = Multiplication(A=gene_pool_9, B=panel)
vector_xyz_3 = VectorXYZ(XComponent=multiplication_10, YComponent=multiplication_11, ZComponent=0)  # -> Vector, Length
move_4 = Move(Geometry=evaluate_surface.Point, Motion=vector_xyz_3.Vector)  # -> Geometry, Transform

# ---- group: geomtry creation (continued)
move_5 = Move(Geometry=move_4.Geometry, Motion=unit_z_3)  # -> Geometry, Transform
center_box_2 = CenterBox(Base=move_5.Geometry, X=multiplication_7, Y=multiplication_8, Z=multiplication_9)
move_6 = Move(Geometry=center_box_2, Motion=unit_z_4)  # -> Geometry, Transform

solid_difference = SolidDifference(BrepsA=flatten(move_3.Geometry), BrepsB=flatten([move_6.Geometry, brep]))
solid_union = SolidUnion(Breps=solid_difference)
brep_join = BrepJoin(Breps=solid_union)  # -> Breps, Closed
# CUT
dispatch = Dispatch(List=brep_join.Breps, DispatchPattern=brep_join.Closed)  # -> ListA, ListB
brep_2 = Brep(dispatch.ListA)

# ----
populate_3d = Populate3D(Region=brep_2, Count=Slider(1000, range=0..1000), Seed=Slider(704248, range=0..1000000))  # disabled
point_in_brep = PointInBrep(Brep=extrude, Point=populate_3d, Strict=False)
cull_pattern = CullPattern(List=populate_3d, CullPattern=point_in_brep)
point_in_brep_2 = PointInBrep(Brep=brep_2, Point=cull_pattern, Strict=False)
cull_pattern_2 = CullPattern(List=cull_pattern, CullPattern=point_in_brep_2)
center_box_3 = CenterBox(Base=cull_pattern_2, X=number_slider_3, Y=number_slider_3, Z=number_slider_3)

# ----
# FACE SELECTOR
deconstruct_brep = DeconstructBrep(Brep=brep_2)  # -> Faces, Edges, Vertices
construct_point_2 = ConstructPoint(XCoordinate=0, YCoordinate=0, ZCoordinate=0)
evaluate_surface_2 = EvaluateSurface(Surface=deconstruct_brep.Faces, Point=construct_point_2)  # -> Point, Normal, UDirection, VDirection, Frame
deconstruct_vector = DeconstructVector(Vector=evaluate_surface_2.Normal)  # -> XComponent, YComponent, ZComponent
absolute = Absolute(Value=deconstruct_vector.YComponent)
equality = Equality(FirstNumber=absolute, SecondNumber="1")  # -> Equality, Inequality
dispatch_2 = Dispatch(List=deconstruct_brep.Faces, DispatchPattern=equality.Equality)  # -> ListA, ListB

# ----
# AVG SUNLIGHT HOURS
ladybug = Ladybug_Ladybug()  # -> out; plug-in component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
panel_2 = Panel(ladybug)
open_weather_file = Ladybug_OpenEPWWeatherFile(open=Toggle(True))  # -> epwFile; plug-in component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
importepw = Ladybug_ImportEpw(epwFile=open_weather_file)  # -> Output, latitude, location, dryBulbTemperature, dewPointTemperature, relativeHumidity, windSpeed, windDirection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; plug-in component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
analysisperiod = Ladybug_AnalysisPeriod(fromMonth="11", fromDay="1", fromHour="9", toMonth="2", toDay="31", toHour="17")  # -> out, analysisPeriod; plug-in component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
flip = Flip()  # -> Surface, Result
sunpath = Ladybug_SunPath(
    location=importepw.location,
    hour=12,
    day=21,
    month=12,
    timeStep=1,
    analysisPeriod=analysisperiod.analysisPeriod,
    sunPathScale=Slider(2, range=0..10),
    dailyOrAnnualSunPath=True)  # -> out, sunVectors, sunAltitudes, sunAzimuths, port, sunSpheresMesh, sunPathCrvs, compassCrvs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; plug-in component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
surface_2 = Surface(<surface referenced from the Rhino model>)
sunlighthoursanalysis = Ladybug_SunlightHoursAnalysis(
    geometry=flatten(dispatch_2.ListA),
    context=flatten(brep_2),
    gridSize=Slider(10, range=0..10),
    disFromBase=Slider(0.01, range=0..1),
    sunVectors=flatten(sunpath.sunVectors),
    timeStep=1,
    parallel=Toggle(True),
    runIt=Toggle(True))  # -> out, contextMesh, analysisMesh, testPts, testVec, port, sunlightHoursResult, sunlightHoursMesh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; plug-in component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
multiplication_12 = Multiplication(A=sunlighthoursanalysis.totalSunlightHours, B="-1")

volume = Volume(Geometry=brep_2)  # -> flatten(Volume), Centroid

curve = Curve(<curve referenced from the Rhino model>)
curve_2 = Curve(<curve referenced from the Rhino model>)
curve_3 = Curve(<curve referenced from the Rhino model>)
# NOISE
curve_closest_point = CurveClosestPoint(Point=volume.Centroid, Curve=graft([curve_3, curve]))  # -> flatten(Point), Parameter, Distance
curve_closest_point_2 = CurveClosestPoint(Point=volume.Centroid, Curve=graft(curve_2))  # -> flatten(Point), Parameter, Distance
distance = Distance(PointA=volume.Centroid, PointB=curve_closest_point.Point)
distance_2 = Distance(PointA=volume.Centroid, PointB=curve_closest_point_2.Point)
# FACE AREA SN
panel_3 = Panel("-3")
power = Power(A=distance, B="-2")
power_2 = Power(A=distance_2, B=panel_3)
mass_addition = MassAddition(Input=[power, power_2])  # -> Result, PartialResults
multiplication_13 = Multiplication(A=mass_addition.Result, B="1")

area = Area(Geometry=dispatch_2.ListA)  # -> Area, Centroid
mass_addition_2 = MassAddition(Input=flatten(area.Area))  # -> Result, PartialResults
area_2 = Area(Geometry=deconstruct_brep.Faces)  # -> Area, Centroid
mass_addition_3 = MassAddition(Input=flatten(area_2.Area))  # -> Result, PartialResults
multiplication_14 = Multiplication(A=mass_addition_2.Result, B="-1")
addition = Addition(A=mass_addition_3.Result, B=multiplication_14)  # disabled

surface_3 = Surface(<surface referenced from the Rhino model>)
unit_z_5 = UnitZ(Factor="60")
extrude_2 = Extrude(Base=surface_3, Direction=unit_z_5)  # disabled
shape_in_brep = ShapeInBrep(Brep=extrude_2, Shape=brep_2)
multiplication_15 = Multiplication(A="10000000", B=shape_in_brep)
mass_addition_4 = MassAddition(Input=multiplication_15)  # -> Result, PartialResults

# ----
# VOLUME
mass_addition_5 = MassAddition(Input=flatten(volume.Volume))  # -> Result, PartialResults
subtraction = Subtraction(A="60000", B=mass_addition_5.Result)
multiplication_16 = Multiplication(A=subtraction, B=subtraction)
multiplication_17 = Multiplication(A=multiplication_16, B="10000")

divide_surface = DivideSurface(Surface=graft(dispatch_2.ListA), UCount=number_slider, VCount=number_slider)  # -> Points, Normals, Parameters
group = Group(Geometry=brep_2)
# 100 X 100
# MUTATION 0.4
wallacei_x = WallaceiX(
    Genes=[gene_pool_4, gene_pool_7, gene_pool_3, gene_pool_5, gene_pool_6, gene_pool_8, gene_pool_9, gene_pool_10, gene_pool_12, gene_pool_11],
    Objectives=[multiplication_14, multiplication_13, multiplication_12, multiplication_17],
    Phenotype=group,
    allFitness="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",
    allFrontIdx="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",
    allGenomes="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",
    curFrontIdx="4|0;4|1;4|2;4|3;4|4;4|5;4|6;4|7;4|8;4|9;4|10;4|11;4|12;4|13;4|14;4|15;4|16;4|17;4|18;4|19;4|20;4|21;4|22;4|23;4|24;4|25;4|26;4|27;4|28;4|29;4|30;4|31;4|32;4|33;4|34;4|35;4|36;4|37;4|38;4|39;4|40;4|41;4|42;4|43;4|44;4|45;4|46;4|47;4|48;4|49;4|50;4|51;4|52;4|53;4|54;4|55;4|56;4|57;4|58;4|59;4|60;4|61;4|62;4|63;4|64;4|65;4|66;4|67;4|68;4|69;4|70;4|71;4|72;4|73;4|74;4|75;4|76;4|77;4|78;4|79;4|80;4|81;4|82;4|83;4|84;4|85;4|86;4|87;4|88;4|89;4|90;4|91;4|92;4|93;4|94;4|95;4|96;4|97;4|98;4|99",
    curFrontIdxSave="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",
    popGen="100,100",
    total="156500",
    wlcDone=True)  # -> WallaceiGenomes, FitnessValues, Data, Phenotypes
