# Grasshopper definition test1.gh (Grasshopper 1.0.8)

gene_pool = GenePool(Decimals=3, Maximum=1, Minimum=0, Value=[0.647, 0.171, 0.287])
gene_pool_2 = GenePool(Decimals=3, Maximum=1, Minimum=0, Value=[0.373, 0.468, 0.68])
surface = Surface(<surface referenced from the Rhino model>)
construct_point = ConstructPoint(XCoordinate=gene_pool_2, YCoordinate=gene_pool, ZCoordinate=0)
evaluate_surface = EvaluateSurface(Surface=reparameterize(surface), Point=construct_point)  # -> Point, Normal, UDirection, VDirection, Frame
polyline = PolyLine(Vertices=evaluate_surface.Point, Closed="-1")
polygon = Polygon(Plane=evaluate_surface.Point, Radius=Slider(10, range=0..10), Segments=Slider(6, range=0..10), FilletRadius=0)  # -> Polygon, Length
boundary_surfaces = BoundarySurfaces(Edges=polyline)
number_slider = Slider(4, range=0..10)
gene_pool_3 = GenePool(Decimals=0, Maximum=15, Minimum=0, Value=[6, 3, 15])
vector_xyz = VectorXYZ(XComponent=0, YComponent=0, ZComponent=Slider(0.5, range=0..1))  # -> Vector, Length
rotate = Rotate(Geometry=polygon.Polygon, Angle=degrees(Slider(47, range=0..90)), Plane=evaluate_surface.Point)  # -> Geometry, Transform
gene_pool_4 = GenePool(Decimals=0, Maximum=15, Minimum=0, Value=[9, 5.569385144, 3])
extrude = Extrude(Base=boundary_surfaces, Direction=vector_xyz.Vector)
multiplication = Multiplication(A=gene_pool_3, B=number_slider)
boundary_surfaces_2 = BoundarySurfaces(Edges=rotate.Geometry)
vector_xyz_2 = VectorXYZ(XComponent=0, YComponent=0, ZComponent=multiplication)  # -> Vector, Length
multiplication_2 = Multiplication(A=gene_pool_4, B=number_slider)
extrude_2 = Extrude(Base=boundary_surfaces_2, Direction=vector_xyz_2.Vector)
vector_xyz_3 = VectorXYZ(XComponent=0, YComponent=0, ZComponent=multiplication_2)  # -> Vector, Length
move = Move(Geometry=extrude, Motion=vector_xyz_3.Vector)  # -> Geometry, Transform
group = Group(Geometry=extrude_2)
volume = Volume(Geometry=extrude_2)  # -> Volume, Centroid
bounding_box = BoundingBox(Content=group, Plane=PlaneXY(0, 0, 0))  # -> Box, Box_2
mass_addition = MassAddition(Input=volume.Volume)  # -> Result, PartialResults
volume_2 = Volume(Geometry=bounding_box.Box)  # -> Volume, Centroid
division = Division(A=mass_addition.Result, B=volume_2.Volume)
galapagos = Galapagos(fitness=division, gene=[gene_pool_2, gene_pool, gene_pool_3])
