# Grasshopper definition SRC-0061-native-clean.gh (Grasshopper 1.0.8)
# plug-ins: LunchBox

# ---- group: 01 / Inputs + remaining branches
# 01 / Inputs + remaining branches
# Additional stored components and their original connections.
curve = Curve(<curve referenced from the Rhino model>)
curve_2 = Curve([<curve referenced from the Rhino model> x4])
curve_3 = Curve(<curve referenced from the Rhino model>)
curve_4 = Curve(<curve referenced from the Rhino model>)
surface = Surface(curve)
triangle_panels_b = TrianglePanelsB(Surface=surface, UDivisions=10, VDivisions=10)
area = Area(Geometry=triangle_panels_b)  # -> Area, Centroid
larger_than = LargerThan(FirstNumber=area.Area, SecondNumber="20")  # -> LargerThan, OrEqualTo
panel = Panel(larger_than.LargerThan)
cull_pattern = CullPattern(List=triangle_panels_b, CullPattern=larger_than.LargerThan)
curve_5 = Curve(graft(cull_pattern))
triangle_mapping = TriangleMapping(Geometry=curve_2, Source=curve_3, Target=curve_5)  # -> simplify(Geometry), Transform
triangle_mapping_2 = TriangleMapping(Geometry=curve_4, Source=curve_3, Target=curve_5)  # -> simplify(Geometry), Transform
discontinuity = Discontinuity(Curve=triangle_mapping_2.Geometry, Level=1)  # -> Points, Parameters
cir = Circle(Plane=discontinuity.Points, Radius="0.15")  # -> simplify(Circle)
merge = Merge(Data1=triangle_mapping.Geometry, Data2=cir)
boundary_surfaces = BoundarySurfaces(Edges=merge)
custom_preview = CustomPreview(
    Geometry=boundary_surfaces,
    Material={diffuse=RGB(221, 160, 221), emission=RGB(66, 48, 66), shine=0.5, specular=RGB(255, 255, 255), transparency=0})
