# Grasshopper definition SRC-0062-native-clean.gh (Grasshopper 1.0.8)
# plug-ins: OpenNest

# ---- group: 01 / Inputs + remaining branches + linked operations
# 01 / Inputs + remaining branches + linked operations
# Interdependent branches combined and arranged by data flow.
face_boundaries = FaceBoundaries()
curve = Curve(<curve referenced from the Rhino model>)
curve_2 = Curve([<curve referenced from the Rhino model> x2])
disc = Discontinuity(Level=1)  # -> Points, Parameters
mesh = Mesh(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)
curve_3 = Curve(<curve referenced from the Rhino model>)
curve_4 = Curve([<curve referenced from the Rhino model> x5])
curve_5 = Curve(<curve referenced from the Rhino model>)
curve_6 = Curve(<curve referenced from the Rhino model>)
panel = Panel("""l
ll""")
panel_2 = Panel("12")
panel_3 = Panel("100")
opennest = OpenNest(Spacing=1, Placement=1, Tolerance=0.1, Rotations=4, Iterations=1, Seed=1, Reset=True, Run=False)  # -> Sheets, Geo, ID, Transform, IDS
triangle_mapping = TriangleMapping(Geometry=curve_2, Source=curve, Target=face_boundaries)  # -> simplify(Geometry), Transform
pl_origin = PlaneOrigin(Origin=disc.Points)
face_boundaries_2 = FaceBoundaries(Mesh=mesh)  # -> graft(Boundaries)
viewer = ParamViewer(triangle_mapping.Geometry)
cir = Circle(Plane=pl_origin, Radius="0.1")  # -> simplify(Circle)
triangle_mapping_2 = TriangleMapping(Geometry=curve_4, Source=curve_5, Target=face_boundaries_2)  # -> simplify(Geometry), Transform
discontinuity = Discontinuity(Curve=face_boundaries_2, Level=1)  # -> Points, Parameters
triangle_mapping_3 = TriangleMapping(Geometry=curve_6, Source=curve_5, Target=face_boundaries_2)  # -> simplify(Geometry), Transform
merge = Merge(Data1=triangle_mapping.Geometry, Data2=cir)
viewer_2 = ParamViewer(cir)
merge_2 = Merge(Data1=triangle_mapping_2.Geometry)
plane_origin = PlaneOrigin(Base=face_boundaries_2, Origin=discontinuity.Points)
param_viewer = ParamViewer(triangle_mapping_2.Geometry)
discontinuity_2 = Discontinuity(Curve=triangle_mapping_3.Geometry, Level=1)  # -> Points, Parameters
boundary_surfaces = BoundarySurfaces(Edges=merge)
circle = Circle(Plane=plane_origin, Radius="0.1")  # -> simplify(Circle)
list_item = ListItem(List=discontinuity_2.Points, Index="-1", Wrap=True)  # -> flatten(Item)
boundary_surfaces_2 = BoundarySurfaces(Edges=merge_2, UseTasks=False)  # -> flatten(Surfaces)
cull_index = CullIndex(List=discontinuity_2.Points, Indices="-1", Wrap=True)
custom_preview = CustomPreview(
    Geometry=boundary_surfaces,
    Material={diffuse=RGB(221, 160, 221), emission=RGB(66, 48, 66), shine=0.5, specular=RGB(255, 255, 255), transparency=0})
area = Area(Geometry=boundary_surfaces_2)  # -> Area, Centroid
custom_preview_2 = CustomPreview(
    Geometry=boundary_surfaces_2,
    Material={diffuse=RGB(221, 160, 221), emission=RGB(66, 48, 66), shine=0.5, specular=RGB(255, 255, 255), transparency=0})
text = Text(Location=cull_index, Text=panel, Size="0.3")
evaluate_surface = EvaluateSurface(Surface=reparameterize(boundary_surfaces_2), Point="0.5,0.5")  # -> Point, Normal, UDirection, VDirection, Frame
text_2 = Text(Location=cull_index, Text=panel, Size="0.3")
text_3 = Text(Location=cull_index, Text=panel, Size="0.3")
list_length = ListLength(List=area.Centroid)
pack_objects = PackObjects(Geo=boundary_surfaces_2, Plane=evaluate_surface.Frame, X="1", Y="0", Tolerabce=0)  # -> Geo, Transformation
point = Point(area.Centroid)
shift_paths = ShiftPaths(Data=text, Offset=-1)
deconstruct_brep = DeconstructBrep(Brep=pack_objects.Geo)  # -> Faces, Edges, Vertices
series = Series(Start=0, Step=1, Count=list_length)
transform = Transform(Geometry=shift_paths, Transform=graft(pack_objects.Transformation))
text_4 = Text(Location=list_item, Text=series, Size="0.4")
text_5 = Text(Location=list_item, Text=series, Size="0.4")
join_curves = JoinCurves(Curves=deconstruct_brep.Edges, Preserve=False)
text_6 = Text(Location=list_item, Text=series, Size="0.4")
length = Length(Curve=join_curves)
boundary_surfaces_3 = BoundarySurfaces(Edges=join_curves)  # -> flatten(Surfaces)
transform_2 = Transform(Geometry=text_4, Transform=graft(pack_objects.Transformation))
sort_list = SortList(Keys=length, ValuesValuesA=join_curves)  # -> Keys, ValuesValuesA
list_item_2 = ListItem(List=sort_list.ValuesValuesA, Index="-1", Wrap=True)  # -> flatten(Item)
panel_4 = Panel(list_item_2)
geometry = Geometry(list_item_2)
opennest_2 = OpenNest(
    Sheets=curve_3,
    Geo=list_item_2,
    Spacing=1,
    Placement=1,
    Tolerance=0.1,
    Rotations=4,
    Iterations=1,
    Seed=1,
    Reset=True,
    Run=False)  # -> Sheets, Geo, ID, Transform, IDS
transform_3 = Transform(Geometry=pack_objects.Geo, Transform=opennest_2.Transform)
transform_4 = Transform(Geometry=transform_2, Transform=graft(opennest_2.Transform))
transform_5 = Transform(Geometry=transform, Transform=graft(opennest_2.Transform))
curve_7 = Curve(opennest_2.Sheets)
deconstruct_brep_2 = DeconstructBrep(Brep=transform_3)  # -> Faces, Edges, Vertices
curve_8 = Curve(transform_4)
curve_9 = Curve(transform_5)
join_curves_2 = JoinCurves(Curves=deconstruct_brep_2.Edges, Preserve=False)
curve_10 = Curve(join_curves_2)
