# Grasshopper definition SRC-0063-native-clean.gh (Grasshopper 1.0.8)
# plug-ins: OpenNest

# ---- group: 01 / Inputs + remaining branches + linked operations
# 01 / Inputs + remaining branches + linked operations
# Interdependent branches combined and arranged by data flow.
surface = Surface(<surface referenced from the Rhino model>)
xy_plane = XYPlane(Origin=Point(0, 0, 0))
curve = Curve(<curve referenced from the Rhino model>)
curve_2 = Curve(<curve referenced from the Rhino model>)
curve_3 = Curve(<curve referenced from the Rhino model>)
panel = Panel("""l
ll""")
curve_4 = Curve([<curve referenced from the Rhino model> x5])
curve_5 = Curve(<curve referenced from the Rhino model>)
curve_6 = Curve(<curve referenced from the Rhino model>)
number_slider = Slider(0.698, range=0..1)
number_slider_2 = Slider(0.055, range=0..10)
opennest = OpenNest(Spacing=1, Placement=1, Tolerance=0.1, Rotations=4, Iterations=1, Seed=1, Reset=True, Run=False)  # -> Sheets, Geo, ID, Transform, IDS
curve_7 = Curve(<curve referenced from the Rhino model>)
unit_z = UnitZ(Factor="0.2")
unit_z_2 = UnitZ(Factor="0.02")
triremesh = TriRemesh(Geometry=surface, Length="0.04", Iterations=25)  # -> Triangulation, Dual, Creases
panel_2 = Panel(triremesh.Triangulation)
mesh_edges = MeshEdges(Mesh=triremesh.Triangulation)  # -> NakedEdges, InteriorEdges, NonManifoldEdges
show = Show(G=triremesh.Triangulation)
nakedvertices = NakedVertices(Mesh=triremesh.Triangulation)  # -> ClothedIndex, NakedIndex, ClothedPts, NakedPts
deconstruct_mesh = DeconstructMesh(Mesh=triremesh.Triangulation)  # -> Vertices, Faces, Colours, Normals
load = Load(Point=deconstruct_mesh.Vertices, ForceVector=unit_z, Weighting=1)
point_in_curve = PointInCurve(Point=graft(deconstruct_mesh.Vertices), Curve=curve_4)  # -> Relationship, Point
merge = Merge(Data1=mesh_edges.NakedEdges, Data2=mesh_edges.InteriorEdges)
point_in_curve_2 = PointInCurve(Point=graft(deconstruct_mesh.Vertices), Curve=curve_5)  # -> Relationship, Point
point_list = PointList(Points=deconstruct_mesh.Vertices, Size="0.01")
point = Point(nakedvertices.NakedPts)
length_line = LengthLine(Line=merge, Length="0", Strength=10)
mass_addition = MassAddition(Input=point_in_curve.Relationship)  # -> flatten(Result), PartialResults
anchorxyz = AnchorXYZ(Point=point, X="1", Y="1", Z=False, Strength="100")
panel_3 = Panel(merge)
mass_addition_2 = MassAddition(Input=point_in_curve_2.Relationship)  # -> flatten(Result), PartialResults
cull_pattern = CullPattern(List=deconstruct_mesh.Vertices, CullPattern=mass_addition.Result)
cull_pattern_2 = CullPattern(List=deconstruct_mesh.Vertices, CullPattern=mass_addition_2.Result)
anchor = Anchor(Point=cull_pattern, Strength=10000)
move = Move(Geometry=cull_pattern_2, Motion=unit_z_2)  # -> Geometry, Transform
anchor_2 = Anchor(Point=cull_pattern_2, Target=move.Geometry, Strength=10000)
entwine = Entwine(
    Branch00=length_line,
    Branch01=anchor,
    Branch02=load,
    Branch03=anchor_2,
    Branch04=anchorxyz,
    Branch05=show,
    FlattenInputs=True)
bouncysolver = BouncySolver(GoalObjects=entwine, Reset=Button(), Threshold=1e-15, Tolerance=0.0001, Damping=0.99, Iterations="1000", On=Toggle(True))  # -> I, V, O
list_item = ListItem(List=bouncysolver.O, Index="-1", Wrap=True)
custom_preview = CustomPreview(
    Geometry=list_item,
    Material={diffuse=RGB(221, 160, 221), emission=RGB(66, 48, 66), shine=0.5, specular=RGB(255, 255, 255), transparency=0})
mirror = Mirror(Geometry=list_item, Plane=xy_plane)  # -> Geometry, Transform
merge_2 = Merge(Data1=list_item, Data2=mirror.Geometry)
combine_clean = CombineClean(Meshes=merge_2)
mesh = Mesh(combine_clean)
face_boundaries = FaceBoundaries(Mesh=mesh)  # -> graft(Boundaries)
triangle_mapping = TriangleMapping(Geometry=curve, Source=curve_2, Target=face_boundaries)  # -> simplify(Geometry), Transform
explode_tree = ExplodeTree(Data=face_boundaries)  # -> _00000, Branch1
discontinuity = Discontinuity(Curve=face_boundaries, Level=1)  # -> Points, Parameters
triangle_mapping_2 = TriangleMapping(Geometry=curve_3, Source=curve_2, Target=face_boundaries)  # -> simplify(Geometry), Transform
param_viewer = ParamViewer(triangle_mapping.Geometry)
merge_3 = Merge(Data1=triangle_mapping.Geometry)
plane_origin = PlaneOrigin(Base=face_boundaries, Origin=discontinuity.Points)
discontinuity_2 = Discontinuity(Curve=triangle_mapping_2.Geometry, Level=1)  # -> Points, Parameters
param_viewer_2 = ParamViewer(merge_3)
circle = Circle(Plane=plane_origin, Radius="0.0015")  # -> simplify(Circle)
explode_tree_2 = ExplodeTree(Data=merge_3)  # -> _00000, Branch1
cull_index = CullIndex(List=discontinuity_2.Points, Indices="-1", Wrap=True)
list_item_2 = ListItem(List=discontinuity_2.Points, Index="-1", Wrap=True)  # -> flatten(Item)
boundary_surfaces = BoundarySurfaces(Edges=merge_3)  # -> flatten(Surfaces)
param_viewer_3 = ParamViewer(circle)
area = Area(Geometry=boundary_surfaces)  # -> Area, Centroid
text = Text(Location=cull_index, Text=panel, Size="0.003")
text_2 = Text(Location=cull_index, Text=panel, Size="0.003")
text_3 = Text(Location=cull_index, Text=panel, Size="0.003")
evaluate_surface = EvaluateSurface(Surface=flatten(boundary_surfaces), Point="0.5,0.5")  # -> Point, Normal, UDirection, VDirection, Frame
list_length = ListLength(List=area.Centroid)
shift_paths = ShiftPaths(Data=text_2, Offset=-1)
point_2 = Point(area.Centroid)
pack_objects = PackObjects(Geo=flatten(merge_3), Plane=evaluate_surface.Frame, X="0.5", Y="0", Tolerabce=0)  # -> Geo, Transformation
transform = Transform(Geometry=shift_paths, Transform=graft(pack_objects.Transformation))
transform_2 = Transform(Geometry=circle, Transform=graft(pack_objects.Transformation))
join_curves = JoinCurves(Curves=pack_objects.Geo, Preserve=False)
series = Series(Start=0, Step=1, Count=list_length)
deconstruct_brep = DeconstructBrep(Brep=pack_objects.Geo)  # -> Faces, Edges, Vertices
boundary_surfaces_2 = BoundarySurfaces(Edges=join_curves)  # -> flatten(Surfaces)
text_4 = Text(Location=list_item_2, Text=series, Size="0.004")
text_5 = Text(Location=list_item_2, Text=series, Size="0.004")
opennest_2 = OpenNest(
    Sheets=curve_6,
    Geo=join_curves,
    Spacing=1,
    Placement=1,
    Tolerance=0.1,
    Rotations=4,
    Iterations=1,
    Seed=1,
    Reset=True,
    Run=Button())  # -> Sheets, Geo, ID, Transform, IDS; disabled
text_6 = Text(Location=list_item_2, Text=series, Size="0.004")
length = Length(Curve=join_curves)
transform_3 = Transform(Geometry=merge_3, Transform=opennest_2.Transform)
transform_4 = Transform(Geometry=transform, Transform=graft(opennest_2.Transform))
transform_5 = Transform(Geometry=text_4, Transform=graft(pack_objects.Transformation))
curve_8 = Curve(opennest_2.Sheets)
sort_list = SortList(Keys=length, ValuesValuesA=join_curves)  # -> Keys, ValuesValuesA
list_item_3 = ListItem(List=sort_list.ValuesValuesA, Index="-1", Wrap=True)  # -> flatten(Item)
curve_9 = Curve(transform_4)
transform_6 = Transform(Geometry=transform_5, Transform=graft(opennest_2.Transform))
deconstruct_brep_2 = DeconstructBrep(Brep=transform_3)  # -> Faces, Edges, Vertices
join_curves_2 = JoinCurves(Curves=deconstruct_brep_2.Edges, Preserve=False)
panel_4 = Panel(list_item_3)
geometry = Geometry(list_item_3)
curve_10 = Curve(transform_6)
curve_11 = Curve(join_curves_2)
