# Grasshopper definition SRC-0066-native-clean.gh (Grasshopper 1.0.8)
# plug-ins: NGon, LunchBox

# ---- group: 01 / Inputs + remaining branches + linked operations
# 01 / Inputs + remaining branches + linked operations
# Interdependent branches combined and arranged by data flow.
number_slider = Slider(100, range=0..100)
boolean_toggle = BooleanToggle(True)
button = Button()
surface = Surface(<surface referenced from the Rhino model>)
brep = Brep(<brep referenced from the Rhino model>)
brep_2 = Brep(<brep referenced from the Rhino model>)
curve = Curve(<curve referenced from the Rhino model>)
discontinuity = Discontinuity(Curve=surface, Level=1)  # -> Points, Parameters
vector_xyz = VectorXYZ(XComponent=Slider(0, range=0..500), YComponent=Slider(22, range=-500..500), ZComponent=Slider(99, range=0..500))  # -> Vector, Length
mesh_surface = MeshSurface(Surface=surface, UCount=Slider(27, range=0..100), VCount=Slider(27, range=0..100), Overhang=True, Equalize=False)  # disabled
unit_z = UnitZ(Factor=Slider(100, range=0..100))
brep_3 = Brep(surface)
vector_xyz_2 = VectorXYZ(XComponent=Slider(8, range=0..10), YComponent=Slider(28, range=-500..500), ZComponent=Slider(0, range=0..500))  # -> Vector, Length
vector_xyz_3 = VectorXYZ(XComponent=Slider(8, range=0..10), YComponent=Slider(28, range=-500..500), ZComponent=Slider(117, range=0..500))  # -> Vector, Length
vector_xyz_4 = VectorXYZ(XComponent=Slider(0, range=0..10), YComponent=Slider(0, range=-500..500), ZComponent=Slider(102, range=0..500))  # -> Vector, Length
anchor = Anchor(Point=discontinuity.Points, Strength=10000)  # disabled
triremesh = TriRemesh(Geometry=brep_3, Length=Slider(19, range=0..100), Iterations=25)  # -> Triangulation, Dual, Creases
mesh_edges = MeshEdges(Mesh=[mesh_surface, triremesh.Triangulation])  # -> AllE, NakedE
show = Show(G=[mesh_surface, triremesh.Triangulation])
deconstruct_mesh = DeconstructMesh(Mesh=[mesh_surface, triremesh.Triangulation])  # -> Vertices, Faces, Colours, Normals
load = Load(Point=deconstruct_mesh.Vertices, ForceVector=unit_z, Weighting=1)
point_in_brep = PointInBrep(Brep=brep, Point=deconstruct_mesh.Vertices, Strict=False)
point_in_brep_2 = PointInBrep(Brep=brep_2, Point=deconstruct_mesh.Vertices, Strict=False)
point_list = PointList(Points=deconstruct_mesh.Vertices, Size=Slider(1, range=0..1))
random_split_list = RandomSplitList(MasterList=deconstruct_mesh.Vertices, Seed=Slider(557999, range=0..1000000), Split=Slider(0, range=0..1))  # -> ListA, ListB
merge = Merge(Data1=mesh_edges.AllE, Data2=mesh_edges.NakedE)
pull_point = PullPoint(Point=deconstruct_mesh.Vertices, Geometry=curve, ClosestOnly=True)  # -> ClosestPoint, Distance, Index
length_line = LengthLine(Line=merge, Length=Slider(10.361, range=0..40), Strength=Slider(9.117, range=0..40))
smaller_than = SmallerThan(FirstNumber=pull_point.Distance, SecondNumber=Slider(1.3, range=0..10))  # -> SmallerThan, OrEqualTo
dispatch = Dispatch(List=deconstruct_mesh.Vertices, DispatchPattern=point_in_brep)  # -> ListA, ListB
dispatch_2 = Dispatch(List=deconstruct_mesh.Vertices, DispatchPattern=point_in_brep_2)  # -> ListA, ListB
move = Move(Geometry=random_split_list.ListB, Motion=vector_xyz_3.Vector)  # -> Geometry, Transform
random_split_list_2 = RandomSplitList(MasterList=dispatch.ListB, Seed=Slider(496000, range=0..1000000), Split=Slider(0, range=0..1))  # -> ListA, ListB
anchor_2 = Anchor(Point=random_split_list.ListB, Target=move.Geometry, Strength=10000)
move_2 = Move(Geometry=dispatch.ListA, Motion=vector_xyz.Vector)  # -> Geometry, Transform; disabled
cull_pattern = CullPattern(List=deconstruct_mesh.Vertices, CullPattern=smaller_than.SmallerThan)
move_3 = Move(Geometry=dispatch_2.ListA, Motion=vector_xyz_2.Vector)  # -> Geometry, Transform
anchor_3 = Anchor(Point=random_split_list_2.ListB, Strength=10000)
anchor_4 = Anchor(Point=dispatch.ListA, Target=move_2.Geometry, Strength=10000)
anchor_5 = Anchor(Point=dispatch_2.ListA, Target=move_3.Geometry, Strength=10000)
move_4 = Move(Geometry=cull_pattern, Motion=vector_xyz_4.Vector)  # -> Geometry, Transform
anchor_6 = Anchor(Point=cull_pattern, Target=move_4.Geometry, Strength=10000)
entwine = Entwine(
    Branch00=length_line,
    Branch01=anchor_3,
    Branch02=load,
    Branch03=anchor_4,
    Branch04=anchor_5,
    Branch05=anchor_2,
    Branch06=anchor,
    Branch07=anchor_6,
    Branch08=show,
    FlattenInputs=True)
bouncysolver = BouncySolver(
    GoalObjects=entwine,
    Reset=button,
    Threshold=1e-15,
    Tolerance=0.0001,
    Damping=0.99,
    Iterations=number_slider,
    On=boolean_toggle)  # -> I, V, O
solver = Solver(GoalObjects=entwine, Reset=button, Threshold=1e-15, Tolerance=0.0001, On=boolean_toggle)  # -> I, V, O; disabled
list_item = ListItem(List=[bouncysolver.O, solver.O], Index="-1", Wrap=True)
panel = Panel([bouncysolver.O, solver.O])
x_2 = X2(G=list_item, T0=Slider(0.637, range=0..1), T1=Slider(0.649, range=0..1), D=0, N=1, S=1)  # -> out, A; inputs G: GeometryBase, I: list, T0: list, T1: list, D: list, N: list, S: list, clr: list of Color
# ---------- x_2: VB ----------
    Component.Params.Input(0).Name = "Mesh or Curve"
    Component.Params.Input(0).Description = "Open or closed mesh or curve"
    Component.Params.Input(1).Name = "Index [Face]"
    Component.Params.Input(1).Description = "An optional integer or list of integers which specify the faces to be modified if the input is a mesh. If no value is supplied then all faces will be modified"
    Component.Params.Input(2).Name = "Along Edge"
    Component.Params.Input(2).Description = "Evaluates a new vertex along the input geometry's edge"
    Component.Params.Input(3).Name = "Edge to Face"
    Component.Params.Input(3).Description = "Evaluates a new vertex between the input geometry's edge midpoint to the face center"
    Component.Params.Input(4).Name = "Distance"
    Component.Params.Input(4).Description = "Sets the depth for the center point offset of each face"
    Component.Params.Input(5).Name = "Normalize"
    Component.Params.Input(5).Description = "If true averages the vertex values per face, if false each new vertices parameters are associated to its origin vertex"
    Component.Params.Input(6).Name = "Stellate"
    Component.Params.Input(6).Description = "A unitized per vertex number which shifts the offset vector from vertex = 0 to face = 1 normal"
    Component.Params.Input(7).Name = "Close"
    Component.Params.Input(7).Description = "If true then additional faces and if needed vertices will be added to the mesh, covering the complete areas of the existing mesh"
    Component.Params.Input(8).Name = "Color [Vertex]"
    Component.Params.Input(8).Description = "(If applied to a mesh a list of colors corresponding to each mesh face, if applied to a curve, a list of colors corresponding to each control point plus an additonal color value for the new averaged center"

    Component.Params.Output(1).Name = "Mesh"
    Component.Params.Output(1).Description = "If successful, a valid mesh"

    If G IsNot Nothing Then

      Dim bM, bP,bmC,biC As Boolean

      bM = g.ObjectType = ObjectType.Mesh
      bP = g.ObjectType = ObjectType.Curve

      If (bM Or bP) Then
        Dim msh As New mesh
        Dim crv As curve
        Dim av As point3d
        Dim ac As color
        Dim h,j,jj,k,u,v,w As Integer
        Dim cv,cf,ce As Integer
        Dim x(),y() As Integer

        Dim mv,fv,ep,eop,tv As New list(Of Point3d)
        Dim mev As New dictionary(Of String, Integer)
        Dim mf As Rhino.Geometry.Collections.MeshFaceList = Nothing
        Dim mtv As Rhino.Geometry.Collections.MeshTopologyVertexList = Nothing
        Dim mte As Rhino.Geometry.Collections.MeshTopologyEdgeList = Nothing
        Dim mn As Rhino.Geometry.Collections.MeshVertexNormalList = Nothing
        Dim mfn As Rhino.Geometry.Collections.MeshFaceNormalList = Nothing
        Dim ev As New list(Of vector3d)
        Dim ed,en As New list(Of Double)
        Dim mc,ec,eoc,tc,cc,fc As New list(Of color)
        Dim xf As New list(Of meshface)

        If clr.count() = 0 Then clr.add(color.LightGray) Else biC = True

        If bm Then
          'Start Deconstruct if Mesh
          msh = g

          If msh.Normals.Count() = 0 Then msh.Normals.ComputeNormals()
          If msh.FaceNormals.Count() = 0 Then msh.FaceNormals.ComputeFaceNormals()

          If i.count() = 0 Then I = Enumerable.Range(0, msh.Faces.Count()).ToList()

          mv = msh.Vertices().ToPoint3dArray().tolist()
          mte = msh.TopologyEdges()
          mtv = msh.TopologyVertices()
          mf = msh.Faces()

          mn = msh.Normals()
          mn.UnitizeNormals()
          mfn = msh.FaceNormals()
          mfn.UnitizeFaceNormals()

          cf = I.Count() - 1
          ce = mte.count() - 1

          'Assign Colors
          If msh.VertexColors.Count() < 1 Then
            msh.VertexColors.CreateMonotoneMesh(color.LightGray)
            bmC = biC
          Else
            bmC = True
          End If
          'Assign fake edges
          mc = msh.VertexColors().ToArray().ToList()
        Else
          'Start Deconstruct if Curve
          crv = g

          I.clear()
          I.add(0)
          Dim nc As nurbscurve
          Dim pc As polyline
          Dim nps As Rhino.Geometry.Collections.NurbsCurvePointList

          nc = crv.ToNurbsCurve()
          nps = nc.Points
          pc = nc.Points.ControlPolygon
          If (Not pc.IsClosed) Then pc.add(pc(0))
          av = pc.CenterPoint

          msh.Vertices.AddVertices(pc.ToArray())
          msh.faces.addfaces(pc.TriangulateClosedPolyline())
          msh.Vertices.Remove(pc.count() - 1, True)
          msh.FaceNormals.ComputeFaceNormals()
          msh.Normals.ComputeNormals()
          msh.Normals.UnitizeNormals()

          mv = msh.Vertices.ToPoint3dArray().tolist()
          mte = msh.TopologyEdges()
          mtv = msh.TopologyVertices()
          mn = msh.Normals()
          mfn = msh.FaceNormals()

          mfn(0) = avgVec(mn.toarray())

          'Assign Colors
          If bic Then bmC = True
          mc = clr
          If (clr.count() - 1) < (mv.count() - 1) Then mc = matchClr(mc, mv.count() - 1)

          ac = avgClr(mc.toarray())
          cf = 0
        End If
        cv = mv.count() - 1
        ce = mte.count() - 1

        x = appendprepend(cv)
        'Match variables and colors to vertex count
        If (T0.count() - 1) < cv Then T0 = matchDbl(T0, cv)
        If (T1.count() - 1) < cv Then T1 = matchDbl(T1, cv)
        If (D.count() - 1) < cv Then D = matchDbl(D, cv)
        If (N.count() - 1) < cv Then N = matchDbl(N, cv)
        If (S.count() - 1) < cv Then S = matchDbl(S, cv)
        If (clr.count() - 1) < cv Then clr = matchClr(clr, cv)
        If biC Then fc = clr Else fc = mc

        'Edge based vertices
        k = 0
        For j = 0 To mte.count() - 1 Step 1
          If (bm Or (bp And (mte.GetConnectedFaces(j).Count() < 2))) Then
            u = mtv.MeshVertexIndices(mte.GetTopologyVertices(j).I)(0)
            v = mtv.MeshVertexIndices(mte.GetTopologyVertices(j).J)(0)

            eop.add(evalP(mv(u), mv(v), T0(u) / 2))
            eoc.add(evalC(mc(u), mc(v), T0(u) / 2))
            mev.add(u & "," & v & "," & 0, w)

            ep.add(evalP(mv(u), mv(v), 0.5))
            ev.add(evalV(mn(u), mn(v), 0.5))
            ed.add(evalN(d(u), d(v), 0.5))
            en.add(evalN(N(u), N(v), 0.5))
            ec.add(evalC(mc(u), mc(v), 0.5))
            mev.add(u & "," & v & "," & 1, k)
            mev.add(v & "," & u & "," & 1, k)

            eop.add(evalP(mv(v), mv(u), T0(v) / 2))
            eoc.add(evalC(mc(v), mc(u), T0(v) / 2))
            mev.add(v & "," & u & "," & 0, w + 1)
            k += 1
            w += 2
          End If
        Next

        'Face based vertices
        Dim xv(),mt(),ei() As Integer
        Dim xc() As color
        Dim xd,xn As Double
        Dim txv(0) As vector3d
        ReDim ei(2)
        u = 1
        v = eop.count() + mv.count() + cf + 1

        For jj = 0 To I.count() - 1 Step 1
          Dim tcv As New point3d
          j = I(jj)
          w = v + tv.count()
          xd = 0
          xn = 0
          If bm Then
            If mf(j).isquad() Then h = 4 Else h = 3
            ReDim xv(h - 1)
            ReDim xc(h - 1)
            mt = mf.GetTopologicalVertices(j)
            For k = 0 To h - 1 Step 1
              xv(k) = mtv.MeshVertexIndices(mt(k))(0)
              xc(k) = fc(xv(k))
            Next
            av = mf.GetFaceCenter(j)
            ac = avgClr(xc)
          Else
            h = mv.count()
            xv = Enumerable.Range(0, h).ToArray()
          End If
          For k = 0 To h - 1 Step 1
            xd += D(xv(k))
            xn += T1(xv(k))
          Next
          xd /= h
          xn /= h
          mfn(j) *= xd
          y = appendprepend(h - 1)

          For k = 1 To h Step 1
            ei(0) = mev.item(xv(y(k)) & "," & xv(y(k + 1)) & "," & 0)
            ei(1) = mev.item(xv(y(k + 1)) & "," & xv(y(k)) & "," & 0)
            ei(2) = mev.item(xv(y(k)) & "," & xv(y(k + 1)) & "," & 1)

            txv(0) = ev(ei(2)) * evalN(eD(ei(2)) * (t1(xv(y(k))) + t1(xv(y(k + 1)))) / 2, xd * xn, eN(ei(2)))

            'Define new per face vertices
            tv.add(evalP(ep(ei(2)) + txv(0), evalP(ep(ei(2)), av + evalV(txv(0), mfn(j), (t1(xv(y(k))) + t1(xv(y(k + 1)))) / 2), (t1(xv(y(k))) + t1(xv(y(k + 1)))) / 2), S(xv(y(k)))))
            tc.add(evalC(ec(ei(2)), ac, (t1(xv(y(k))) + t1(xv(y(k + 1)))) / 2))

            tcv += tv.item(tv.count() - 1)
            'Define new faces
            xf.add(New meshface(v + jj - cf - 1, eop.count() + xv(y(k)), ei(0), w + y(k) * u))
            xf.add(New meshface(eop.count() + xv(y(k + 1)), v + jj - cf - 1, w + y(k) * u, ei(1)))

            If c Then xf.add(New meshface(ei(1), w + y(k) * u, ei(0)))
          Next
          tcv /= h
          fv.add(tcv)
          cc.add(ac)
        Next

        Dim om As New mesh
        om.Vertices.AddVertices(eop.toarray())
        If bmC Then om.VertexColors.AppendColors(eoc.toarray())

        om.Vertices.AddVertices(mv)
        If bmC Then om.VertexColors.AppendColors(mc.toarray())

        om.Vertices.AddVertices(fv)
        If bmC Then om.VertexColors.AppendColors(cc.toarray())

        om.Vertices.AddVertices(tv.toarray())
        If bmC Then om.VertexColors.AppendColors(tc.toarray())

        om.Faces.AddFaces(xf.toarray())

        If i.count() > 1 Then om.Vertices.CullUnused()

        A = om
      End If
    End If
# ---------- x_2: VB additional code ----------
  Private Function appendprepend(ByVal i As Integer)
    Dim srsEnum As IEnumerable(Of Integer) = Enumerable.Range(0, i + 1)
    Dim arrVal As New list(Of Integer)
    arrVal = srsEnum.tolist()
    arrVal.add(0)
    arrVal.insert(0, i)
    Return arrVal.toarray()
  End Function

  Private Function matchDbl(ByVal a As list(Of Double), ByVal t As Integer)
    Dim i,k As Integer
    k = a.count()
    For i = 0 To ((t + 1) - k) - 1 Step 1
      a.add(a.item(k - 1))
    Next
    Return a
  End Function

  Private Function matchClr(ByVal a As list(Of Color), ByVal t As Integer)
    Dim i,k As Integer
    k = a.count()
    For i = 0 To ((t + 1) - k) - 1 Step 1
      a.add(a.item(k - 1))
    Next
    Return a
  End Function

  Private Function evalP(ByVal op As point3d, ByVal tp As Point3d, ByVal t As Double)
    Return New point3d(op + (tp - op) * t)
  End Function

  Private Function evalV(ByVal ov As vector3d, ByVal tv As vector3d, ByVal t As Double)
    Return New vector3d(ov + (tv - ov) * t)
  End Function

  Private Function evalN(ByVal u As Double, ByVal v As Double, ByVal t As Double)
    Return u + (v - u) * t
  End Function

  Private Function avgVec(ByVal v() As vector3f)
    Dim i As Integer
    Dim tv As Vector3d

    For i = 0 To ubound(v) Step 1
      tv += v(i)
    Next
    tv /= (ubound(v) + 1)
    tv.Unitize()
    Return New vector3f(tv.X, tv.Y, tv.Z)
  End Function

  Private Function roundClr(ByVal r As Integer, ByVal g As Integer, ByVal b As Integer, ByVal i As Integer)
    r = CInt(r / i)
    g = CInt(g / i)
    b = CInt(b / i)

    If r > 255 Then r = 255 Else If r < 0 Then r = 0
    If g > 255 Then g = 255 Else If g < 0 Then g = 0
    If b > 255 Then b = 255 Else If b < 0 Then b = 0

    Return color.FromArgb(r, g, b)
  End Function

  Private Function avgClr(ByVal c() As color)
    Dim r,g,b As Integer
    Dim i,k As Integer

    k = ubound(c) + 1

    For i = 0 To k - 1 Step 1
      r += CInt(c(i).R)
      g += CInt(c(i).G)
      b += CInt(c(i).B)
    Next

    r = CInt(r / k)
    g = CInt(g / k)
    b = CInt(b / k)

    If r > 255 Then r = 255 Else If r < 0 Then r = 0
    If g > 255 Then g = 255 Else If g < 0 Then g = 0
    If b > 255 Then b = 255 Else If b < 0 Then b = 0

    Return color.FromArgb(r, g, b)
  End Function

  Private Function evalC(ByVal oc As color, ByVal tc As color, ByVal t As Double)
    Dim r,g,b As Integer
    r = CInt(CInt(oc.R) + (CInt(tc.R) - CInt(oc.R)) * t)
    g = CInt(CInt(oc.G) + (CInt(tc.G) - CInt(oc.G)) * t)
    b = CInt(CInt(oc.B) + (CInt(tc.B) - CInt(oc.B)) * t)

    If r > 255 Then r = 255 Else If r < 0 Then r = 0
    If g > 255 Then g = 255 Else If g < 0 Then g = 0
    If b > 255 Then b = 255 Else If b < 0 Then b = 0

    Return color.FromArgb(r, g, b)
  End Function

  ''' <summary>
  ''' This method will be called once every solution, before any calls to RunScript.
  ''' </summary>
  Public Overrides Sub BeforeRunScript()
  End Sub
  ''' <summary>
  ''' This method will be called once every solution, after any calls to RunScript.
  ''' </summary>
  Public Overrides Sub AfterRunScript()
  End Sub
# ---------- end x_2 ----------
custom_preview = CustomPreview(
    Geometry=x_2.A,
    Material={diffuse=RGB(221, 160, 221), emission=RGB(66, 48, 66), shine=0.5, specular=RGB(255, 255, 255), transparency=0})
