# Grasshopper definition SRC-0067-native-clean.gh (Grasshopper 1.0.8)

# ---- group: 01 / Inputs + remaining branches
# 01 / Inputs + remaining branches
# Additional stored components and their original connections.
panel = Panel("1")
button = Button()
surface = Surface(<surface referenced from the Rhino model>)
panel_2 = Panel("""22
11""")
number_slider = Slider(10000, range=0..10000)
number_slider_2 = Slider(0, range=0..100)
number_slider_3 = Slider(10000, range=0..10000)
curve = Curve(surface)
integer = Integer("22")
triremesh = TriRemesh(Geometry=surface, Length=Slider(2, range=0..10), Iterations=25)  # -> Triangulation, Dual, Creases
unit_z = UnitZ(Factor=Slider(2, range=0..10))
edgelengths = EdgeLengths(Mesh=triremesh.Triangulation, LengthFactor=Slider(0.924, range=0..2), Strength=Slider(6, range=0..100))
show = Show(G=triremesh.Triangulation)
nakedvertices = NakedVertices(Mesh=triremesh.Triangulation)  # -> ClothedIndex, NakedIndex, ClothedPts, NakedPts
point = Point(nakedvertices.NakedPts)
plasticanchor = PlasticAnchor(Point=nakedvertices.ClothedPts, Limit="1", Strength="10", Reset=button)
sort_along_curve = SortAlongCurve(Points=point, Curve=curve)  # -> Points, Indices
point_list = PointList(Points=sort_along_curve.Points, Size=panel)
partition_list = PartitionList(List=sort_along_curve.Points, Size=panel_2)
param_viewer = ParamViewer(partition_list)
tree_statistics = TreeStatistics(Tree=partition_list)  # -> Paths, Length, Count
equality = Equality(FirstNumber=tree_statistics.Length, SecondNumber=integer)  # -> Equality, Inequality
dispatch = Dispatch(List=tree_statistics.Paths, DispatchPattern=equality.Equality)  # -> ListA, ListB
tree_branch = TreeBranch(Tree=partition_list, Path=dispatch.ListB, MaintainPaths=True)
tree_branch_2 = TreeBranch(Tree=partition_list, Path=dispatch.ListA, MaintainPaths=True)
anchorxyz = AnchorXYZ(Point=tree_branch_2, X=number_slider_2, Y=number_slider_2, Z=False, Strength=Slider(104, range=0..1000))  # disabled
anchor = Anchor(Point=tree_branch, Strength=10000)
polyline = PolyLine(Vertices=tree_branch_2, Closed=False)
list_item = ListItem(List=tree_branch_2, Index="11", Wrap=True)
end_points = EndPoints(Curve=polyline)  # -> Start, End
rod = Rod(
    Polyline=polyline,
    LengthFactor=Slider(1.7, range=0..10),
    AngleFactor=Slider(0, range=0..100),
    AxialStrength=number_slider,
    BendStrength=number_slider)
load = Load(Point=list_item, ForceVector=unit_z, Weighting=Slider(17, range=0..1000))
anchor_2 = Anchor(Point=[end_points.Start, end_points.End], Strength=10000)
entwine = Entwine(
    Branch00=edgelengths,
    Branch01=anchor_2,
    Branch02=rod,
    Branch04=load,
    Branch05=anchor,
    Branch06=plasticanchor,
    Branch07=show,
    Branch08=anchorxyz,
    FlattenInputs=True)
solver = Solver(GoalObjects=entwine, Reset=button, Threshold=1e-15, Tolerance=0.0001, On=Toggle(True))  # -> I, V, O
tree_branch_3 = TreeBranch(Tree=solver.O, Path="0;7", MaintainPaths=True)
custom_preview = CustomPreview(
    Geometry=tree_branch_3,
    Material={diffuse=RGB(221, 160, 221), emission=RGB(66, 48, 66), shine=0.5, specular=RGB(255, 255, 255), transparency=0})
