# Grasshopper definition SRC-0068-native-clean.gh (Grasshopper 1.0.8)
# plug-ins: Anemone

# ---- group: 01 / Inputs + remaining branches + linked operations
# 01 / Inputs + remaining branches + linked operations
# Interdependent branches combined and arranged by data flow.
brep = Brep(<brep referenced from the Rhino model>)
loop_start = LoopStart(Repeat=Slider(2, range=0..3), Trigger=Button(), Data=brep)  # -> port, Counter, Data
deconstruct_brep = DeconstructBrep(Brep=loop_start.Data)  # -> Faces, Edges, Vertices
scale = Scale(Geometry=loop_start.Data, Center=deconstruct_brep.Vertices, Factor="0.5")  # -> graft(Geometry), Transform
loop_end = LoopEnd(port=loop_start.port, Exit=False, Data=scale.Geometry, TimeOutVal=0, pausedState=False, state="Constant output")
custom_preview = CustomPreview(
    Geometry=loop_end,
    Material={diffuse=RGB(221, 160, 221), emission=RGB(66, 48, 66), shine=0.5, specular=RGB(255, 255, 255), transparency=0})
