# Grasshopper definition SRC-0070-native-clean.gh (Grasshopper 1.0.8)

# ---- group: 01 / Inputs + remaining branches + linked operations
# 01 / Inputs + remaining branches + linked operations
# Interdependent branches combined and arranged by data flow.
surface = Surface(<surface referenced from the Rhino model>)
xy_plane = XYPlane(Origin=Point(0, 0, 0))
curve = Curve([<curve referenced from the Rhino model> x5])
curve_2 = Curve(<curve referenced from the Rhino model>)
number_slider = Slider(0.698, range=0..1)
number_slider_2 = Slider(0.055, range=0..10)
mesh = Mesh(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)
unit_z = UnitZ(Factor="0.2")
unit_z_2 = UnitZ(Factor="0.02")
triremesh = TriRemesh(Geometry=surface, Length="0.04", Iterations=25)  # -> Triangulation, Dual, Creases
panel = Panel(triremesh.Triangulation)
mesh_edges = MeshEdges(Mesh=triremesh.Triangulation)  # -> NakedEdges, InteriorEdges, NonManifoldEdges
show = Show(G=triremesh.Triangulation)
nakedvertices = NakedVertices(Mesh=triremesh.Triangulation)  # -> ClothedIndex, NakedIndex, ClothedPts, NakedPts
deconstruct_mesh = DeconstructMesh(Mesh=triremesh.Triangulation)  # -> Vertices, Faces, Colours, Normals
load = Load(Point=deconstruct_mesh.Vertices, ForceVector=unit_z, Weighting=1)
point_in_curve = PointInCurve(Point=graft(deconstruct_mesh.Vertices), Curve=curve)  # -> Relationship, Point
merge = Merge(Data1=mesh_edges.NakedEdges, Data2=mesh_edges.InteriorEdges)
point_in_curve_2 = PointInCurve(Point=graft(deconstruct_mesh.Vertices), Curve=curve_2)  # -> Relationship, Point
point_list = PointList(Points=deconstruct_mesh.Vertices, Size="0.01")
point = Point(nakedvertices.NakedPts)
length_line = LengthLine(Line=merge, Length="0", Strength=10)
mass_addition = MassAddition(Input=point_in_curve.Relationship)  # -> flatten(Result), PartialResults
anchorxyz = AnchorXYZ(Point=point, X="1", Y="1", Z=False, Strength="100")
panel_2 = Panel(merge)
mass_addition_2 = MassAddition(Input=point_in_curve_2.Relationship)  # -> flatten(Result), PartialResults
cull_pattern = CullPattern(List=deconstruct_mesh.Vertices, CullPattern=mass_addition.Result)
cull_pattern_2 = CullPattern(List=deconstruct_mesh.Vertices, CullPattern=mass_addition_2.Result)
anchor = Anchor(Point=cull_pattern, Strength=10000)
move = Move(Geometry=cull_pattern_2, Motion=unit_z_2)  # -> Geometry, Transform
anchor_2 = Anchor(Point=cull_pattern_2, Target=move.Geometry, Strength=10000)
entwine = Entwine(
    Branch00=length_line,
    Branch01=anchor,
    Branch02=load,
    Branch03=anchor_2,
    Branch04=anchorxyz,
    Branch05=show,
    FlattenInputs=True)
bouncysolver = BouncySolver(GoalObjects=entwine, Reset=Button(), Threshold=1e-15, Tolerance=0.0001, Damping=0.99, Iterations="10", On=Toggle(True))  # -> I, V, O
list_item = ListItem(List=bouncysolver.O, Index="-1", Wrap=True)
custom_preview = CustomPreview(
    Geometry=list_item,
    Material={diffuse=RGB(221, 160, 221), emission=RGB(66, 48, 66), shine=0.5, specular=RGB(255, 255, 255), transparency=0})
mirror = Mirror(Geometry=list_item, Plane=xy_plane)  # -> Geometry, Transform
merge_2 = Merge(Data1=list_item, Data2=mirror.Geometry)
combine_clean = CombineClean(Meshes=merge_2)
