# Grasshopper definition SRC-0071-native-clean.gh (Grasshopper 1.0.8)
# plug-ins: NGon

# ---- group: 01 / Inputs + remaining branches
# 01 / Inputs + remaining branches
# Additional stored components and their original connections.
number_slider = Slider(8, range=0..10)
brep = Brep(<brep referenced from the Rhino model>)
point = Point(<point referenced from the Rhino model>)
button = Button()
gene_pool = GenePool(Decimals=2, Maximum=100, Minimum=0, Value=[4.13, 0, 0, 0, 0])
populate_geometry = PopulateGeometry(Geometry=brep, Count=Slider(4, range=0..10), Seed=Slider(701923, range=0..1000000))
unit_z = UnitZ(Factor=Slider(4, range=0..100))
sphere = Sphere(Base=populate_geometry, Radius=number_slider)
vector_2pt = Vector2Pt(PointA=point, PointB=populate_geometry, Unitize=False)  # -> Vector, Length
brep_brep = BrepBrep(BrepA=brep, BrepB=sphere)  # -> graft(Curves), Points
trim_solid = TrimSolid(Shape=brep, Cutters=sphere)
amplitude = Amplitude(Vector=vector_2pt.Vector, Amplitude=gene_pool)
triremesh = TriRemesh(Geometry=trim_solid, Iterations=25)  # -> Triangulation, Dual, Creases
edgelengths = EdgeLengths(Mesh=triremesh.Triangulation, LengthFactor=Slider(0, range=0..10), Strength=Slider(10, range=0..10))
show = Show(G=triremesh.Triangulation)
deconstruct_mesh = DeconstructMesh(Mesh=triremesh.Triangulation)  # -> Vertices, Faces, Colours, Normals
nakedvertices = NakedVertices(Mesh=triremesh.Triangulation)  # -> ClothedIndex, NakedIndex, ClothedPts, NakedPts
mesh_edges = MeshEdges(Mesh=triremesh.Triangulation)  # -> AllE, NakedE
pull_point = PullPoint(Point=deconstruct_mesh.Vertices, Geometry=brep_brep.Curves, ClosestOnly=True)  # -> ClosestPoint, Distance, Index
plasticanchor = PlasticAnchor(Point=nakedvertices.ClothedPts, Limit="1", Strength="10", Reset=button)
load = Load(Point=deconstruct_mesh.Vertices, ForceVector=unit_z, Weighting=1)
smaller_than = SmallerThan(FirstNumber=pull_point.Distance, SecondNumber=Slider(0.123, range=0..1))  # -> SmallerThan, OrEqualTo
cull_pattern = CullPattern(List=deconstruct_mesh.Vertices, CullPattern=smaller_than.SmallerThan)
move = Move(Geometry=cull_pattern, Motion=graft(amplitude))  # -> Geometry, Transform
set_difference = SetDifference(SetA=nakedvertices.NakedPts, SetB=flatten(cull_pattern))
anchor = Anchor(Point=cull_pattern, Target=move.Geometry, Strength=10000)
anchor_2 = Anchor(Point=set_difference, Strength=10000)
entwine = Entwine(
    Branch00=edgelengths,
    Branch01=anchor,
    Branch02=plasticanchor,
    Branch03=anchor_2,
    Branch04=show,
    Branch05=load,
    FlattenInputs=True)
solver = Solver(GoalObjects=entwine, Reset=button, Threshold=1e-15, Tolerance=0.0001, On=Toggle(True))  # -> I, V, O
tree_branch = TreeBranch(Tree=solver.O, Path="0;4", MaintainPaths=True)
pinwheel_2 = Pinwheel2(G=tree_branch, T0=Slider(0.8, range=0..1), O=True, F=False)  # -> out, A; inputs G: GeometryBase, I: list, T0: list, clr: list of Color
# ---------- pinwheel_2: VB ----------
    Component.Params.Input(0).Name = "Mesh or Curve"
    Component.Params.Input(0).Description = "Open or closed mesh or curve"
    Component.Params.Input(1).Name = "Index [Face]"
    Component.Params.Input(1).Description = "An optional integer or list of integers which specify the faces to be modified if the input is a mesh. If no value is supplied then all faces will be modified"
    Component.Params.Input(2).Name = "Along Edge"
    Component.Params.Input(2).Description = "Evaluates a new vertex along the input geometry's edge"
    Component.Params.Input(3).Name = "Close"
    Component.Params.Input(3).Description = "If true then additional faces and if needed vertices will be added to the mesh, covering the complete areas of the existing mesh"
    Component.Params.Input(4).Name = "Optimize"
    Component.Params.Input(4).Description = "If true, when faces are quad or tri based, a single face will be used about the face center, if false or per face vertex count is greater than 4 then a new offset vertex is added"
    Component.Params.Input(5).Name = "Flip"
    Component.Params.Input(5).Description = "If true, flips quad orientation"
    Component.Params.Input(6).Name = "Color [Vertex]"
    Component.Params.Input(6).Description = "(If applied to a mesh a list of colors corresponding to each mesh face, if applied to a curve, a list of colors corresponding to each control point plus an additonal color value for the new averaged center"

    Component.Params.Output(1).Name = "Mesh"
    Component.Params.Output(1).Description = "If successful, a valid mesh"

    If G IsNot Nothing Then

      Dim bM, bP,bmC,biC As Boolean

      bM = g.ObjectType = ObjectType.Mesh
      bP = g.ObjectType = ObjectType.Curve

      If (bM Or bP) Then
        Dim msh As New mesh
        Dim crv As curve
        Dim av As point3d
        Dim ac As color
        Dim h,j,jj,k,u,v,w As Integer
        Dim cv,cf,ce As Integer
        Dim x(),y() As Integer

        Dim mv,fv,ep,tv As New list(Of Point3d)
        Dim mev As New dictionary(Of String, Integer)
        Dim mf As Rhino.Geometry.Collections.MeshFaceList = Nothing
        Dim mtv As Rhino.Geometry.Collections.MeshTopologyVertexList = Nothing
        Dim mte As Rhino.Geometry.Collections.MeshTopologyEdgeList = Nothing
        Dim ev As New list(Of vector3d)
        Dim ed,en As New list(Of Double)
        Dim mc,ec,tc,cc,fc As New list(Of color)
        Dim xf As New list(Of meshface)

        If clr.count() = 0 Then clr.add(color.LightGray) Else biC = True

        If bm Then
          'Start Deconstruct if Mesh
          msh = g

          If msh.Normals.Count() = 0 Then msh.Normals.ComputeNormals()
          If msh.FaceNormals.Count() = 0 Then msh.FaceNormals.ComputeFaceNormals()

          If i.count() = 0 Then I = Enumerable.Range(0, msh.Faces.Count()).ToList()

          mv = msh.Vertices().ToPoint3dArray().tolist()
          mte = msh.TopologyEdges()
          mtv = msh.TopologyVertices()
          mf = msh.Faces()

          cf = I.Count() - 1
          ce = mte.count() - 1

          'Assign Colors
          If msh.VertexColors.Count() < 1 Then
            msh.VertexColors.CreateMonotoneMesh(color.LightGray)
            bmC = biC
          Else
            bmC = True
          End If
          'Assign fake edges
          mc = msh.VertexColors().ToArray().ToList()
        Else
          'Start Deconstruct if Curve
          crv = g

          I.clear()
          I.add(0)
          Dim nc As nurbscurve
          Dim pc As polyline
          Dim nps As Rhino.Geometry.Collections.NurbsCurvePointList

          nc = crv.ToNurbsCurve()
          nps = nc.Points
          pc = nc.Points.ControlPolygon
          If (Not pc.IsClosed) Then pc.add(pc(0))
          av = pc.CenterPoint

          msh.Vertices.AddVertices(pc.ToArray())
          msh.faces.addfaces(pc.TriangulateClosedPolyline())
          msh.Vertices.Remove(pc.count() - 1, True)
          msh.FaceNormals.ComputeFaceNormals()

          mv = msh.Vertices.ToPoint3dArray().tolist()
          mte = msh.TopologyEdges()
          mtv = msh.TopologyVertices()

          'Assign Colors
          If bic Then bmC = True
          mc = clr
          If (clr.count() - 1) < (mv.count() - 1) Then mc = matchClr(mc, mv.count() - 1)

          ac = avgClr(mc.toarray())
          If (mv.count() - 1) > 3 Then o = False
          cf = 0
        End If
        cv = mv.count() - 1
        ce = mte.count() - 1

        x = appendprepend(cv)
        'Match variables and colors to vertex count
        If (T0.count() - 1) < cv Then T0 = matchDbl(T0, cv)
        If (clr.count() - 1) < cv Then clr = matchClr(clr, cv)
        If biC Then fc = clr Else fc = mc

        'Edge based vertices
        k = 0
        For j = 0 To mte.count() - 1 Step 1
          If (bm Or (bp And (mte.GetConnectedFaces(j).Count() < 2))) Then
            u = mtv.MeshVertexIndices(mte.GetTopologyVertices(j).I)(0)
            v = mtv.MeshVertexIndices(mte.GetTopologyVertices(j).J)(0)

            ep.add(evalP(mv(u), mv(v), T0(u) / 2))
            ec.add(evalC(mc(u), mc(v), T0(u) / 2))
            mev.add(u & "," & v & "," & 0, k)

            ep.add(evalP(mv(v), mv(u), T0(v) / 2))
            ec.add(evalC(mc(v), mc(u), T0(v) / 2))
            mev.add(v & "," & u & "," & 0, k + 1)
            k += 2
          End If
        Next

        'Face based vertices
        Dim xv(),mt(),ei() As Integer
        Dim xc() As color
        Dim xn As Double
        ReDim ei(3)
        u = 1
        v = ep.count()
        If c Then v += mv.count()
        If (Not o) Then v += cf + 1

        For jj = 0 To I.count() - 1 Step 1
          Dim tcv As New point3d
          j = I(jj)
          w = v + tv.count()
          xn = 0
          If bm Then
            If mf(j).isquad() Then h = 4 Else h = 3
            ReDim xv(h - 1)
            ReDim xc(h - 1)
            mt = mf.GetTopologicalVertices(j)
            For k = 0 To h - 1 Step 1
              xv(k) = mtv.MeshVertexIndices(mt(k))(0)
              xc(k) = fc(xv(k))
            Next
            av = mf.GetFaceCenter(j)
            ac = avgClr(xc)
          Else
            h = mv.count()
            xv = Enumerable.Range(0, h).ToArray()
          End If
          y = appendprepend(h - 1)
          Dim tev As New list(Of Integer)

          For k = 1 To h Step 1
            ei(0) = mev.item(xv(y(k)) & "," & xv(y(k + 1)) & "," & 0)
            ei(1) = mev.item(xv(y(k + 1)) & "," & xv(y(k)) & "," & 0)
            ei(2) = mev.item(xv(y(k)) & "," & xv(y(k - 1)) & "," & 0)
            ei(3) = mev.item(xv(y(k - 1)) & "," & xv(y(k)) & "," & 0)

            If f Then
              tev.add(ei(0))
              xf.add(New meshface(ei(2), ei(3), ei(0)))
              If (Not o) Then xf.add(New meshface(ei(3), ei(0), v + jj - cf - 1))
            Else
              tev.add(ei(1))
              xf.add(New meshface(ei(2), ei(0), ei(1)))
              If (Not o) Then xf.add(New meshface(ei(2), ei(1), v + jj - cf - 1))
            End If
            'Define new faces


            If c Then xf.add(New meshface(ei(2), ep.count() + xv(y(k)), ei(0)))
          Next
          If o Then
            If h = 4 Then
              xf.add(New meshface(tev.item(0), tev.item(1), tev.item(2), tev.item(3)))
            Else
              xf.add(New meshface(tev.item(0), tev.item(1), tev.item(2)))
            End If
          Else
            fv.add(av)
            cc.add(ac)
          End If
        Next

        Dim om As New mesh
        om.Vertices.AddVertices(ep.toarray())
        If bmC Then om.VertexColors.AppendColors(ec.toarray())

        If c Then
          om.Vertices.AddVertices(mv)
          If bmC Then om.VertexColors.AppendColors(mc.toarray())
        End If

        If (Not o) Then
          om.Vertices.AddVertices(fv)
          If bmC Then om.VertexColors.AppendColors(cc.toarray())
        End If


        om.Faces.AddFaces(xf.toarray())

        If i.count() > 1 Then om.Vertices.CullUnused()

        A = om
      End If
    End If
# ---------- pinwheel_2: VB additional code ----------
  Private Function appendprepend(ByVal i As Integer)
    Dim srsEnum As IEnumerable(Of Integer) = Enumerable.Range(0, i + 1)
    Dim arrVal As New list(Of Integer)
    arrVal = srsEnum.tolist()
    arrVal.add(0)
    arrVal.insert(0, i)
    Return arrVal.toarray()
  End Function

  Private Function matchDbl(ByVal a As list(Of Double), ByVal t As Integer)
    Dim i,k As Integer
    k = a.count()
    For i = 0 To ((t + 1) - k) - 1 Step 1
      a.add(a.item(k - 1))
    Next
    Return a
  End Function

  Private Function matchClr(ByVal a As list(Of Color), ByVal t As Integer)
    Dim i,k As Integer
    k = a.count()
    For i = 0 To ((t + 1) - k) - 1 Step 1
      a.add(a.item(k - 1))
    Next
    Return a
  End Function

  Private Function evalP(ByVal op As point3d, ByVal tp As Point3d, ByVal t As Double)
    Return New point3d(op + (tp - op) * t)
  End Function

  Private Function evalV(ByVal ov As vector3d, ByVal tv As vector3d, ByVal t As Double)
    Return New vector3d(ov + (tv - ov) * t)
  End Function

  Private Function evalN(ByVal u As Double, ByVal v As Double, ByVal t As Double)
    Return u + (v - u) * t
  End Function

  Private Function avgVec(ByVal v() As vector3f)
    Dim i As Integer
    Dim tv As Vector3d

    For i = 0 To ubound(v) Step 1
      tv += v(i)
    Next
    tv /= (ubound(v) + 1)
    tv.Unitize()
    Return New vector3f(tv.X, tv.Y, tv.Z)
  End Function

  Private Function roundClr(ByVal r As Integer, ByVal g As Integer, ByVal b As Integer, ByVal i As Integer)
    r = CInt(r / i)
    g = CInt(g / i)
    b = CInt(b / i)

    If r > 255 Then r = 255 Else If r < 0 Then r = 0
    If g > 255 Then g = 255 Else If g < 0 Then g = 0
    If b > 255 Then b = 255 Else If b < 0 Then b = 0

    Return color.FromArgb(r, g, b)
  End Function

  Private Function avgClr(ByVal c() As color)
    Dim r,g,b As Integer
    Dim i,k As Integer

    k = ubound(c) + 1

    For i = 0 To k - 1 Step 1
      r += CInt(c(i).R)
      g += CInt(c(i).G)
      b += CInt(c(i).B)
    Next

    r = CInt(r / k)
    g = CInt(g / k)
    b = CInt(b / k)

    If r > 255 Then r = 255 Else If r < 0 Then r = 0
    If g > 255 Then g = 255 Else If g < 0 Then g = 0
    If b > 255 Then b = 255 Else If b < 0 Then b = 0

    Return color.FromArgb(r, g, b)
  End Function

  Private Function evalC(ByVal oc As color, ByVal tc As color, ByVal t As Double)
    Dim r,g,b As Integer
    r = CInt(CInt(oc.R) + (CInt(tc.R) - CInt(oc.R)) * t)
    g = CInt(CInt(oc.G) + (CInt(tc.G) - CInt(oc.G)) * t)
    b = CInt(CInt(oc.B) + (CInt(tc.B) - CInt(oc.B)) * t)

    If r > 255 Then r = 255 Else If r < 0 Then r = 0
    If g > 255 Then g = 255 Else If g < 0 Then g = 0
    If b > 255 Then b = 255 Else If b < 0 Then b = 0

    Return color.FromArgb(r, g, b)
  End Function
# ---------- end pinwheel_2 ----------
