# Grasshopper definition SRC-0072-native-clean.gh (Grasshopper 1.0.8)

# ---- group: 01 / Inputs + remaining branches
# 01 / Inputs + remaining branches
# Additional stored components and their original connections.
number_slider = Slider(4, range=0..10)
curve = Curve(<curve referenced from the Rhino model>)
panel = Panel("""0
0
1""")
polygon_center = PolygonCenter(Polyline=curve)  # -> CenterV, CenterE, CenterA
explode = Explode(Curve=curve, Recursive=True)  # -> graft(Segments), Vertices
discontinuity = Discontinuity(Curve=curve, Level=1)  # -> graft(Points), Parameters
dispatch = Dispatch(DispatchPattern=panel)  # -> ListA, ListB
circle_cnr = CircleCNR(Center=discontinuity.Points, Normal=Vector(0, 0, 1), Radius=Slider(6, range=0..10))  # -> graft(Circle)
list_item = ListItem(List=explode.Segments, Index=0, Wrap=True)
list_item_2 = ListItem(List=discontinuity.Points, Index=Slider(4, range=0..10), Wrap=True)
point_list = PointList(Points=discontinuity.Points, Size="20")
panel_2 = Panel(dispatch.ListA)
param_viewer = ParamViewer(dispatch.ListA)
list_item_3 = ListItem(List=circle_cnr, Index=0, Wrap=True)
curve_curve = CurveCurve(CurveA=list_item, CurveB=list_item_3)  # -> Points, ParamsA, ParamsB
list_item_4 = ListItem(List=curve_curve.Points, Index=number_slider, Wrap=True)
line = Line(StartPoint=list_item_2, EndPoint=list_item_4)
line_2 = Line(StartPoint=polygon_center.CenterV, EndPoint=list_item_4)
merge = Merge(Data1=line, Data2=line_2)  # -> flatten(Result)
curve_2 = Curve(merge)
