# Grasshopper definition SRC-0073-native-clean.gh (Grasshopper 1.0.8)

# ---- group: 01 / Triangle input
# 01 / Triangle input
# Retained triangle geometry and control values.
curve = Curve(<curve referenced from the Rhino model>)
number_slider = Slider(7.593, range=1..11)
panel = Panel("""0
1""")
polygon_center = PolygonCenter(Polyline=curve)  # -> CenterV, CenterE, CenterA
discontinuity = Discontinuity(Curve=curve, Level=1)  # -> Points, Parameters

# ---- group: 02 / Point + curve construction
# 02 / Point + curve construction
# Intersections, duplicate-point removal and line construction.
explode = Explode(Curve=curve, Recursive=True)  # -> flatten(Segments), Vertices
circle_cnr = CircleCNR(Center=polygon_center.CenterV, Normal=Vector(0, 0, 1), Radius=number_slider)  # -> graft(Circle)
removeduplicatepts = RemoveDuplicatePts(Points=polygon_center.CenterV, Tolerance=0.01)
removeduplicatepts_2 = RemoveDuplicatePts(Points=discontinuity.Points, Tolerance=0.01)
number_slider_2 = Slider(1.578, range=0..5)
curve_curve = CurveCurve(CurveA=explode.Segments, CurveB=circle_cnr)  # -> Points, ParamsA, ParamsB
circle_cnr_2 = CircleCNR(Center=removeduplicatepts, Normal=Vector(0, 0, 1), Radius=number_slider)  # -> graft(Circle)
circle_cnr_3 = CircleCNR(Center=removeduplicatepts_2, Normal=Vector(0, 0, 1), Radius=Slider(7, range=0..10))  # -> graft(Circle)
dispatch = Dispatch(List=curve_curve.Points, DispatchPattern=panel)  # -> flatten(ListA), ListB
removeduplicatepts_3 = RemoveDuplicatePts(Points=dispatch.ListA, Tolerance=0.01)
point_in_curve = PointInCurve(Point=removeduplicatepts_3, Curve=circle_cnr_2)  # -> Relationship, Point
point_in_curve_2 = PointInCurve(Point=removeduplicatepts_3, Curve=circle_cnr_3)  # -> Relationship, Point
circle_cnr_4 = CircleCNR(Center=[removeduplicatepts_3, removeduplicatepts_2], Normal=Vector(0, 0, 1), Radius=number_slider_2)  # -> flatten(Circle)
cull_pattern = CullPattern(List=removeduplicatepts_3, CullPattern=point_in_curve.Relationship)
cull_pattern_2 = CullPattern(List=removeduplicatepts_3, CullPattern=point_in_curve_2.Relationship)
line = Line(StartPoint=cull_pattern, EndPoint=graft(removeduplicatepts))
line_2 = Line(StartPoint=cull_pattern_2, EndPoint=graft(removeduplicatepts_2))
merge = Merge(Data1=line_2, Data2=line)  # -> graft(Result)

# ---- group: 03 / Offset + edge construction
# 03 / Offset + edge construction
# The retained cluster, offsets, loft and edge operations.
cluster = Cluster(
    set_a=removeduplicatepts_3,
    set_a_2=removeduplicatepts_3,
    point=removeduplicatepts_2,
    point_2=removeduplicatepts_2,
    point_3=removeduplicatepts_2,
    geometry=removeduplicatepts_3,
    start_point=removeduplicatepts_2,
    end_point_2=removeduplicatepts_2,
    end_point=removeduplicatepts_2)  # disabled
offset_curve = OffsetCurve(Curve=merge, Distance=number_slider_2, Corners=1)  # -> graft(Curve)
offset_curve_2 = OffsetCurve(Curve=merge, Distance=expr("-x", number_slider_2), Corners=1)  # -> graft(Curve)
number_slider_3 = Slider(1.392, range=0..10)
loft = Loft(
    Curves=[offset_curve, offset_curve_2],
    Options={Adjust=False, Closed=False, LoftEnds=0, LoftSimp=0, LoftType=0, Rebuild=10, Refit=0.01})
brep_edges = BrepEdges(Brep=loft)  # -> Naked, Interior, NonManifold
join_curves = JoinCurves(Curves=[brep_edges.Naked, circle_cnr_4], Preserve=False)

# ---- group: 04 / Profile + openings
# 04 / Profile + openings
# Union, fillet, opening subtraction and final surfaces.
region_union = RegionUnion(Curves=flatten(join_curves))
circle_cnr_5 = CircleCNR(Center=[removeduplicatepts_3, removeduplicatepts_2], Normal=Vector(0, 0, 1), Radius=1)  # -> flatten(Circle); disabled
number_slider_4 = Slider(0.841, range=0..1)
fillet = Fillet(Curve=region_union, Radius=number_slider_3)
boundary_surfaces = BoundarySurfaces(Edges=fillet)
region_difference = RegionDifference(CurvesA=fillet, CurvesB=circle_cnr_5)  # disabled

# ==== cluster Cluster
point = ClusterInput()
geometry = ClusterInput()
start_point = ClusterInput()
pull_point = PullPoint(Point=point, Geometry=geometry, ClosestOnly=True)  # -> ClosestPoint, Distance, Index
line = Line(StartPoint=start_point, EndPoint=pull_point.ClosestPoint)
set_a = ClusterInput()
set_difference = SetDifference(SetA=set_a, SetB=pull_point.ClosestPoint)
point_2 = ClusterInput()
end_point = ClusterInput()
pull_point_2 = PullPoint(Point=point_2, Geometry=set_difference, ClosestOnly=True)  # -> ClosestPoint, Distance, Index
line_2 = Line(StartPoint=pull_point_2.ClosestPoint, EndPoint=end_point)
set_a_2 = ClusterInput()
set_difference_2 = SetDifference(SetA=set_a_2, SetB=pull_point_2.ClosestPoint)
point_3 = ClusterInput()
end_point_2 = ClusterInput()
pull_point_3 = PullPoint(Point=point_3, Geometry=set_difference_2, ClosestOnly=True)  # -> ClosestPoint, Distance, Index
line_3 = Line(StartPoint=pull_point_3.ClosestPoint, EndPoint=end_point_2)
