# Grasshopper definition SRC-0074-native-clean.gh (Grasshopper 1.0.8)

# ---- group: 01 / Inputs + remaining branches
# 01 / Inputs + remaining branches
# Additional stored components and their original connections.
curve = Curve(<curve referenced from the Rhino model>)
number_slider = Slider(2, range=0..10)
number_slider_2 = Slider(0.1, range=0..1)
curve_2 = Curve()
curve_3 = Curve()
unit_z = UnitZ(Factor=Slider(3.3, range=0..10))
unit_z_2 = UnitZ(Factor=Slider(3, range=0..5))
populate_2d = Populate2D(Region=curve, Count=Slider(138, range=0..1000), Seed=Slider(426, range=0..1000))
move = Move(Geometry=populate_2d, Motion=unit_z)  # -> Geometry, Transform
voronoi = Voronoi(Points=populate_2d, Boundary=curve, BruteForceOverride=False)
extrude_point = ExtrudePoint(Point=move.Geometry)
fillet = Fillet(Curve=voronoi, Radius=number_slider)  # -> graft(Curve)
scale = Scale(Geometry=voronoi, Center=populate_2d, Factor=Slider(0.5, range=0..10))  # -> Geometry, Transform
scale_2 = Scale(Geometry=voronoi, Center=populate_2d, Factor=Slider(0.3, range=0..10))  # -> Geometry, Transform
custom_preview = CustomPreview(
    Geometry=extrude_point,
    Material={diffuse=RGB(221, 160, 221), emission=RGB(66, 48, 66), shine=0.5, specular=RGB(255, 255, 255), transparency=0})
move_2 = Move(Geometry=scale.Geometry, Motion=unit_z_2)  # -> Geometry, Transform
fillet_2 = Fillet(Curve=scale_2.Geometry, Radius=number_slider)  # -> graft(Curve)
fillet_3 = Fillet(Curve=move_2.Geometry, Radius=number_slider)  # -> graft(Curve)
merge = Merge(Data1=fillet, Data2=fillet_3, Data3=fillet_2)
loft = Loft(Curves=merge, Options={Adjust=False, Closed=False, LoftEnds=0, LoftSimp=0, LoftType=0, Rebuild=10, Refit=0.01})
custom_preview_2 = CustomPreview(
    Geometry=loft,
    Material={diffuse=RGB(221, 160, 221), emission=RGB(66, 48, 66), shine=0.5, specular=RGB(255, 255, 255), transparency=0})
