# Grasshopper definition SRC-0080-native-clean.gh (Grasshopper 1.0.8)
# plug-ins: Anemone

# ---- group: 01 / Inputs + remaining branches + linked operations
# 01 / Inputs + remaining branches + linked operations
# Interdependent branches combined and arranged by data flow.
point = Point(<point referenced from the Rhino model>)
polygon = Polygon(Plane=point, Radius="1", Segments="3", FilletRadius=0)  # -> Polygon, Length
unit_z = UnitZ(Factor="0.25")
loop_start = LoopStart(Repeat=Slider(2, range=0..6), Trigger=Button(), Data=polygon.Polygon)  # -> port, Counter, Data
discontinuity = Discontinuity(Curve=loop_start.Data, Level=1)  # -> Points, Parameters
scale = Scale(Geometry=loop_start.Data, Center=discontinuity.Points, Factor="0.5")  # -> graft(Geometry), Transform
loop_end = LoopEnd(port=loop_start.port, Exit=False, Data=scale.Geometry, TimeOutVal=0, pausedState=False, state="Constant output")
surface = Surface(loop_end)
extrude = Extrude(Base=surface, Direction=unit_z)
custom_preview = CustomPreview(Geometry=surface, Material="black")
