# Grasshopper definition SRC-0119-native-clean.gh (Grasshopper 1.0.8)
# plug-ins: OpenNest, LunchBox

# ---- group: 01 / Inputs + remaining branches
# 01 / Inputs + remaining branches
# Additional stored components and their original connections.
curve = Curve(<curve referenced from the Rhino model>)
curve_2 = Curve([<curve referenced from the Rhino model> x4])
curve_3 = Curve(<curve referenced from the Rhino model>)
curve_4 = Curve(<curve referenced from the Rhino model>)
curve_5 = Curve(<curve referenced from the Rhino model>)
surface = Surface(curve)
triangle_panels_b = TrianglePanelsB(Surface=surface, UDivisions=10, VDivisions=10)
area = Area(Geometry=triangle_panels_b)  # -> Area, Centroid
larger_than = LargerThan(FirstNumber=area.Area, SecondNumber="20")  # -> LargerThan, OrEqualTo
panel = Panel(larger_than.LargerThan)
cull_pattern = CullPattern(List=triangle_panels_b, CullPattern=larger_than.LargerThan)
curve_6 = Curve(graft(cull_pattern))
triangle_mapping = TriangleMapping(Geometry=curve_2, Source=curve_4, Target=curve_6)  # -> simplify(Geometry), Transform
triangle_mapping_2 = TriangleMapping(Geometry=curve_5, Source=curve_4, Target=curve_6)  # -> simplify(Geometry), Transform
discontinuity = Discontinuity(Curve=triangle_mapping_2.Geometry, Level=1)  # -> Points, Parameters
cir = Circle(Plane=discontinuity.Points, Radius="0.15")  # -> simplify(Circle)
merge = Merge(Data1=triangle_mapping.Geometry, Data2=cir)
boundary_surfaces = BoundarySurfaces(Edges=merge)  # -> flatten(Surfaces)
custom_preview = CustomPreview(
    Geometry=boundary_surfaces,
    Material={diffuse=RGB(221, 160, 221), emission=RGB(66, 48, 66), shine=0.5, specular=RGB(255, 255, 255), transparency=0})
evaluate_surface = EvaluateSurface(Surface=reparameterize(boundary_surfaces), Point="0.5,0.5")  # -> Point, Normal, UDirection, VDirection, Frame
pack_objects = PackObjects(Geo=boundary_surfaces, Plane=evaluate_surface.Frame, X="1", Y="0", Tolerabce=0)  # -> Geo, Transformation
deconstruct_brep = DeconstructBrep(Brep=pack_objects.Geo)  # -> Faces, Edges, Vertices
join_curves = JoinCurves(Curves=deconstruct_brep.Edges, Preserve=False)
boundary_surfaces_2 = BoundarySurfaces(Edges=join_curves)  # -> flatten(Surfaces)
length = Length(Curve=join_curves)
sort_list = SortList(Keys=length, ValuesValuesA=join_curves)  # -> Keys, ValuesValuesA
list_item = ListItem(List=sort_list.ValuesValuesA, Index="-1", Wrap=True)  # -> flatten(Item)
opennest = OpenNest(
    Sheets=curve_3,
    Geo=list_item,
    Spacing=1,
    Placement=1,
    Tolerance=0.1,
    Rotations=4,
    Iterations=1,
    Seed=1,
    Reset=True,
    Run=False)  # -> Sheets, Geo, ID, Transform, IDS
transform = Transform(Geometry=pack_objects.Geo, Transform=opennest.Transform)
