# Grasshopper definition SRC-0126-native-clean.gh (Grasshopper 1.0.8)
# plug-ins: OpenNest, LunchBox

# ---- group: 01 / Inputs + remaining branches + linked operations
# 01 / Inputs + remaining branches + linked operations
# Interdependent branches combined and arranged by data flow.
curve = Curve(<curve referenced from the Rhino model>)
curve_2 = Curve([<curve referenced from the Rhino model> x12])
curve_3 = Curve(<curve referenced from the Rhino model>)
curve_4 = Curve(<curve referenced from the Rhino model>)
curve_5 = Curve(<curve referenced from the Rhino model>)
panel = Panel("""l
ll""")
curve_6 = Curve(<curve referenced from the Rhino model>)
surface = Surface(curve)
triangle_panels_b = TrianglePanelsB(Surface=surface, UDivisions=10, VDivisions=10)
area = Area(Geometry=triangle_panels_b)  # -> Area, Centroid
larger_than = LargerThan(FirstNumber=area.Area, SecondNumber="20")  # -> LargerThan, OrEqualTo
panel_2 = Panel(larger_than.LargerThan)
cull_pattern = CullPattern(List=triangle_panels_b, CullPattern=larger_than.LargerThan)
curve_7 = Curve(graft(cull_pattern))
triangle_mapping = TriangleMapping(Geometry=curve_2, Source=curve_4, Target=curve_7)  # -> simplify(Geometry), Transform
triangle_mapping_2 = TriangleMapping(Geometry=curve_5, Source=curve_4, Target=curve_7)  # -> simplify(Geometry), Transform
triangle_mapping_3 = TriangleMapping(Geometry=curve_6, Source=curve_4, Target=curve_7)  # -> simplify(Geometry), Transform
discontinuity = Discontinuity(Curve=triangle_mapping_2.Geometry, Level=1)  # -> Points, Parameters
discontinuity_2 = Discontinuity(Curve=triangle_mapping_3.Geometry, Level=1)  # -> Points, Parameters
circle = Circle(Plane=discontinuity.Points, Radius="0.15")  # -> simplify(Circle)
cull_index = CullIndex(List=discontinuity_2.Points, Indices="-1", Wrap=True)
merge = Merge(Data1=triangle_mapping.Geometry, Data2=circle)
text = Text(Location=cull_index, Text=panel, Size="0.3")  # -> simplify(Curves)
boundary_surfaces = BoundarySurfaces(Edges=merge)  # -> flatten(Surfaces)
shift_paths = ShiftPaths(Data=text, Offset=-1)
custom_preview = CustomPreview(
    Geometry=boundary_surfaces,
    Material={diffuse=RGB(221, 160, 221), emission=RGB(66, 48, 66), shine=0.5, specular=RGB(255, 255, 255), transparency=0})
area_2 = Area(Geometry=boundary_surfaces)  # -> Area, Centroid
evaluate_surface = EvaluateSurface(Surface=reparameterize(boundary_surfaces), Point="0.5,0.5")  # -> Point, Normal, UDirection, VDirection, Frame
pack_objects = PackObjects(Geo=boundary_surfaces, Plane=evaluate_surface.Frame, X="1", Y="0", Tolerabce=0)  # -> Geo, Transformation
list_length = ListLength(List=area_2.Centroid)
deconstruct_brep = DeconstructBrep(Brep=pack_objects.Geo)  # -> Faces, Edges, Vertices
series = Series(Start=0, Step=1, Count=list_length)
transform = Transform(Geometry=shift_paths, Transform=graft(pack_objects.Transformation))
join_curves = JoinCurves(Curves=deconstruct_brep.Edges, Preserve=False)
text_2 = Text(Location=area_2.Centroid, Text=series, Size=1)
boundary_surfaces_2 = BoundarySurfaces(Edges=join_curves)  # -> flatten(Surfaces)
length = Length(Curve=join_curves)
transform_2 = Transform(Geometry=text_2, Transform=graft(pack_objects.Transformation))
sort_list = SortList(Keys=length, ValuesValuesA=join_curves)  # -> Keys, ValuesValuesA
list_item = ListItem(List=sort_list.ValuesValuesA, Index="-1", Wrap=True)  # -> flatten(Item)
opennest = OpenNest(
    Sheets=curve_3,
    Geo=list_item,
    Spacing=1,
    Placement=1,
    Tolerance=0.1,
    Rotations=4,
    Iterations=1,
    Seed=1,
    Reset=True,
    Run=False)  # -> Sheets, Geo, ID, Transform, IDS
transform_3 = Transform(Geometry=pack_objects.Geo, Transform=opennest.Transform)
transform_4 = Transform(Geometry=transform_2, Transform=graft(opennest.Transform))
curve_8 = Curve(opennest.Sheets)
transform_5 = Transform(Geometry=transform, Transform=graft(opennest.Transform))
deconstruct_brep_2 = DeconstructBrep(Brep=transform_3)  # -> Faces, Edges, Vertices
curve_9 = Curve(transform_4)
curve_10 = Curve(transform_5)
join_curves_2 = JoinCurves(Curves=deconstruct_brep_2.Edges, Preserve=False)
curve_11 = Curve(join_curves_2)
