# Grasshopper definition SRC-0140-native-clean.gh (Grasshopper 1.0.8)
# plug-ins: LunchBox

# ---- group: 01 / Inputs + remaining branches + linked operations
# 01 / Inputs + remaining branches + linked operations
# Interdependent branches combined and arranged by data flow.
curve = Curve(<curve referenced from the Rhino model>)
face_boundaries = FaceBoundaries()  # -> graft(Boundaries)
curve_2 = Curve([<curve referenced from the Rhino model> x4])
curve_3 = Curve(<curve referenced from the Rhino model>)
triangle_mapping = TriangleMapping(Geometry=curve_2, Source=curve, Target=face_boundaries)  # -> Geometry, Transform
surface = Surface(curve_3)
boundary_surfaces = BoundarySurfaces(Edges=triangle_mapping.Geometry)
triangle_panels_b = TrianglePanelsB(Surface=surface, UDivisions=Slider(17, range=0..20), VDivisions=Slider(13, range=0..20))
custom_preview = CustomPreview(
    Geometry=boundary_surfaces,
    Material={diffuse=RGB(221, 160, 221), emission=RGB(66, 48, 66), shine=0.5, specular=RGB(255, 255, 255), transparency=0})
