# Grasshopper definition SRC-0143-native-clean.gh (Grasshopper 1.0.8)

# ---- group: 01 / Inputs + remaining branches + linked operations
# 01 / Inputs + remaining branches + linked operations
# Interdependent branches combined and arranged by data flow.
surface = Surface(<surface referenced from the Rhino model>)
curve = Curve(<curve referenced from the Rhino model>)
curve_2 = Curve(<curve referenced from the Rhino model>)
curve_3 = Curve(<curve referenced from the Rhino model>)
curve_4 = Curve([<curve referenced from the Rhino model> x4])
crv = Curve(graft([<curve referenced from the Rhino model> x2]))
triremesh = TriRemesh(Geometry=surface, Length=Slider(5, range=0..10), Iterations=25)  # -> Triangulation, Dual, Creases
triangle_mapping = TriangleMapping(Geometry=curve_4, Source=curve_3, Target=crv)  # -> simplify(Geometry), Transform
face_boundaries = FaceBoundaries(Mesh=triremesh.Triangulation)  # -> graft(Boundaries)
triangle_mapping_2 = TriangleMapping(Geometry=curve_2, Source=curve, Target=face_boundaries)  # -> simplify(Geometry), Transform
disc = Discontinuity(Curve=face_boundaries, Level=1)  # -> Points, Parameters
pl_origin = PlaneOrigin(Base=face_boundaries, Origin=disc.Points)
viewer = ParamViewer(triangle_mapping_2.Geometry)
cir = Circle(Plane=pl_origin, Radius="0.1")  # -> simplify(Circle)
viewer_2 = ParamViewer(cir)
merge = Merge(Data1=triangle_mapping_2.Geometry, Data2=cir)
boundary_surfaces = BoundarySurfaces(Edges=merge)
custom_preview = CustomPreview(
    Geometry=boundary_surfaces,
    Material={diffuse=RGB(221, 160, 221), emission=RGB(66, 48, 66), shine=0.5, specular=RGB(255, 255, 255), transparency=0})
