# Grasshopper definition SRC-0144-native-clean.gh (Grasshopper 1.0.8)
# plug-ins: LunchBox

# ---- group: 01 / Inputs + remaining branches
# 01 / Inputs + remaining branches
# Additional stored components and their original connections.
panel = Panel("0.1")
curve = Curve(<curve referenced from the Rhino model>)
curve_2 = Curve([<curve referenced from the Rhino model> x4])
crv = Curve(graft([<curve referenced from the Rhino model> x2]))
panel_2 = Panel("""1
0""")
curve_3 = Curve(<curve referenced from the Rhino model>)
curve_4 = Curve(<curve referenced from the Rhino model>)
curve_5 = Curve(<curve referenced from the Rhino model>)
curve_6 = Curve(<curve referenced from the Rhino model>)
curve_7 = Curve(<curve referenced from the Rhino model>)
surface = Surface()
curve_8 = Curve([<curve referenced from the Rhino model> x11])
triangle_mapping = TriangleMapping(Geometry=curve_2, Source=curve, Target=crv)  # -> simplify(Geometry), Transform
surface_2 = Surface(curve_3)
triangle_panels_b = TrianglePanelsB(Surface=surface_2, UDivisions=10, VDivisions=10)
area = Area(Geometry=triangle_panels_b)  # -> Area, Centroid
larger_than = LargerThan(FirstNumber=area.Area, SecondNumber=Slider(30, range=0..100))  # -> LargerThan, OrEqualTo
cull_pattern = CullPattern(List=triangle_panels_b, CullPattern=larger_than.LargerThan)
curve_9 = Curve(cull_pattern)
dispatch = Dispatch(List=curve_9, DispatchPattern=panel_2)  # -> ListA, ListB
curve_10 = Curve(dispatch.ListA)
curve_11 = Curve(dispatch.ListB)
triangle_mapping_2 = TriangleMapping(Geometry=curve_5, Source=curve_4, Target=curve_10)  # -> simplify(Geometry), Transform
disc = Discontinuity(Curve=curve_10, Level=1)  # -> Points, Parameters
disc_2 = Discontinuity(Curve=curve_11, Level=1)  # -> Points, Parameters
triangle_mapping_3 = TriangleMapping(Geometry=curve_7, Source=curve_6, Target=curve_11)  # -> simplify(Geometry), Transform
pl_origin = PlaneOrigin(Base=curve_10, Origin=disc.Points)
viewer = ParamViewer(triangle_mapping_2.Geometry)
pl_origin_2 = PlaneOrigin(Base=curve_11, Origin=disc_2.Points)
viewer_2 = ParamViewer(triangle_mapping_3.Geometry)
cir = Circle(Plane=pl_origin, Radius=panel)  # -> simplify(Circle)
cir_2 = Circle(Plane=pl_origin_2, Radius="0.1")  # -> simplify(Circle)
viewer_3 = ParamViewer(cir)
merge = Merge(Data1=triangle_mapping_2.Geometry, Data2=cir)
merge_2 = Merge(Data1=triangle_mapping_3.Geometry, Data2=cir_2)
viewer_4 = ParamViewer(cir_2)
boundary_surfaces = BoundarySurfaces(Edges=merge)
boundary_surfaces_2 = BoundarySurfaces(Edges=merge_2)
custom_preview = CustomPreview(
    Geometry=[boundary_surfaces_2, boundary_surfaces],
    Material={diffuse=RGB(221, 160, 221), emission=RGB(66, 48, 66), shine=0.5, specular=RGB(255, 255, 255), transparency=0})
merge_3 = Merge(Data1=boundary_surfaces, Data2=boundary_surfaces_2)

# ---- group: 02 / TriRemesh / Face Boundaries
# 02 / TriRemesh / Face Boundaries
# Related components retained from the original grouping.
surface_3 = Surface()
triremesh = TriRemesh(Geometry=surface_3, Iterations=25)  # -> Triangulation, Dual, Creases
face_boundaries = FaceBoundaries(Mesh=triremesh.Triangulation)  # -> graft(Boundaries)

# ---- group: 03 / TriRemesh / Face Boundaries
# 03 / TriRemesh / Face Boundaries
# Related components retained from the original grouping.
surface_4 = Surface()
triremesh_2 = TriRemesh(Geometry=surface_4, Iterations=25)  # -> Triangulation, Dual, Creases
face_boundaries_2 = FaceBoundaries(Mesh=triremesh_2.Triangulation)  # -> graft(Boundaries)
