# Grasshopper definition SRC-0069-native-straight.gh (Grasshopper 1.0.8)
# plug-ins: OpenNest, LunchBox

# ---- group: 04 / Triangle mapping
# 04 / Triangle mapping
# Map the retained module curves to the triangular field.
mesh = Mesh(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)
curve = Curve(<curve referenced from the Rhino model>)
curve_2 = Curve([<curve referenced from the Rhino model> x12])
curve_3 = Curve(<curve referenced from the Rhino model>)
curve_4 = Curve(<curve referenced from the Rhino model>)
surface = Surface(curve)
triangle_panels_b = TrianglePanelsB(Surface=surface, UDivisions=10, VDivisions=10)
area = Area(Geometry=triangle_panels_b)  # -> Area, Centroid
larger_than = LargerThan(FirstNumber=area.Area, SecondNumber="20")  # -> LargerThan, OrEqualTo
panel = Panel(larger_than.LargerThan)
cull_pattern = CullPattern(List=triangle_panels_b, CullPattern=larger_than.LargerThan)
curve_5 = Curve(graft(cull_pattern))
triangle_mapping = TriangleMapping(Geometry=curve_2, Source=curve_3, Target=curve_5)  # -> simplify(Geometry), Transform
triangle_mapping_2 = TriangleMapping(Geometry=curve_4, Source=curve_3, Target=curve_5)  # -> simplify(Geometry), Transform
discontinuity = Discontinuity(Curve=triangle_mapping_2.Geometry, Level=1)  # -> Points, Parameters
circle = Circle(Plane=discontinuity.Points, Radius="0.15")  # -> simplify(Circle)
merge = Merge(Data1=triangle_mapping.Geometry, Data2=circle)
boundary_surfaces = BoundarySurfaces(Edges=merge)  # -> flatten(Surfaces)
custom_preview = CustomPreview(
    Geometry=boundary_surfaces,
    Material={diffuse=RGB(221, 160, 221), emission=RGB(66, 48, 66), shine=0.5, specular=RGB(255, 255, 255), transparency=0})

# ---- group: 05 / Labelling + nesting
# 05 / Labelling + nesting
# Retain part labels and send contours to sheet packing.
panel_2 = Panel("0.5,0.5")
curve_6 = Curve(<curve referenced from the Rhino model>)
area_2 = Area(Geometry=boundary_surfaces)  # -> Area, Centroid
curve_7 = Curve(<curve referenced from the Rhino model>)
panel_3 = Panel("""l
ll""")
evaluate_surface = EvaluateSurface(Surface=reparameterize(boundary_surfaces), Point=panel_2)  # -> Point, Normal, UDirection, VDirection, Frame
list_length = ListLength(List=area_2.Centroid)
triangle_mapping_3 = TriangleMapping(Geometry=curve_7, Source=curve_3, Target=curve_5)  # -> simplify(Geometry), Transform
pack_objects = PackObjects(Geo=boundary_surfaces, Plane=evaluate_surface.Frame, X="1", Y="0", Tolerabce=0)  # -> Geo, Transformation
series = Series(Start=0, Step=1, Count=list_length)
discontinuity_2 = Discontinuity(Curve=triangle_mapping_3.Geometry, Level=1)  # -> Points, Parameters
deconstruct_brep = DeconstructBrep(Brep=pack_objects.Geo)  # -> Faces, Edges, Vertices
text = Text(Location=area_2.Centroid, Text=series, Size=1)
cull_index = CullIndex(List=discontinuity_2.Points, Indices="-1", Wrap=True)
join_curves = JoinCurves(Curves=deconstruct_brep.Edges, Preserve=False)
text_2 = Text(Location=cull_index, Text=panel_3, Size="0.3")  # -> simplify(Curves)
transform = Transform(Geometry=text, Transform=graft(pack_objects.Transformation))
boundary_surfaces_2 = BoundarySurfaces(Edges=join_curves)  # -> flatten(Surfaces)
length = Length(Curve=join_curves)
shift_paths = ShiftPaths(Data=text_2, Offset=-1)
sort_list = SortList(Keys=length, ValuesValuesA=join_curves)  # -> Keys, ValuesValuesA
transform_2 = Transform(Geometry=shift_paths, Transform=graft(pack_objects.Transformation))
list_item = ListItem(List=sort_list.ValuesValuesA, Index="-1", Wrap=True)  # -> flatten(Item)
opennest = OpenNest(
    Sheets=curve_6,
    Geo=list_item,
    Spacing=1,
    Placement=1,
    Tolerance=0.1,
    Rotations=4,
    Iterations=1,
    Seed=1,
    Reset=True,
    Run=False)  # -> Sheets, Geo, ID, Transform, IDS
transform_3 = Transform(Geometry=pack_objects.Geo, Transform=opennest.Transform)
transform_4 = Transform(Geometry=transform, Transform=graft(opennest.Transform))
curve_8 = Curve(opennest.Sheets)
transform_5 = Transform(Geometry=transform_2, Transform=graft(opennest.Transform))
deconstruct_brep_2 = DeconstructBrep(Brep=transform_3)  # -> Faces, Edges, Vertices
curve_9 = Curve(transform_4)
curve_10 = Curve(transform_5)
join_curves_2 = JoinCurves(Curves=deconstruct_brep_2.Edges, Preserve=False)
curve_11 = Curve(join_curves_2)

# ---- group: 01 / Source + remeshing
# 01 / Source + remeshing
# Surface, boundary curves and mesh controls.
surface_2 = Surface(<surface referenced from the Rhino model>)
xy_plane = XYPlane(Origin=Point(0, 0, 0))
number_slider = Slider(0.698, range=0..1)
curve_12 = Curve([<curve referenced from the Rhino model> x5])

# ---- group: 02 / Boundary controls
# 02 / Boundary controls
# Select and constrain the saved boundary vertices.
panel_4 = Panel("0")
curve_13 = Curve(<curve referenced from the Rhino model>)
number_slider_2 = Slider(0.055, range=0..10)
panel_5 = Panel("0.2")
unit_z = UnitZ(Factor="0.02")

# ---- group: 03 / Goals + relaxation
# 03 / Goals + relaxation
# Combine length, load and anchor goals for the solver.
panel_6 = Panel("0.04")
unit_z_2 = UnitZ(Factor=panel_5)

# ---- group: 01 / Source + remeshing (continued)
triremesh = TriRemesh(Geometry=surface_2, Length=panel_6, Iterations=25)  # -> Triangulation, Dual, Creases
deconstruct_mesh = DeconstructMesh(Mesh=triremesh.Triangulation)  # -> Vertices, Faces, Colours, Normals
point_list = PointList(Points=deconstruct_mesh.Vertices, Size="0.01")

# ---- group: 02 / Boundary controls (continued)
point_in_curve = PointInCurve(Point=graft(deconstruct_mesh.Vertices), Curve=curve_12)  # -> Relationship, Point
nakedvertices = NakedVertices(Mesh=triremesh.Triangulation)  # -> ClothedIndex, NakedIndex, ClothedPts, NakedPts
mass_addition = MassAddition(Input=point_in_curve.Relationship)  # -> flatten(Result), PartialResults
point_in_curve_2 = PointInCurve(Point=graft(deconstruct_mesh.Vertices), Curve=curve_13)  # -> Relationship, Point
point = Point(nakedvertices.NakedPts)
cull_pattern_2 = CullPattern(List=deconstruct_mesh.Vertices, CullPattern=mass_addition.Result)
mass_addition_2 = MassAddition(Input=point_in_curve_2.Relationship)  # -> flatten(Result), PartialResults
anchorxyz = AnchorXYZ(Point=point, X="1", Y="1", Z=False, Strength="100")
cull_pattern_3 = CullPattern(List=deconstruct_mesh.Vertices, CullPattern=mass_addition_2.Result)
move = Move(Geometry=cull_pattern_3, Motion=unit_z)  # -> Geometry, Transform
anchor = Anchor(Point=cull_pattern_3, Target=move.Geometry, Strength=10000)

# ---- group: 03 / Goals + relaxation (continued)
mesh_edges = MeshEdges(Mesh=triremesh.Triangulation)  # -> NakedEdges, InteriorEdges, NonManifoldEdges
anchor_2 = Anchor(Point=cull_pattern_2, Strength=10000)
show = Show(G=triremesh.Triangulation)
panel_7 = Panel(triremesh.Triangulation)
load = Load(Point=deconstruct_mesh.Vertices, ForceVector=unit_z_2, Weighting=1)
merge_2 = Merge(Data1=mesh_edges.NakedEdges, Data2=mesh_edges.InteriorEdges)
length_line = LengthLine(Line=merge_2, Length=panel_4, Strength=10)
panel_8 = Panel(merge_2)
entwine = Entwine(
    Branch00=length_line,
    Branch01=anchor_2,
    Branch02=load,
    Branch03=anchor,
    Branch04=anchorxyz,
    Branch05=show,
    FlattenInputs=True)
bouncysolver = BouncySolver(GoalObjects=entwine, Reset=Button(), Threshold=1e-15, Tolerance=0.0001, Damping=0.99, Iterations="10", On=Toggle(True))  # -> I, V, O
list_item_2 = ListItem(List=bouncysolver.O, Index="-1", Wrap=True)
custom_preview_2 = CustomPreview(
    Geometry=list_item_2,
    Material={diffuse=RGB(221, 160, 221), emission=RGB(66, 48, 66), shine=0.5, specular=RGB(255, 255, 255), transparency=0})

# ---- group: 01 / Source + remeshing (continued)
mirror = Mirror(Geometry=list_item_2, Plane=xy_plane)  # -> Geometry, Transform
merge_3 = Merge(Data1=list_item_2, Data2=mirror.Geometry)
combine_clean = CombineClean(Meshes=merge_3)
