# Grasshopper definition W04-inspection-flattening.gh (Grasshopper 1.0.8)

# ---- group: 01 / SOURCE
# 01 / SOURCE
# Exact contours / source UUID references
_442_saved_contours = _442SavedContours([<442 saved contours referenced from the Rhino model> x442])

# ---- group: 02 / FRAMES
# 02 / FRAMES
# Native planarity check + rigid bases
planar = Planar(Curve=_442_saved_contours)  # -> Planar, Plane, Deviation
part_local_frames = PartLocalFrames([Plane(origin=(0.06900401551, 0.3464219038, 0.088880351), x=(0.4170719048, -0.7890309505, -0.4510888885), y=(-0.8976607766, -0.2798903956, -0.3403916811)), Plane(origin=(0.06899830161, 0.4654052072, 0.1057815567), x=(0.4898344875, -0.8706526312, 0.04501300472), y=(-0.8649223013, -0.4788335174, 0.1504256469)), Plane(origin=(0.09945707659, 0.6237267116, 0.0001140129339), x=(-0.9263461373, -0.3766670576, -0.002182120905), y=(0.3766632571, -0.9263481702, 0.001964255554)), Plane(origin=(0.1036668386, 0.4861152463, 0.09824952252), x=(0.4988364294, -0.8657821796, 0.03979238802), y=(-0.844823364, -0.4754848837, 0.2453316308)), Plane(origin=(0.131857836, 0.5576444957, 0.07208769673), x=(-0.9187645448, -0.1161239192, -0.3773419491), y=(0.1345286039, 0.8064865283, -0.5757443307)), Plane(origin=(0.1013867369, 0.5629140686, 0.0517735378), x=(0.8854883153, 0.1070829219, 0.4521544994), y=(-0.1241687676, -0.883165807, 0.4523276186))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])
catalogue_planes = CataloguePlanes([PlaneXY(0.01103188584, 0.03947426145, 0), PlaneXY(0.1130480568, 0.03158197398, 0), PlaneXY(0.2191409533, 0.01496957138, 0), PlaneXY(0.324136792, 0.03269385448, 0), PlaneXY(0.4316171825, 0.03708639142, 0), PlaneXY(0.5372837528, 0.03333497119, 0)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])

# ---- group: 03 / ORIENT
# 03 / ORIENT
# Plane to plane / no stretch
orient = Orient(Geometry=_442_saved_contours, Source=part_local_frames, Target=catalogue_planes)  # -> Geometry, Transform

# ---- group: 04 / VERIFY
# 04 / VERIFY
# 442 outputs / area + perimeter
flattened_outlines = FlattenedOutlines(orient.Geometry)
area = Area(Geometry=flattened_outlines)  # -> Area, Centroid
len = Length(Curve=flattened_outlines)
lng = ListLength(List=flattened_outlines)
part_count = Panel(lng)
