# Grasshopper definition historical-part-construction.gh (Grasshopper 1.0.7)
# plug-ins: Kangaroo2 Components

curve = Curve(<curve referenced from the Rhino model>)

number_slider = Slider(7.593, range=1..11)
explode = Explode(Curve=curve, Recursive=True)  # -> flatten(Segments), Vertices
polygon_center = PolygonCenter(Polyline=curve)  # -> CenterV, CenterE, CenterA
discontinuity = Discontinuity(Curve=curve, Level=1)  # -> Points, Parameters
circle_cnr = CircleCNR(Center=polygon_center.CenterV, Normal=Vector(0, 0, 1), Radius=number_slider)  # -> graft(Circle)
curve_curve = CurveCurve(CurveA=explode.Segments, CurveB=circle_cnr)  # -> Points, ParamsA, ParamsB
panel = Panel("""0
1""")
dispatch = Dispatch(List=curve_curve.Points, DispatchPattern=panel)  # -> flatten(ListA), ListB
removeduplicatepts = RemoveDuplicatePts(Points=dispatch.ListA, Tolerance=0.01)
removeduplicatepts_2 = RemoveDuplicatePts(Points=discontinuity.Points, Tolerance=0.01)
removeduplicatepts_3 = RemoveDuplicatePts(Points=polygon_center.CenterV, Tolerance=0.01)

circle_cnr_2 = CircleCNR(Center=removeduplicatepts_3, Normal=Vector(0, 0, 1), Radius=number_slider)  # -> graft(Circle)
point_in_curve = PointInCurve(Point=removeduplicatepts, Curve=circle_cnr_2)  # -> Relationship, Point
cull_pattern = CullPattern(List=removeduplicatepts, CullPattern=point_in_curve.Relationship)
line = Line(StartPoint=cull_pattern, EndPoint=graft(removeduplicatepts_3))

circle_cnr_3 = CircleCNR(Center=removeduplicatepts_2, Normal=Vector(0, 0, 1), Radius=Slider(7, range=0..10))  # -> graft(Circle)
point_in_curve_2 = PointInCurve(Point=removeduplicatepts, Curve=circle_cnr_3)  # -> Relationship, Point
cull_pattern_2 = CullPattern(List=removeduplicatepts, CullPattern=point_in_curve_2.Relationship)
line_2 = Line(StartPoint=cull_pattern_2, EndPoint=graft(removeduplicatepts_2))

cluster = Cluster(
    set_a=removeduplicatepts,
    set_a_2=removeduplicatepts,
    point=removeduplicatepts_2,
    point_2=removeduplicatepts_2,
    point_3=removeduplicatepts_2,
    geometry=removeduplicatepts,
    start_point=removeduplicatepts_2,
    end_point_2=removeduplicatepts_2,
    end_point=removeduplicatepts_2)  # disabled
merge = Merge(Data1=line_2, Data2=line)  # -> graft(Result)
number_slider_2 = Slider(0.841, range=0..1)
circle_cnr_4 = CircleCNR(Center=[removeduplicatepts, removeduplicatepts_2], Normal=Vector(0, 0, 1), Radius=1)  # -> flatten(Circle); disabled

number_slider_3 = Slider(1.578, range=0..5)
offset_curve = OffsetCurve(Curve=merge, Distance=number_slider_3, Corners=1)  # -> graft(Curve)
offset_curve_2 = OffsetCurve(Curve=merge, Distance=expr("-x", number_slider_3), Corners=1)  # -> graft(Curve)
loft = Loft(
    Curves=[offset_curve, offset_curve_2],
    Options={Adjust=False, Closed=False, LoftEnds=0, LoftSimp=0, LoftType=0, Rebuild=10, Refit=0.01})
brep_edges = BrepEdges(Brep=loft)  # -> Naked, Interior, NonManifold

circle_cnr_5 = CircleCNR(Center=[removeduplicatepts, removeduplicatepts_2], Normal=Vector(0, 0, 1), Radius=number_slider_3)  # -> flatten(Circle)

join_curves = JoinCurves(Curves=[brep_edges.Naked, circle_cnr_5], Preserve=False)
region_union = RegionUnion(Curves=flatten(join_curves))
fillet = Fillet(Curve=region_union, Radius=Slider(1.392, range=0..10))

region_difference = RegionDifference(CurvesA=fillet, CurvesB=circle_cnr_4)  # disabled
boundary_surfaces = BoundarySurfaces(Edges=fillet)

# ==== cluster Cluster
point = ClusterInput()
geometry = ClusterInput()
start_point = ClusterInput()
pull_point = PullPoint(Point=point, Geometry=geometry, ClosestOnly=True)  # -> ClosestPoint, Distance
line = Line(StartPoint=start_point, EndPoint=pull_point.ClosestPoint)
set_a = ClusterInput()
set_difference = SetDifference(SetA=set_a, SetB=pull_point.ClosestPoint)
point_2 = ClusterInput()
end_point = ClusterInput()
pull_point_2 = PullPoint(Point=point_2, Geometry=set_difference, ClosestOnly=True)  # -> ClosestPoint, Distance
line_2 = Line(StartPoint=pull_point_2.ClosestPoint, EndPoint=end_point)
set_a_2 = ClusterInput()
set_difference_2 = SetDifference(SetA=set_a_2, SetB=pull_point_2.ClosestPoint)
point_3 = ClusterInput()
end_point_2 = ClusterInput()
pull_point_3 = PullPoint(Point=point_3, Geometry=set_difference_2, ClosestOnly=True)  # -> ClosestPoint, Distance
line_3 = Line(StartPoint=pull_point_3.ClosestPoint, EndPoint=end_point_2)
