# Grasshopper definition historical-relaxation.gh (Grasshopper 1.0.7)
# plug-ins: Kangaroo2 Components, LunchBox, OpenNest

surface = Surface(<surface referenced from the Rhino model>)
curve = Curve([<curve referenced from the Rhino model> x5])
triremesh = TriRemesh(Geometry=surface, Length="0.04", Iterations=25)  # -> Triangulation, Dual, Creases
deconstruct_mesh = DeconstructMesh(Mesh=triremesh.Triangulation)  # -> Vertices, Faces, Colours, Normals
point_in_curve = PointInCurve(Point=graft(deconstruct_mesh.Vertices), Curve=curve)  # -> Relationship, Point
panel = Panel(triremesh.Triangulation)
nakedvertices = NakedVertices(Mesh=triremesh.Triangulation)  # -> ClothedIndex, NakedIndex, ClothedPts, NakedPts
mass_addition = MassAddition(Input=point_in_curve.Relationship)  # -> flatten(Result), PartialResults
mesh_edges = MeshEdges(Mesh=triremesh.Triangulation)  # -> NakedEdges, InteriorEdges, NonManifoldEdges
point = Point(nakedvertices.NakedPts)
curve_2 = Curve(<curve referenced from the Rhino model>)
anchorxyz = AnchorXYZ(Point=point, X="1", Y="1", Z=False, Strength="100")
point_in_curve_2 = PointInCurve(Point=graft(deconstruct_mesh.Vertices), Curve=curve_2)  # -> Relationship, Point
merge = Merge(Data1=mesh_edges.NakedEdges, Data2=mesh_edges.InteriorEdges)
number_slider = Slider(0.055, range=0..10)
point_list = PointList(Points=deconstruct_mesh.Vertices, Size="0.01")
cull_pattern = CullPattern(List=deconstruct_mesh.Vertices, CullPattern=mass_addition.Result)
mass_addition_2 = MassAddition(Input=point_in_curve_2.Relationship)  # -> flatten(Result), PartialResults
curve_3 = Curve(<curve referenced from the Rhino model>)
panel_2 = Panel(merge)
unit_z = UnitZ(Factor="0.2")
surface_2 = Surface(curve_3)
unit_z_2 = UnitZ(Factor="0.02")
cull_pattern_2 = CullPattern(List=deconstruct_mesh.Vertices, CullPattern=mass_addition_2.Result)

# ----
# goals
load = Load(Point=deconstruct_mesh.Vertices, ForceVector=unit_z, Weighting=1)
length_line = LengthLine(Line=merge, Length="0", Strength=10)
anchor = Anchor(Point=cull_pattern, Strength=10000)
show = Show(G=triremesh.Triangulation)

triangle_panels_b = TrianglePanelsB(Surface=surface_2, UDivisions=10, VDivisions=10)
move = Move(Geometry=cull_pattern_2, Motion=unit_z_2)  # -> Geometry, Transform
area = Area(Geometry=triangle_panels_b)  # -> Area, Centroid
anchor_2 = Anchor(Point=cull_pattern_2, Target=move.Geometry, Strength=10000)
entwine = Entwine(
    Branch00=length_line,
    Branch01=anchor,
    Branch02=load,
    Branch03=anchor_2,
    Branch04=anchorxyz,
    Branch05=show,
    FlattenInputs=True)
larger_than = LargerThan(FirstNumber=area.Area, SecondNumber="20")  # -> LargerThan, OrEqualTo
bouncysolver = BouncySolver(GoalObjects=entwine, Reset=Button(), Threshold=1e-15, Tolerance=0.0001, Damping=0.99, Iterations="10", On=Toggle(True))  # -> I, V, O
panel_3 = Panel(larger_than.LargerThan)
number_slider_2 = Slider(0.698, range=0..1)
list_item = ListItem(List=bouncysolver.O, Index="-1", Wrap=True)
cull_pattern_3 = CullPattern(List=triangle_panels_b, CullPattern=larger_than.LargerThan)
xy_plane = XYPlane(Origin=Point(0, 0, 0))
mirror = Mirror(Geometry=list_item, Plane=xy_plane)  # -> Geometry, Transform
custom_preview = CustomPreview(
    Geometry=list_item,
    Material={diffuse=RGB(221, 160, 221), emission=RGB(66, 48, 66), shine=0.5, specular=RGB(255, 255, 255), transparency=0})
merge_2 = Merge(Data1=list_item, Data2=mirror.Geometry)
combine_clean = CombineClean(Meshes=merge_2)

# ----
# center of (a,b,c)
curve_4 = Curve(<curve referenced from the Rhino model>)

mesh = Mesh(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)
curve_5 = Curve(graft(cull_pattern_3))

# ----
# خط اتصال مراکز اتصال پیچ‌ها
curve_6 = Curve(<curve referenced from the Rhino model>)

# ----
# در این قسمت خطوط ماژول طراحی شده ست میشوند
curve_7 = Curve([<curve referenced from the Rhino model> x12])

# ----
# مثلث پایه ماژول
curve_8 = Curve(<curve referenced from the Rhino model>)

triangle_mapping = TriangleMapping(Geometry=curve_6, Source=curve_8, Target=curve_5)  # -> simplify(Geometry), Transform

triangle_mapping_2 = TriangleMapping(Geometry=curve_4, Source=curve_8, Target=curve_5)  # -> simplify(Geometry), Transform
discontinuity = Discontinuity(Curve=triangle_mapping_2.Geometry, Level=1)  # -> Points, Parameters
cull_index = CullIndex(List=discontinuity.Points, Indices="-1", Wrap=True)
panel_4 = Panel("""l
ll""")
text = Text(Location=cull_index, Text=panel_4, Size="0.3")  # -> simplify(Curves)

triangle_mapping_3 = TriangleMapping(Geometry=curve_7, Source=curve_8, Target=curve_5)  # -> simplify(Geometry), Transform
discontinuity_2 = Discontinuity(Curve=triangle_mapping.Geometry, Level=1)  # -> Points, Parameters
circle = Circle(Plane=discontinuity_2.Points, Radius="0.15")  # -> simplify(Circle)
merge_3 = Merge(Data1=triangle_mapping_3.Geometry, Data2=circle)

# ----
# در هر شاخه سطوح با حفره‌های
#  داخلش ایجاد میشود
boundary_surfaces = BoundarySurfaces(Edges=merge_3)  # -> flatten(Surfaces)

area_2 = Area(Geometry=boundary_surfaces)  # -> Area, Centroid
list_length = ListLength(List=area_2.Centroid)
series = Series(Start=0, Step=1, Count=list_length)
text_2 = Text(Location=area_2.Centroid, Text=series, Size=1)

shift_paths = ShiftPaths(Data=text, Offset=-1)
evaluate_surface = EvaluateSurface(Surface=reparameterize(boundary_surfaces), Point="0.5,0.5")  # -> Point, Normal, UDirection, VDirection, Frame
custom_preview_2 = CustomPreview(
    Geometry=boundary_surfaces,
    Material={diffuse=RGB(221, 160, 221), emission=RGB(66, 48, 66), shine=0.5, specular=RGB(255, 255, 255), transparency=0})
pack_objects = PackObjects(Geo=boundary_surfaces, Plane=evaluate_surface.Frame, X="1", Y="0", Tolerabce=0)  # -> Geo, Transformation
deconstruct_brep = DeconstructBrep(Brep=pack_objects.Geo)  # -> Faces, Edges, Vertices
transform = Transform(Geometry=text_2, Transform=graft(pack_objects.Transformation))
transform_2 = Transform(Geometry=shift_paths, Transform=graft(pack_objects.Transformation))
join_curves = JoinCurves(Curves=deconstruct_brep.Edges, Preserve=False)
boundary_surfaces_2 = BoundarySurfaces(Edges=join_curves)  # -> flatten(Surfaces)
length = Length(Curve=join_curves)
sort_list = SortList(Keys=length, ValuesValuesA=join_curves)  # -> Keys, ValuesValuesA
list_item_2 = ListItem(List=sort_list.ValuesValuesA, Index="-1", Wrap=True)  # -> flatten(Item)
curve_9 = Curve(<curve referenced from the Rhino model>)
opennest = OpenNest(
    Sheets=curve_9,
    Geo=list_item_2,
    Spacing=1,
    Placement=1,
    Tolerance=0.1,
    Rotations=4,
    Iterations=1,
    Seed=1,
    Reset=True,
    Run=False)  # -> Sheets, Geo, ID, Transform, IDS
transform_3 = Transform(Geometry=pack_objects.Geo, Transform=opennest.Transform)
transform_4 = Transform(Geometry=transform, Transform=graft(opennest.Transform))
transform_5 = Transform(Geometry=transform_2, Transform=graft(opennest.Transform))
deconstruct_brep_2 = DeconstructBrep(Brep=transform_3)  # -> Faces, Edges, Vertices
join_curves_2 = JoinCurves(Curves=deconstruct_brep_2.Edges, Preserve=False)
curve_10 = Curve(join_curves_2)
curve_11 = Curve(transform_4)
curve_12 = Curve(opennest.Sheets)
curve_13 = Curve(transform_5)
