# Grasshopper definition tower-v4-source.gh (Grasshopper 1.0.8)
# plug-ins: Karamba3D

number_slider = Slider(439, range=0..1000)
number_slider_2 = Slider(40, range=0..100)
series = Series(Start=Slider(30, range=0..1000), Step=Slider(0.05, range=0..1), Count=number_slider_2)
graph_mapper = GraphMapper(
    series,
    x0=0,
    x1=1,
    y0=0,
    y1=1,
    A=-0.007711648941,
    B=0.504966855,
    container_name="Linear",
    Graph_x0=0,
    Graph_x1=1,
    Graph_y0=0.504966855,
    Graph_y1=0.4972552061)
panel = Panel(graph_mapper)
multiplication = Multiplication(A=panel, B=Slider(0, range=0..100))
radians = Radians(Degrees=multiplication)
series_2 = Series(Start=0, Step=1, Count=10)
series_3 = Series(Start=Slider(0, range=0..100), Step=Slider(4, range=0..100), Count=number_slider_2)
number_slider_3 = Slider(10, range=0..10)
number_slider_4 = Slider(30, range=0..100)
number_slider_5 = Slider(53, range=0..100)
series_4 = Series(Start=0, Step=Slider(0.1, range=0..0.1), Count=Slider(30, range=0..100))
construct_point = ConstructPoint(XCoordinate=0, YCoordinate=0, ZCoordinate=0)
construct_point_2 = ConstructPoint(XCoordinate=0, YCoordinate=0, ZCoordinate=0)
graph_mapper_2 = GraphMapper(
    series_4,
    x0=0,
    x1=1,
    y0=0,
    y1=1,
    container_name="Sine Summation",
    Equation0_px=[0.3461886644, 0.3363626003],
    Equation0_py=[0.1571659446, 0.4846994281],
    Equation1_px=[0.6540699005, 0.9022992849],
    Equation1_py=[0.356534183, 0.1678464413])
unit_z = UnitZ(Factor=1)
series_5 = Series(Start=0, Step=Slider(0.025, range=0..1), Count=number_slider_2)
series_6 = Series(Start=0, Step=Slider(0.05, range=0..1), Count=number_slider_2)
unit_z_2 = UnitZ(Factor=series_3)
graph_mapper_3 = GraphMapper(
    series_5,
    x0=0,
    x1=1,
    y0=0,
    y1=1,
    container_name="Bezier",
    cpx=[0, 0.6120269299, 0.4656822383, 1],
    cpy=[0.6393991709, 0.7052686214, 0.3289543986, 0.3873195648])
panel_2 = Panel(graph_mapper_2)
graph_mapper_4 = GraphMapper(
    series_5,
    x0=0,
    x1=1,
    y0=0,
    y1=1,
    container_name="Sine",
    Equation_px=[0, 0.7403717041],
    Equation_py=[0.6561155319, 0.4406030774])
graph_mapper_5 = GraphMapper(
    series_5,
    x0=0,
    x1=1,
    y0=0,
    y1=1,
    container_name="Sine Summation",
    Equation0_px=[0.428276062, 0.4112478197],
    Equation0_py=[0.3219666481, 0.1601191163],
    Equation1_px=[0.4728431106, 1],
    Equation1_py=[0.2743981481, 0.2601937652])
move = Move(Motion=Vector(0, 0, 10))  # -> Geometry, Transform
graph_mapper_6 = GraphMapper(
    series_6,
    x0=0,
    x1=1,
    y0=0,
    y1=1,
    A=0.3948915504,
    B=0.502972126,
    container_name="Linear",
    Graph_x0=0,
    Graph_x1=0.9991906881,
    Graph_y0=0.502972126,
    Graph_y1=0.897544086)
flip_matrix = FlipMatrix()
panel_3 = Panel(graph_mapper_3)
panel_4 = Panel(graph_mapper_6)
polyline = PolyLine(Closed=False)
divide_curve = DivideCurve(Count=Slider(20, range=0..100), Kinks=False)  # -> Points, Tangents, Parameters
offset_curve_loose = OffsetCurveLoose(Distance="-0.5")
series_7 = Series(Start=0, Step="-1", Count=10)  # -> graft(Series)
series_8 = Series(Start=0, Step="-1", Count=number_slider_2)  # -> graft(Series)
series_9 = Series(Start=0, Step="1", Count=number_slider_2)  # -> graft(Series)
multiplication_2 = Multiplication(A=panel_4, B=Slider(100, range=0..100))
radians_2 = Radians(Degrees=multiplication_2)
series_10 = Series(Start=Slider(1, range=0..1), Step=Slider(1, range=-10..1), Count=number_slider_2)
loft = Loft(
    Curves=flatten(offset_curve_loose),
    Options={Adjust=False, Closed=False, LoftEnds=0, LoftSimp=0, LoftType=0, Rebuild=10, Refit=0.01})
multiplication_3 = Multiplication(A=panel_3, B=Slider(13, range=0..100))
shift_list = ShiftList(List=divide_curve.Points, Shift=series_7, Wrap=True)
modulus = Modulus(A=series_10, B=Slider(2, range=0..10))
flip_matrix_2 = FlipMatrix(Data=divide_curve.Points)
flip_matrix_3 = FlipMatrix(Data=shift_list)
cross_section_karamba3d = CroSec(
    FamilyNameOfCrossSection="DefaultCroSec",
    Height_cm=9.6,
    UpperFlangeWidth_cm=10,
    LowerFlangeWidth_cm=10,
    UpperFlangeThickness_cm=0.8,
    LowerFlangeThickness_cm=0.8,
    WebThickness_cm=0.5,
    FilletRadius_cm=0,
    mode="I")
tree_branch = TreeBranch(Tree=simplify(divide_curve.Points), Path=Slider(0, range=0..100), MaintainPaths=True)
addition = Addition(A=modulus, B=Slider(1, range=0..10))
multiplication_4 = Multiplication(A=addition, B=Slider(0.2, range=0..1))
multiplication_5 = Multiplication(A=addition, B=Slider(1, range=0..1))
addition_2 = Addition(A=multiplication_5, B=multiplication_3)
polyline_2 = PolyLine(Vertices=divide_curve.Points, Closed=False)
polyline_3 = PolyLine(Vertices=flip_matrix_2, Closed=False)
polyline_4 = PolyLine(Vertices=flip_matrix_3, Closed=False)
multiplication_6 = Multiplication(A=addition_2, B=Slider(1, range=0..100))
polygon = Polygon(Plane=construct_point_2, Radius=multiplication_6, Segments=Slider(4, range=0..10), FilletRadius=0)  # -> Polygon, Length
rotate = Rotate(Geometry=polygon.Polygon, Angle=radians, Plane=PlaneXY(0, 0, 0))  # -> Geometry, Transform
entwine = Entwine(Branch00=polygon.Polygon, Branch01=rotate.Geometry, FlattenInputs=True)
flip_matrix_4 = FlipMatrix(Data=entwine)  # -> simplify(Data)
region_union = RegionUnion(Curves=flip_matrix_4)  # -> flatten(Result)
circle_cnr = CircleCNR(Center=construct_point_2, Normal=Vector(0, 0, 1), Radius=multiplication_6)
curve = Curve(simplify(region_union))
rotate_2 = Rotate(Geometry=curve, Angle=radians_2, Plane=PlaneXY(0, 0, 0))  # -> Geometry, Transform
rotate_3 = Rotate(Geometry=rotate_2.Geometry, Angle=multiplication_4, Plane=PlaneXY(0, 0, 0))  # -> Geometry, Transform
move_2 = Move(Geometry=rotate_3.Geometry, Motion=unit_z_2)  # -> Geometry, Transform
flip_matrix_5 = FlipMatrix(Data=move_2.Geometry)
polyline_5 = PolyLine(Vertices=flip_matrix_5, Closed=False)
divide_curve_2 = DivideCurve(Curve=move_2.Geometry, Count=Slider(8, range=0..100), Kinks=Slider(1, range=0..1))  # -> Points, Tangents, Parameters
offset_curve_loose_2 = OffsetCurveLoose(Curve=move_2.Geometry, Distance="-0.05")
loft_2 = Loft(
    Curves=flatten(offset_curve_loose_2),
    Options={Adjust=False, Closed=False, LoftEnds=0, LoftSimp=0, LoftType=0, Rebuild=10, Refit=0.01})
shift_list_2 = ShiftList(List=divide_curve_2.Points, Shift=series_8, Wrap=True)
shift_list_3 = ShiftList(List=divide_curve_2.Points, Shift=series_9, Wrap=True)
flip_matrix_6 = FlipMatrix(Data=divide_curve_2.Points)
flip_matrix_7 = FlipMatrix(Data=shift_list_2)
flip_matrix_8 = FlipMatrix(Data=shift_list_3)
panel_5 = Panel(multiplication_6)
polyline_6 = PolyLine(Vertices=divide_curve_2.Points, Closed=Slider(1, range=0..1))
polyline_7 = PolyLine(Vertices=flip_matrix_6, Closed=False)
polyline_8 = PolyLine(Vertices=flip_matrix_7, Closed=False)
polyline_9 = PolyLine(Vertices=flip_matrix_8, Closed=False)
tree_branch_2 = TreeBranch(Tree=simplify(divide_curve_2.Points), Path=Slider(0, range=0..100), MaintainPaths=True)
cross_section_range_selector_karamba3d = CroSecRSelect(MaximumHeight_cm=-1, MaximumWidth_cm=-1, menu=[dropdown(2), dropdown(1), dropdown(1)])
brep = Brep(loft)
boundary_surfaces = BoundarySurfaces(Edges=polyline_2)
number_slider_6 = Slider(5, range=0..10)
brep_2 = Brep(loft_2)
entwine_2 = Entwine(Branch00=polyline_2, Branch01=polyline_3, Branch02=polyline_4, FlattenInputs=True)
boundary_surfaces_2 = BoundarySurfaces(Edges=polyline_6)
number_slider_7 = Slider(5, range=0..10)
mesh_brep = MeshBrep(
    Brep=brep,
    Settings={GridMaxCount=0, GridMinCount=16, JaggedSeams=False, MaxEdgeLength=0, MinEdgeLength=0.0001, MinTolerance=0, Refine=True, RefineAngle=0, RelativeTolerance=0.65, SimplePlanes=True, Tolerance=0})
mesh_surface = MeshSurface(Surface=boundary_surfaces, UCount=number_slider_6, VCount=number_slider_6, Overhang=True, Equalize=False)
list_item = ListItem(Index=0, Wrap=True)  # -> flatten(Item)
unit_z_3 = UnitZ(Factor=1)
unit_z_4 = UnitZ(Factor=1)
unit_x = UnitX(Factor=1)
unit_y = UnitY(Factor=1)
mesh_brep_2 = MeshBrep(
    Brep=brep_2,
    Settings={GridMaxCount=0, GridMinCount=16, JaggedSeams=False, MaxEdgeLength=0, MinEdgeLength=0.0001, MinTolerance=0, Refine=True, RefineAngle=0, RelativeTolerance=0.65, SimplePlanes=True, Tolerance=0})
triremesh = TriRemesh(Geometry=boundary_surfaces_2, Iterations=25)  # -> Triangulation, Dual, Creases
material_selection_karamba3d = MatSelect(menu=[dropdown(0), dropdown(0)])
pipe = Pipe(Radius=Slider(0.03, range=0..0.1), Caps=0)
entwine_3 = Entwine(Branch00=polyline_6, Branch01=polyline_7, Branch02=polyline_8, Branch03=polyline_9, FlattenInputs=True)
loads_karamba3d = Loads(Vector=[unit_y, unit_x], LCase="LC0", mode="MeshLoad -Const.", menu=[buttons(on, off, off), buttons(on, on)])
loads_karamba3d_2 = Loads(Vector=unit_z_3, LCase="LC0", mode="MeshLoad -Const.", menu=[buttons(on, off, off), buttons(on, on)])
create_linear_element_karamba3d = LineElem(
    Line=flatten(entwine_2),
    LimitDistance_m=0.005,
    BucklingLengthY_m=-1,
    BucklingLengthZ_m=-1,
    BucklingLengthLT_m=-1,
    Bending=True,
    ToPolylineMaxAngle=0.25,
    ToPolylineTolerance=0.1,
    ToPolylineMaxEdgeLength=0.25,
    New=True,
    Remove=True,
    mode="LineToBeam")  # -> Element, Points, Info
create_surface_element_karamba3d = SurfElem(Mesh=flatten(mesh_surface), LimitDistance_m=0.005, Bending=True, mode="MeshToShell")  # -> Element, Points, Info
create_surface_element_karamba3d_2 = SurfElem(Mesh=flatten(mesh_brep), LimitDistance_m=0.005, Bending=True, mode="MeshToShell")  # -> Element, Points, Info
support_karamba3d = Supp(PosInd=list_item, Ct_kN_m=Vector(0, 0, 0), Cr_kNm_rad=Vector(0, 0, 0), menu=[buttons(on, on, on, on, on, on)])
loads_karamba3d_3 = Loads(Vector=unit_z_4, LCase="LC0", mode="Gravity")
explode = Explode(Curve=entwine_3, Recursive=True)  # -> Segments, Vertices
trim = TrimTree(Tree=explode.Segments, Depth=1)

offset_l = OffsetCurveLoose(Curve=polyline_6, Distance=expr("-x", Slider(0.5, range=0..1)))  # -> flatten(Curve)
panel_6 = Panel("facade")
loft_3 = Loft(Curves=offset_l, Options={Adjust=False, Closed=False, LoftEnds=0, LoftSimp=0, LoftType=0, Rebuild=10, Refit=0.01})
mesh = MeshBrep(
    Brep=loft_3,
    Settings={GridMaxCount=0, GridMinCount=16, JaggedSeams=False, MaxEdgeLength=0, MinEdgeLength=0.0001, MinTolerance=0, Refine=True, RefineAngle=0, RelativeTolerance=0.65, SimplePlanes=True, Tolerance=0})
mjoin = MeshJoin(Meshes=flatten(triremesh.Triangulation))
panel_7 = Panel("""beam
floor""")
Y = UnitY(Factor=Slider(2, range=0..10))
X = UnitX(Factor=Slider(2, range=0..10))
Z = UnitZ(Factor=Slider(-4, range=-20..-1))
loads_karamba3d_4 = Loads(
    Vector=Z,
    Mesh=mjoin,
    ElementIdentifiers=graft(panel_7),
    LCase="LC0",
    mode="MeshLoad -Const.",
    menu=[buttons(off, on, off), buttons(on, on)])
loads_karamba3d_5 = Loads(
    Vector=Y,
    Mesh=mesh,
    ElementIdentifiers="beam",
    LCase="LC0",
    mode="MeshLoad -Const.",
    menu=[buttons(off, off, on), buttons(on, on)])
loads_karamba3d_6 = Loads(
    Vector=X,
    Mesh=mesh,
    ElementIdentifiers="beam",
    LCase="LC0",
    mode="MeshLoad -Const.",
    menu=[buttons(off, off, on), buttons(on, on)])

cross_section_karamba3d_2 = CroSec(
    FamilyNameOfCrossSection="DefaultCroSec",
    Diameter_cm=Slider(20, range=0..100),
    WallThickness_cm=Slider(3, range=0..10),
    mode="Circular Hollow")
cross_section_karamba3d_3 = CroSec(FamilyNameOfCrossSection="DefaultCroSec", Height_cm=Slider(10, range=0..10), mode="Shell - Const")
panel_8 = Panel("""beam
column
diagonal""")
create_linear_element_karamba3d_2 = LineElem(
    Line=trim,
    Identifier=graft(panel_8),
    CrossSection=cross_section_karamba3d_2,
    LimitDistance_m=0.005,
    BucklingLengthY_m=-1,
    BucklingLengthZ_m=-1,
    BucklingLengthLT_m=-1,
    Bending=True,
    ToPolylineMaxAngle=0.25,
    ToPolylineTolerance=0.1,
    ToPolylineMaxEdgeLength=0.25,
    New=True,
    Remove=True,
    mode="LineToBeam")  # -> Element, Points, Info
create_surface_element_karamba3d_3 = SurfElem(
    Mesh=flatten(triremesh.Triangulation),
    Identifier="floor",
    CrossSection=cross_section_karamba3d_3,
    LimitDistance_m=0.005,
    Bending=True,
    mode="MeshToShell")  # -> Element, Points, Info

item = ListItem(List=flip_matrix_6, Index="0", Wrap=True)
support_karamba3d_2 = Supp(PosInd=item, Ct_kN_m=Vector(0, 0, 0), Cr_kNm_rad=Vector(0, 0, 0), menu=[buttons(on, on, on, on, on, on)])

loads_karamba3d_7 = Loads(Vector=Vector(0, 0, -1), LCase="Gravity", mode="Gravity")
load = LoadKaramba3D([loads_karamba3d_5, loads_karamba3d_7, loads_karamba3d_4, loads_karamba3d_6])
support = SupportKaramba3D(support_karamba3d_2)
element = ElementKaramba3D([create_surface_element_karamba3d_3.Element, create_linear_element_karamba3d_2.Element])
assemble_model_karamba3d = Assemble(Elem=flatten(element), Support=flatten(support), Load=flatten(load), LimitDistance_m=0.005)  # -> Model, Info, Mass_kg, CentreOfGravity, LoadCaseNames
eigen_modes_karamba3d = EModesEModes(
    Model=assemble_model_karamba3d.Model,
    FromIndex=1,
    NumberOfModes=1,
    WithThIIEffects=True,
    MaximumNumberOfIterations=300,
    Epsilon=1e-07)  # -> ModelWithEigenModes, Eigenvalues
analyse_karamba3d = AnalyseAnalyze(Model=assemble_model_karamba3d.Model)  # -> AnalysedModel, MaximumDisplacement_cm, ResultingForce_kN, ChangeOfElasticEnergy_kNm
panel_9 = Panel(eigen_modes_karamba3d.Eigenvalues)
model_view_karamba3d = ModelView(Model=analyse_karamba3d.AnalysedModel)  # -> Model, DeformedMesh, DeformedAxes, DeformedModel, MaximumDeformation
shell_view_karamba3d = ShellView(Model=model_view_karamba3d.Model, IndexOfLayer=0)  # -> Model, MeshesOfRenderedShells, LegendColours, LegendTags
beam_view_karamba3d = BeamView(Model=model_view_karamba3d.Model)  # -> Model, MeshesOfRenderedBeams, DeformedBeamAxes, LegendColours, LegendTags

cross_section_selector_karamba3d = CroSecSelect()  # -> CrossSection, Info
cross_section_karamba3d_4 = CroSec(FamilyNameOfCrossSection="DefaultCroSec", Height_cm=1, mode="Shell - Const")
cross_section_karamba3d_5 = CroSec(FamilyNameOfCrossSection="DefaultCroSec", Height_cm=1, mode="Shell - Const")
load_karamba3d = LoadKaramba3D()
element_karamba3d = ElementKaramba3D()
legend = Legend(Colour=shell_view_karamba3d.LegendColours, Tags=shell_view_karamba3d.LegendTags, LegendType=1)
legend_2 = Legend(Colour=beam_view_karamba3d.LegendColours, Tags=beam_view_karamba3d.LegendTags, LegendType=1)
assemble_model_karamba3d_2 = Assemble(LimitDistance_m=0.005)  # -> Model, Info, Mass_kg, CentreOfGravity, LoadCaseNames
analyse_karamba3d_2 = AnalyseAnalyze(Model=assemble_model_karamba3d_2.Model)  # -> AnalysedModel, MaximumDisplacement_cm, ResultingForce_kN, ChangeOfElasticEnergy_kNm
model_view_karamba3d_2 = ModelView(Model=analyse_karamba3d_2.AnalysedModel)  # -> Model, DeformedMesh, DeformedAxes, DeformedModel, MaximumDeformation
shell_view_karamba3d_2 = ShellView(Model=model_view_karamba3d_2.Model, IndexOfLayer=0)  # -> Model, MeshesOfRenderedShells, LegendColours, LegendTags
beam_view_karamba3d_2 = BeamView(Model=model_view_karamba3d_2.Model)  # -> Model, MeshesOfRenderedBeams, DeformedBeamAxes, LegendColours, LegendTags
